# Grasshopper definition Meditation_interior_design_v2.gh (Grasshopper 1.0.7)
# plug-ins: Kangaroo2 Components, Heteroptera, ClipperComponents, treesloth01, ShapeDiverForGrasshopper, Pufferfish, Speckle 2

# units contour
# FIRE CYARD
geo = Geometry([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])
# AIR CYARD
# units contour
geo_2 = Geometry([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])

# ----
# units contour
# EARTH CYARD
geo_3 = Geometry([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])

# ----
# units contour
# WATER CYARD
geo_4 = Geometry([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])
sddp = ShapeDiverDocumentPayload({AbsoluteTolerance=0, AngleTolerance=0, DistanceDisplayPrecision=0, GltfVersion="Gltf2", GrasshopperVersion="1.0.0007", InputGroups="{}", OutputGroups="{}", RelativeTolerance=0, RhinoVersion="7.35.23346.11001", UnitSystem=0, VersionCreated="1.16.0.0", VersionSaved="1.16.0.0"})
debrep = DeconstructBrep(Brep=geo_4)  # -> Faces, Edges, Vertices
debrep_2 = DeconstructBrep(Brep=geo)  # -> Faces, Edges, Vertices
debrep_3 = DeconstructBrep(Brep=geo_2)  # -> Faces, Edges, Vertices
number_slider = Slider(2, range=0..2)  # disabled

geo_5 = Geometry([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])  # disabled
geo_6 = Geometry([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])  # disabled
geo_7 = Geometry([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])  # disabled
geo_8 = Geometry([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])  # disabled
entwine = Entwine(Branch00=geo_5, Branch01=geo_6, Branch02=geo_7, Branch03=geo_8, FlattenInputs=True)  # disabled
panel = Panel("-3.0")  # disabled
Z = UnitZ(Factor=panel)  # disabled
move = Move(Geometry=entwine, Motion=Z)  # -> Geometry, Transform; disabled
debrep_4 = DeconstructBrep(Brep=move.Geometry)  # -> Faces, Edges, Vertices; disabled
pcen = PolygonCenter(Polyline=debrep_4.Faces)  # -> CenterV, CenterE, CenterA; disabled
pdecon = Deconstruct(Point=pcen.CenterV)  # -> XComponent, YComponent, ZComponent; disabled
bnd = Bounds(Numbers=pdecon.ZComponent)  # disabled
dedomain = DeconstructDomain(Domain=bnd)  # -> Start, End; disabled
smaller = SmallerThan(FirstNumber=pdecon.ZComponent, SecondNumber=dedomain.Start)  # -> SmallerThan, OrEqualTo; disabled
larger = LargerThan(FirstNumber=pdecon.ZComponent, SecondNumber=dedomain.End)  # -> LargerThan, OrEqualTo; disabled
or = GateOr(A=smaller.OrEqualTo, B=larger.OrEqualTo)  # disabled
dispatch = Dispatch(List=debrep_4.Faces, DispatchPattern=or)  # -> ListA, ListB; disabled
dispatch_2 = Dispatch(List=debrep_4.Faces, DispatchPattern=smaller.OrEqualTo)  # -> ListA, ListB; disabled
dispatch_3 = Dispatch(List=pcen.CenterV, DispatchPattern=or)  # -> ListA, ListB; disabled
dispatch_4 = Dispatch(List=debrep_4.Faces, DispatchPattern=larger.OrEqualTo)  # -> ListA, ListB; disabled
pt = Point(dispatch_3.ListB)  # disabled
srf = Surface(dispatch.ListB)  # disabled
srf_2 = Surface(dispatch_2.ListA)  # disabled
srf_3 = Surface(dispatch_4.ListA)  # disabled
shift = ShiftPaths(Data=pt, Offset=-1)  # disabled
shift_2 = ShiftPaths(Data=srf, Offset=-1)  # disabled
number_slider_2 = Slider(12, range=0..100)  # disabled
avr = Average(Input=shift)  # disabled
dist = Distance(PointA=shift, PointB=avr)  # disabled
smaller_2 = SmallerThan(FirstNumber=dist, SecondNumber=number_slider_2)  # -> SmallerThan, OrEqualTo; disabled
dispatch_5 = Dispatch(List=shift, DispatchPattern=smaller_2.OrEqualTo)  # -> ListA, ListB; disabled
dispatch_6 = Dispatch(List=shift_2, DispatchPattern=smaller_2.OrEqualTo)  # -> ListA, ListB; disabled
srf_4 = Surface(dispatch_6.ListA)  # disabled
crv = Curve(srf_4)  # disabled
number_slider_3 = Slider(4, range=0..10)  # disabled
merge = Merge(Data1=avr, Data2=dispatch_5.ListA)  # disabled
mst = MST(BasePoints=merge)  # -> PointPointTopology, ConnectionPointTopology, Lines; disabled
circle = CircleCNR(Center=avr, Normal=Vector(0, 0, 1), Radius=number_slider_3)  # disabled
circle_2 = CircleCNR(Center=dispatch_5.ListA, Normal=Vector(0, 0, 1), Radius=number_slider_3)  # disabled
join = JoinCurves(Curves=mst.Lines, Preserve=False)  # disabled
runion = RegionUnion(Curves=circle_2)  # disabled
number_slider_4 = Slider(0, range=0..2)  # disabled
number_slider_5 = Slider(0, range=0..2)  # disabled
number_slider_6 = Slider(1.59, range=1..3)  # disabled
polyoffset = PolylineOffset(
    Polylines=join,
    Distance=number_slider_6,
    Plane=Plane(origin=(0, 0, 0), x=(0, 0, 0), y=(0, 0, 0)),
    Tolerance=0.01,
    ClosedFillet=number_slider_4,
    OpenFillet=number_slider_5,
    Miter=2)  # -> Contour, Holes; disabled
srf_5 = Surface(circle)  # disabled
boundary = BoundarySurfaces(Edges=[polyoffset.Contour, polyoffset.Holes])  # disabled
boundary_2 = BoundarySurfaces(Edges=runion)  # disabled
sunion = SolidUnion(Breps=flatten([srf_5, boundary, boundary_2]))  # disabled
fmerge = MergeFaces(Brep=simplify(flatten(sunion)))  # -> Breps, Before, After; disabled
edges = BrepEdges(Brep=fmerge.Breps)  # -> Naked, Interior, NonManifold; disabled
join_2 = JoinCurves(Curves=edges.Naked, Preserve=False)  # disabled
number_slider_7 = Slider(3, range=0..10)  # disabled
reb = RebuildCurve(Curve=join_2, Degree=number_slider_7, Count=10, Tangents=False)  # disabled

debrep_5 = DeconstructBrep(Brep=geo_3)  # -> Faces, Edges, Vertices
volume = Volume(Geometry=geo_3)  # -> Volume, Centroid; disabled
points = PointList(Points=volume.Centroid, Size=number_slider)  # disabled
area = Area(Geometry=debrep.Faces)  # -> Area, Centroid
area_2 = Area(Geometry=debrep_2.Faces)  # -> Area, Centroid
area_3 = Area(Geometry=debrep_5.Faces)  # -> Area, Centroid
area_4 = Area(Geometry=debrep_3.Faces)  # -> Area, Centroid
pdecon_2 = Deconstruct(Point=area_3.Centroid)  # -> XComponent, YComponent, ZComponent
pdecon_3 = Deconstruct(Point=area.Centroid)  # -> XComponent, YComponent, ZComponent
pdecon_4 = Deconstruct(Point=area_2.Centroid)  # -> XComponent, YComponent, ZComponent
bnd_2 = Bounds(Numbers=pdecon_2.ZComponent)
pdecon_5 = Deconstruct(Point=area_4.Centroid)  # -> XComponent, YComponent, ZComponent
bnd_3 = Bounds(Numbers=pdecon_3.ZComponent)
dedomain_2 = DeconstructDomain(Domain=bnd_2)  # -> Start, End
bnd_4 = Bounds(Numbers=pdecon_4.ZComponent)
dedomain_3 = DeconstructDomain(Domain=bnd_3)  # -> Start, End
bnd_5 = Bounds(Numbers=pdecon_5.ZComponent)
dedomain_4 = DeconstructDomain(Domain=bnd_4)  # -> Start, End
smaller_3 = SmallerThan(FirstNumber=pdecon_2.ZComponent, SecondNumber=dedomain_2.Start)  # -> SmallerThan, OrEqualTo
larger_2 = LargerThan(FirstNumber=pdecon_3.ZComponent, SecondNumber=dedomain_3.End)  # -> LargerThan, OrEqualTo
smaller_4 = SmallerThan(FirstNumber=pdecon_3.ZComponent, SecondNumber=dedomain_3.Start)  # -> SmallerThan, OrEqualTo
dedomain_5 = DeconstructDomain(Domain=bnd_5)  # -> Start, End
larger_3 = LargerThan(FirstNumber=pdecon_4.ZComponent, SecondNumber=dedomain_4.End)  # -> LargerThan, OrEqualTo
smaller_5 = SmallerThan(FirstNumber=pdecon_4.ZComponent, SecondNumber=dedomain_4.Start)  # -> SmallerThan, OrEqualTo
dispatch_7 = Dispatch(List=debrep_5.Faces, DispatchPattern=smaller_3.OrEqualTo)  # -> ListA, ListB
dispatch_8 = Dispatch(List=debrep.Faces, DispatchPattern=smaller_4.OrEqualTo)  # -> ListA, ListB
larger_4 = LargerThan(FirstNumber=pdecon_5.ZComponent, SecondNumber=dedomain_5.End)  # -> LargerThan, OrEqualTo
smaller_6 = SmallerThan(FirstNumber=pdecon_5.ZComponent, SecondNumber=dedomain_5.Start)  # -> SmallerThan, OrEqualTo
dispatch_9 = Dispatch(List=debrep_2.Faces, DispatchPattern=smaller_5.OrEqualTo)  # -> ListA, ListB
srf_6 = Surface(dispatch_7.ListA)
srf_7 = Surface(dispatch_8.ListA)
dispatch_10 = Dispatch(List=debrep_3.Faces, DispatchPattern=smaller_6.OrEqualTo)  # -> ListA, ListB
debrep_6 = DeconstructBrep(Brep=srf_6)  # -> Faces, Edges, Vertices
srf_8 = Surface(dispatch_9.ListA)
srf_9 = Surface(dispatch_10.ListA)
midpt = CurveMiddle(Curve=debrep_6.Edges)
area_5 = Area(Geometry=debrep_6.Faces)  # -> Area, flatten(Centroid)
debrep_7 = DeconstructBrep(Brep=srf_8)  # -> Faces, Edges, Vertices
debrep_8 = DeconstructBrep(Brep=srf_7)  # -> Faces, Edges, Vertices
debrep_9 = DeconstructBrep(Brep=srf_9)  # -> Faces, Edges, Vertices
avr_2 = Average(Input=area_5.Centroid)
area_6 = Area(Geometry=debrep_7.Faces)  # -> Area, flatten(Centroid)
midpt_2 = CurveMiddle(Curve=debrep_7.Edges)
area_7 = Area(Geometry=debrep_8.Faces)  # -> Area, flatten(Centroid)
midpt_3 = CurveMiddle(Curve=debrep_8.Edges)
area_8 = Area(Geometry=debrep_9.Faces)  # -> Area, flatten(Centroid)
midpt_4 = CurveMiddle(Curve=debrep_9.Edges)
ln = Line(StartPoint=avr_2, EndPoint=midpt)
avr_3 = Average(Input=area_6.Centroid)
avr_4 = Average(Input=area_7.Centroid)
avr_5 = Average(Input=area_8.Centroid)
ln_2 = Line(StartPoint=avr_3, EndPoint=midpt_2)
len = Length(Curve=ln)
ln_3 = Line(StartPoint=avr_4, EndPoint=midpt_3)
ln_4 = Line(StartPoint=avr_5, EndPoint=midpt_4)
len_2 = Length(Curve=ln_2)
len_3 = Length(Curve=ln_3)
len_4 = Length(Curve=ln_4)
smaller_7 = SmallerThan(FirstNumber=len_2, SecondNumber=Slider(12.13, range=10..16))  # -> SmallerThan, OrEqualTo
smaller_8 = SmallerThan(FirstNumber=len_3, SecondNumber=Slider(12.13, range=10..16))  # -> SmallerThan, OrEqualTo
smaller_9 = SmallerThan(FirstNumber=len_4, SecondNumber=Slider(12.13, range=10..16))  # -> SmallerThan, OrEqualTo
smaller_10 = SmallerThan(FirstNumber=len, SecondNumber=Slider(12.13, range=10..16))  # -> SmallerThan, OrEqualTo
dispatch_11 = Dispatch(List=debrep_7.Edges, DispatchPattern=smaller_7.SmallerThan)  # -> ListA, ListB
dispatch_12 = Dispatch(List=debrep_8.Edges, DispatchPattern=smaller_8.SmallerThan)  # -> ListA, ListB
dispatch_13 = Dispatch(List=debrep_9.Edges, DispatchPattern=smaller_9.SmallerThan)  # -> ListA, ListB
panel_2 = Panel(shift)  # disabled
dispatch_14 = Dispatch(List=debrep_6.Edges, DispatchPattern=smaller_10.SmallerThan)  # -> ListA, ListB
crv_2 = Curve(dispatch_11.ListB)

# ----
# curve
crv_3 = Curve(dispatch_11.ListA)

crv_4 = Curve(dispatch_12.ListB)

# ----
# curve
crv_5 = Curve(dispatch_12.ListA)
join_3 = JoinCurves(Curves=flatten(crv_5), Preserve=False)

crv_6 = Curve(dispatch_13.ListB)

# ----
# curve
crv_7 = Curve(dispatch_13.ListA)

# ----
# curve
crv_8 = Curve(dispatch_14.ListA)
join_4 = JoinCurves(Curves=flatten(crv_8), Preserve=False)

crv_9 = Curve(dispatch_14.ListB)
join_5 = JoinCurves(Curves=flatten(crv_3), Preserve=False)
join_6 = JoinCurves(Curves=flatten(crv_7), Preserve=False)
debrep_10 = DeconstructBrep(Brep=join_5)  # -> Faces, Edges, Vertices
debrep_11 = DeconstructBrep(Brep=join_3)  # -> Faces, Edges, Vertices

# ----
# MANUAL INPUT (FOR NOW)
# center point
pcen_2 = PolygonCenter(Polyline=join_3)  # -> CenterV, CenterE, CenterA

disc = Discontinuity(Curve=[join_6, join_4, join_3, join_5], Level=1)  # -> Points, Parameters
boundary_3 = BoundarySurfaces(Edges=join_6)
boundary_4 = BoundarySurfaces(Edges=join_3)
boundary_5 = BoundarySurfaces(Edges=join_5)
boundary_6 = BoundarySurfaces(Edges=join_4)
# PATH
points_2 = PointList(Points=disc.Points, Size=Slider(1, range=0..10))
points_3 = PointList(Points=merge)  # disabled
merge_2 = Merge(Data1=boundary_6, Data2=boundary_4, Data3=boundary_5, Data4=boundary_3)
number_slider_8 = Slider(15, range=0..100)  # disabled
number_slider_9 = Slider(1.7, range=0..10)  # disabled
number_slider_10 = Slider(15, range=0..100)  # disabled
number_slider_11 = Slider(3.4, range=0..10)  # disabled
number_slider_12 = Slider(15, range=0..100)  # disabled
number_slider_13 = Slider(15, range=0..100)  # disabled
number_slider_14 = Slider(300, range=0..1000)  # disabled
number_slider_15 = Slider(10, range=0..10)  # disabled
number_slider_16 = Slider(2.3, range=0..10)  # disabled
number_slider_17 = Slider(200, range=0..1000)  # disabled

# ---- group: Surfaces on Latest Location
srf_10 = Surface(flatten(Tree({0;0;0;0;0;0}: [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], {0;0;0;1;0;0}: [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], {0;0;0;2;0;0}: [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], {0;0;0;3;0;0}: [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])))
path_mapper = PathMapper(srf_10, source="{A}", target="{0;A}")

# ----
xy = XYPlane(Origin=Point(0, 0, 0))  # disabled
xy_2 = XYPlane(Origin=Point(0, 0, 0))  # disabled
division = Division(A=number_slider_10, B=number_slider_9)  # disabled
division_2 = Division(A=number_slider_10, B=number_slider_11)  # disabled
division_3 = Division(A=number_slider_17, B=number_slider_15)  # disabled
division_4 = Division(A=number_slider_17, B=number_slider_16)  # disabled
dom = ConstructDomain(DomainStart=division, DomainEnd=division_2)  # disabled
planesrf = PlaneSurface(Plane=xy, XSize=number_slider_8, YSize=number_slider_10)  # disabled
number_slider_18 = Slider(4, range=0..10)  # disabled
dom_2 = ConstructDomain(DomainStart=division_3, DomainEnd=division_4)  # disabled
planesrf_2 = PlaneSurface(Plane=xy_2, XSize=number_slider_14, YSize=number_slider_17)  # disabled
number_slider_19 = Slider(5, range=0..10)  # disabled
srf_11 = Surface(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)  # disabled
range = Range(Domain=dom, Steps=number_slider_18)  # disabled
pcen_3 = PolygonCenter(Polyline=srf_11)  # -> CenterV, CenterE, CenterA; disabled
range_2 = Range(Domain=dom_2, Steps=number_slider_19)  # disabled
pcen_4 = PolygonCenter(Polyline=planesrf_2)  # -> CenterV, CenterE, CenterA; disabled
debrep_12 = DeconstructBrep(Brep=path_mapper)  # -> flatten(Faces), Edges, Vertices
cir = Circle(Plane=pcen_3.CenterV, Radius=range)  # disabled
cir_2 = Circle(Plane=pcen_4.CenterV, Radius=range_2)  # disabled
number_slider_20 = Slider(0.4, range=0..10)  # disabled
item = ListItem(List=debrep_12.Faces, Index=0, Wrap=True)  # -> Item, Item1, Item2, Item3
len_5 = Length(Curve=cir)  # disabled
number_slider_21 = Slider(2, range=0..10)  # disabled
item_2 = ListItem(List=debrep_12.Faces, Index=0, Wrap=True)  # -> Item, Item1, Item2, Item3
len_6 = Length(Curve=cir_2)  # disabled
division_5 = Division(A=len_5, B=number_slider_20)  # disabled
division_6 = Division(A=len_6, B=number_slider_21)  # disabled
divide = DivideCurve(Curve=cir, Count=division_5, Kinks=False)  # -> simplify(Points), Tangents, Parameters; disabled

area_9 = Area(Geometry=item_2.Item3)  # -> Area, Centroid
cir_3 = Circle(Plane=area_9.Centroid, Radius=Slider(3, range=0..10))
divide_2 = DivideCurve(Curve=cir_3, Count=Slider(4, range=0..10), Kinks=False)  # -> Points, Tangents, Parameters
points_4 = PointList(Points=divide_2.Points, Size=Slider(1.36, range=0..2))

debrep_13 = DeconstructBrep(Brep=item.Item3)  # -> Faces, Edges, Vertices
shift_3 = ShiftList(List=debrep_13.Vertices, Shift=Slider(8, range=0..24), Wrap=True)
pline = PolyLine(Vertices=shift_3, Closed=True)
points_5 = PointList(Points=shift_3, Size=Slider(1.39, range=0..10))
debrep_14 = DeconstructBrep(Brep=pline)  # -> Faces, Edges, Vertices
midpt_5 = CurveMiddle(Curve=debrep_14.Edges)
item_3 = ListItem(List=midpt_5, Index=0, Wrap=True)
ln_5 = Line(StartPoint=area_9.Centroid, EndPoint=item_3)
ccx = CurveCurve(CurveA=ln_5, CurveB=cir_3)  # -> Points, ParamsA, ParamsB

area_10 = Area(Geometry=item_2.Item)  # -> Area, Centroid
cir_4 = Circle(Plane=area_10.Centroid, Radius=Slider(4, range=0..10))
divide_3 = DivideCurve(Curve=cir_4, Count=Slider(4, range=0..10), Kinks=False)  # -> Points, Tangents, Parameters
points_6 = PointList(Points=divide_3.Points, Size=Slider(1.36, range=0..2))

divide_4 = DivideCurve(Curve=cir_2, Count=division_6, Kinks=False)  # -> simplify(Points), Tangents, Parameters; disabled

area_11 = Area(Geometry=item_2.Item2)  # -> Area, Centroid
cir_5 = Circle(Plane=area_11.Centroid, Radius=Slider(3, range=0..10))
divide_5 = DivideCurve(Curve=cir_5, Count=Slider(4, range=0..10), Kinks=False)  # -> Points, Tangents, Parameters
points_7 = PointList(Points=divide_5.Points, Size=Slider(1.36, range=0..2))

area_12 = Area(Geometry=item_2.Item1)  # -> Area, Centroid
cir_6 = Circle(Plane=area_12.Centroid, Radius=Slider(4, range=0..10))
divide_6 = DivideCurve(Curve=cir_6, Count=Slider(4, range=0..10), Kinks=False)  # -> Points, Tangents, Parameters
points_8 = PointList(Points=divide_6.Points, Size=Slider(1.36, range=0..2))

pline_2 = PolyLine(Vertices=divide.Points, Closed=invert(False))  # disabled
pline_3 = PolyLine(Vertices=divide_4.Points, Closed=invert(False))  # disabled
lng = ListLength(List=divide.Points)  # -> flatten(Length); disabled
lng_2 = ListLength(List=divide_4.Points)  # -> flatten(Length); disabled
explode = Explode(Curve=pline_2, Recursive=True)  # -> Segments, Vertices; disabled
series = Series(Start=0, Step=1, Count=lng)  # disabled
explode_2 = Explode(Curve=pline_3, Recursive=True)  # -> Segments, Vertices; disabled

debrep_15 = DeconstructBrep(Brep=item.Item2)  # -> Faces, Edges, Vertices
shift_4 = ShiftList(List=debrep_15.Vertices, Shift=Slider(20, range=0..24), Wrap=True)
pline_4 = PolyLine(Vertices=shift_4, Closed=True)
points_9 = PointList(Points=shift_4, Size=Slider(1.39, range=0..10))
debrep_16 = DeconstructBrep(Brep=pline_4)  # -> Faces, Edges, Vertices
midpt_6 = CurveMiddle(Curve=debrep_16.Edges)
item_4 = ListItem(List=midpt_6, Index=[Slider(0, range=0..23), Slider(6, range=0..23)], Wrap=True)
ln_6 = Line(StartPoint=area_11.Centroid, EndPoint=item_4)
ccx_2 = CurveCurve(CurveA=ln_6, CurveB=cir_5)  # -> Points, ParamsA, ParamsB

debrep_17 = DeconstructBrep(Brep=item.Item1)  # -> Faces, Edges, Vertices
shift_5 = ShiftList(List=debrep_17.Vertices, Shift=Slider(14, range=0..24), Wrap=True)
pline_5 = PolyLine(Vertices=shift_5, Closed=True)
points_10 = PointList(Points=shift_5, Size=Slider(1.39, range=0..10))
debrep_18 = DeconstructBrep(Brep=pline_5)  # -> Faces, Edges, Vertices
midpt_7 = CurveMiddle(Curve=debrep_18.Edges)
item_5 = ListItem(List=midpt_7, Index=[Slider(0, range=0..23), Slider(18, range=0..23)], Wrap=True)
ln_7 = Line(StartPoint=area_12.Centroid, EndPoint=item_5)
ccx_3 = CurveCurve(CurveA=ln_7, CurveB=cir_6)  # -> Points, ParamsA, ParamsB

debrep_19 = DeconstructBrep(Brep=item.Item)  # -> Faces, Edges, Vertices
shift_6 = ShiftList(List=debrep_19.Vertices, Shift=Slider(2, range=0..24), Wrap=True)
pline_6 = PolyLine(Vertices=shift_6, Closed=True)
points_11 = PointList(Points=shift_6, Size=Slider(1.39, range=0..10))
debrep_20 = DeconstructBrep(Brep=pline_6)  # -> Faces, Edges, Vertices
midpt_8 = CurveMiddle(Curve=debrep_20.Edges)
item_6 = ListItem(List=midpt_8, Index=Slider(0, range=0..23), Wrap=True)
ln_8 = Line(StartPoint=area_10.Centroid, EndPoint=item_6)
ccx_4 = CurveCurve(CurveA=ln_8, CurveB=cir_4)  # -> Points, ParamsA, ParamsB

number_slider_22 = Slider(310, range=0..1000)  # disabled
series_2 = Series(Start=0, Step=1, Count=lng_2)  # disabled
pt_2 = Point(flatten(divide.Points))  # disabled
line = Line(flatten(explode.Segments))  # disabled

number_slider_23 = Slider(2, range=0..10)  # disabled
number_slider_24 = Slider(3.474, range=0..10)  # disabled

shift_7 = ShiftList(List=series, Shift=1, Wrap=True)  # disabled
number_slider_25 = Slider(0.18, range=0..5)  # disabled
number_slider_26 = Slider(1000, range=0..1000)  # disabled
number_slider_27 = Slider(1000, range=0..1000)  # disabled
pt_3 = Point(flatten(divide_4.Points))  # disabled
number_slider_28 = Slider(1000, range=0..1000)  # disabled
line_2 = Line(flatten(explode_2.Segments))  # disabled
number_slider_29 = Slider(10, range=0..10)  # disabled
shift_8 = ShiftList(List=explode.Segments, Shift=1, Wrap=True)  # disabled
panel_3 = Panel("0")  # disabled
shift_9 = ShiftList(List=series_2, Shift=1, Wrap=True)  # disabled
number_slider_30 = Slider(1000, range=0..1000)  # disabled
number_slider_31 = Slider(1.59, range=0..5)  # disabled
number_slider_32 = Slider(5.641, range=0..10)  # disabled
number_slider_33 = Slider(1000, range=0..1000)  # disabled
entwine_2 = Entwine(Branch00=line, Branch01=pt_2, FlattenInputs=True)  # disabled
int = Integer(flatten(series))  # disabled
int_2 = Integer(flatten(shift_7))  # disabled
shift_10 = ShiftList(List=explode_2.Segments, Shift=1, Wrap=True)  # disabled
panel_4 = Panel("0")  # disabled
entwine_3 = Entwine(Branch00=line_2, Branch01=pt_3, FlattenInputs=True)  # disabled
int_3 = Integer(flatten(series_2))  # disabled
int_4 = Integer(flatten(shift_9))  # disabled
length_line = LengthLine(Line=flatten(explode.Segments), Length=number_slider_24, Strength=number_slider_23)  # disabled
onmesh = OnMesh(Points=divide.Points, Mesh=srf_11, Strength=number_slider_22)  # disabled
angle = Angle(LineA=explode.Segments, LineB=shift_8, RestAngle=panel_3, Strength=number_slider_28)  # disabled
collider = Collider(Objects=entwine_2, Radii=number_slider_25, IgnoreA=int, IgnoreB=int_2, Strength=number_slider_27)  # disabled
show = Show(G=pline_2)  # disabled
length_line_2 = LengthLine(Line=flatten(explode_2.Segments), Length=number_slider_32, Strength=number_slider_29)  # disabled
onmesh_2 = OnMesh(Points=divide_4.Points, Mesh=planesrf_2, Strength=number_slider_26)  # disabled
angle_2 = Angle(LineA=explode_2.Segments, LineB=shift_10, RestAngle=panel_4, Strength=number_slider_33)  # disabled
collider_2 = Collider(Objects=entwine_3, Radii=number_slider_31, IgnoreA=int_3, IgnoreB=int_4, Strength=number_slider_30)  # disabled
show_2 = Show(G=pline_3)  # disabled
toggle = BooleanToggle(False)  # disabled
button = Button()  # disabled
entwine_4 = Entwine(Branch00=show, Branch01=[onmesh, length_line, angle, collider], FlattenInputs=True)  # disabled
toggle_2 = BooleanToggle(False)  # disabled
button_2 = Button()  # disabled
entwine_5 = Entwine(Branch00=show_2, Branch01=[onmesh_2, length_line_2, angle_2, collider_2], FlattenInputs=True)  # disabled
pt_4 = Point(item_4)
solver = Solver(GoalObjects=entwine_4, Reset=button, Threshold=1e-15, Tolerance=0.0001, On=toggle)  # -> I, V, O; disabled
pt_5 = Point(item_5)
pt_6 = Point(item_6)
pt_7 = Point(ccx_3.Points)
pt_8 = Point(ccx_4.Points)
item_7 = ListItem(List=pt_4, Index=0, Wrap=True)
pt_9 = Point(ccx_2.Points)
pt_10 = Point(ccx.Points)
pt_11 = Point(item_3)
item_8 = ListItem(List=pt_5, Index=0, Wrap=True)
solver_2 = Solver(GoalObjects=entwine_5, Reset=button_2, Threshold=1e-15, Tolerance=0.0001, On=toggle_2)  # -> I, V, O; disabled
merge_3 = Merge(
    Data1=pt_8,
    Data3=pt_7,
    Data4=item_8,
    Data5=pt_9,
    Data6=item_7,
    Data7=pt_10,
    Data8=area_10.Centroid,
    Data9=area_12.Centroid,
    Data10=area_11.Centroid,
    Data11=area_9.Centroid,
    Data12=pt_11)  # -> flatten(Result)

# ----
# LOCATION OF BUFFER UNITS
panel_5 = Panel("""5
20""")

# ----
# LOCATION OF BUFFER UNITS
panel_6 = Panel("""5
14""")

# ----
# LOCATION OF BUFFER UNITS
panel_7 = Panel("""14
20
11""")

# ----
# LOCATION OF BUFFER UNITS
panel_8 = Panel("""5
14
20
11
8
17""")

panel_9 = Panel("""0
6""")
panel_10 = Panel("""0
18""")
# CENTER PATH
mst_2 = MST(BasePoints=merge_3)  # -> PointPointTopology, ConnectionPointTopology, Lines

# ----
# CIRCULATION EP
item_9 = ListItem(List=shift_6, Index=panel_5, Wrap=True)
item_10 = ListItem(List=midpt_8, Index=0, Wrap=True)
crv_10 = Curve(cir_4)
area_13 = Area(Geometry=crv_10)  # -> Area, Centroid
crv_cp = CurveClosestPoint(Point=item_9, Curve=crv_10)  # -> Point, Parameter, Distance
merge_4 = Merge(Data1=crv_cp.Point, Data2=item_9, Data3=area_13.Centroid)  # -> flatten(Result)
mst_3 = MST(BasePoints=merge_4)  # -> PointPointTopology, ConnectionPointTopology, Lines
ln_9 = Line(StartPoint=crv_cp.Point, EndPoint=item_9)

# ----
# CIRCULATION WP
item_11 = ListItem(List=midpt_7, Index=panel_10, Wrap=True)
item_12 = ListItem(List=shift_5, Index=panel_6, Wrap=True)
crv_11 = Curve(cir_6)
area_14 = Area(Geometry=crv_11)  # -> Area, Centroid
crv_cp_2 = CurveClosestPoint(Point=item_12, Curve=crv_11)  # -> Point, Parameter, Distance
merge_5 = Merge(Data1=crv_cp_2.Point, Data2=item_12, Data3=area_14.Centroid)  # -> flatten(Result)
mst_4 = MST(BasePoints=merge_5)  # -> PointPointTopology, ConnectionPointTopology, Lines
ln_10 = Line(StartPoint=crv_cp_2.Point, EndPoint=item_12)

# ----
# CIRCULATION WP
item_13 = ListItem(List=shift_4, Index=panel_7, Wrap=True)
item_14 = ListItem(List=midpt_6, Index=panel_9, Wrap=True)
crv_12 = Curve(cir_5)
area_15 = Area(Geometry=crv_12)  # -> Area, Centroid
crv_cp_3 = CurveClosestPoint(Point=item_13, Curve=crv_12)  # -> Point, Parameter, Distance
merge_6 = Merge(Data1=crv_cp_3.Point, Data2=item_13, Data3=area_15.Centroid)  # -> flatten(Result)
mst_5 = MST(BasePoints=merge_6)  # -> PointPointTopology, ConnectionPointTopology, Lines
ln_11 = Line(StartPoint=crv_cp_3.Point, EndPoint=item_13)

# ----
# CIRCULATION WP
item_15 = ListItem(List=shift_3, Index=panel_8, Wrap=True)
item_16 = ListItem(List=midpt_5, Index="0", Wrap=True)
crv_13 = Curve(cir_3)
crv_cp_4 = CurveClosestPoint(Point=flatten([item_15, item_16]), Curve=crv_13)  # -> Point, Parameter, Distance
area_16 = Area(Geometry=crv_13)  # -> Area, Centroid
merge_7 = Merge(Data1=crv_cp_4.Point, Data2=item_15, Data3=area_16.Centroid, Data4=item_16)  # -> flatten(Result)
ln_12 = Line(StartPoint=crv_cp_4.Point, EndPoint=item_15)
mst_6 = MST(BasePoints=merge_7)  # -> PointPointTopology, ConnectionPointTopology, Lines

crv_14 = Curve([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])
crv_cp_5 = CurveClosestPoint(Point=item_10, Curve=crv_10)  # -> Point, Parameter, Distance
crv_cp_6 = CurveClosestPoint(Point=item_14, Curve=crv_12)  # -> Point, Parameter, Distance
crv_cp_7 = CurveClosestPoint(Point=item_11, Curve=crv_11)  # -> Point, Parameter, Distance
ln_13 = Line(StartPoint=crv_cp_5.Point, EndPoint=item_10)
ln_14 = Line(StartPoint=crv_cp_6.Point, EndPoint=item_14)
ln_15 = Line(StartPoint=crv_cp_7.Point, EndPoint=item_11)
merge_8 = Merge(Data1=ln_11, Data2=ln_14)
merge_9 = Merge(Data1=ln_9, Data2=ln_13)
merge_10 = Merge(Data1=ln_10, Data2=ln_15)
number_slider_34 = Slider(1, range=0..10)
polyoffset_2 = PolylineOffset(
    Polylines=merge_9,
    Distance=Slider(0.82, range=0..10),
    Plane=area_13.Centroid,
    Tolerance=0.01,
    ClosedFillet=1,
    OpenFillet=1,
    Miter=2)  # -> Contour, Holes
polyoffset_3 = PolylineOffset(
    Polylines=merge_10,
    Distance=Slider(0.82, range=0..10),
    Plane=area_14.Centroid,
    Tolerance=0.01,
    ClosedFillet=1,
    OpenFillet=1,
    Miter=2)  # -> Contour, Holes
polyoffset_4 = PolylineOffset(
    Polylines=mst_6.Lines,
    Distance=number_slider_34,
    Plane=area_16.Centroid,
    Tolerance=0.01,
    ClosedFillet=1,
    OpenFillet=1,
    Miter=2)  # -> Contour, Holes
polyoffset_5 = PolylineOffset(
    Polylines=merge_8,
    Distance=number_slider_34,
    Plane=area_15.Centroid,
    Tolerance=0.01,
    ClosedFillet=1,
    OpenFillet=1,
    Miter=2)  # -> Contour, Holes
perimetral_walkway = Slider(-1.5, range=-2.5..2.5)
crv_15 = Curve(crv_11)
crv_16 = Curve(polyoffset_3.Contour)
crv_17 = Curve(pline_5)
crv_18 = Curve(crv_12)
crv_19 = Curve(pline_4)
crv_20 = Curve(crv_10)
crv_21 = Curve(pline_6)
crv_22 = Curve(polyoffset_2.Contour)
crv_23 = Curve(polyoffset_5.Contour)
number_slider_35 = Slider(-0.89, range=-2.5..2.5)
crv_24 = Curve(pline)
crv_25 = Curve(crv_13)
crv_26 = Curve(polyoffset_4.Contour)
number_slider_36 = Slider(-1.5, range=-2.5..2.5)
number_slider_37 = Slider(-0.89, range=-2.5..2.5)
runion_2 = RegionUnion(Curves=flatten([crv_20, crv_22]), Plane=area_13.Centroid)
runion_3 = RegionUnion(Curves=flatten([crv_15, crv_16]), Plane=area_14.Centroid)
runion_4 = RegionUnion(Curves=flatten([crv_18, crv_23]), Plane=area_15.Centroid)
offset = OffsetCurve(Curve=crv_24, Distance=perimetral_walkway, Corners=1)
# INCLUDE RAMPS HERE!
runion_5 = RegionUnion(Curves=flatten([crv_26, crv_25]), Plane=area_16.Centroid)
offset_2 = OffsetCurve(Curve=crv_21, Distance=perimetral_walkway, Corners=1)
offset_3 = OffsetCurve(Curve=crv_17, Distance=perimetral_walkway, Corners=1)
offset_4 = OffsetCurve(Curve=crv_19, Distance=perimetral_walkway, Corners=1)
number_slider_38 = Slider(1, range=0..1)
rdiff = RegionDifference(CurvesA=offset_2, CurvesB=runion_2, Plane=area_13.Centroid)
rdiff_2 = RegionDifference(CurvesA=offset_3, CurvesB=runion_3, Plane=area_14.Centroid)
rdiff_3 = RegionDifference(CurvesA=offset, CurvesB=runion_5, Plane=area_16.Centroid)
rdiff_4 = RegionDifference(CurvesA=offset_4, CurvesB=runion_4, Plane=area_15.Centroid)
number_slider_39 = Slider(1, range=0..1)

# ----
# FILLET NOT WORKING
number_slider_40 = Slider(1.28, range=0..10)
number_slider_41 = Slider(1, range=0..1)
crv_27 = Curve(rdiff_4)

# ----
# FLOORS TO OPERATE ON
crv_28 = Curve(rdiff_3)
number_slider_42 = Slider(1, range=0..1)
crv_29 = Curve(rdiff)
crv_30 = Curve(rdiff_2)
fillet = Fillet(Curve=crv_28, Radius=Slider(1.28, range=0..10))
Z_2 = UnitZ(Factor=Slider(3, range=0..10))
fillet_2 = Fillet(Curve=crv_29, Radius=Slider(1.28, range=0..10))
# FLOORS TO OPERATE ON
fillet_3 = Fillet(Curve=crv_27, Radius=number_slider_40)
fillet_4 = Fillet(Curve=crv_30, Radius=Slider(1.28, range=0..10))
neg = Negative(Value=Z_2)
join_7 = JoinCurves(Curves=fillet, Preserve=False)
join_8 = JoinCurves(Curves=fillet_3, Preserve=False)
join_9 = JoinCurves(Curves=fillet_4, Preserve=False)
join_10 = JoinCurves(Curves=fillet_2, Preserve=False)
area_17 = Area(Geometry=join_8)  # -> Area, Centroid
area_18 = Area(Geometry=join_7)  # -> Area, Centroid
area_19 = Area(Geometry=join_9)  # -> Area, Centroid
smaller_11 = SmallerThan(FirstNumber=area_17.Area, SecondNumber=Slider(2, range=0..10))  # -> SmallerThan, OrEqualTo
boundary_7 = BoundarySurfaces(Edges=join_10)
# POINTS FOR STRUCTURE
# TO ANCHOR
pt_12 = Point(area_19.Centroid)
boundary_8 = BoundarySurfaces(Edges=join_9)
dispatch_15 = Dispatch(List=area_17.Centroid, DispatchPattern=smaller_11.SmallerThan)  # -> ListA, ListB
boundary_9 = BoundarySurfaces(Edges=join_8)
boundary_10 = BoundarySurfaces(Edges=join_7)

join_11 = JoinCurves(Curves=mst_2.Lines, Preserve=False)
flip = FlipCurve(Curve=join_11)  # -> Curve, Flag
pframe = PerpFrame(Curve=reparameterize(flip.Curve), Parameter="1")
cir_7 = Circle(Plane=pframe, Radius="1.00")
seam = Seam(Curve=reparameterize(cir_7), Seam=Slider(0.25, range=0..1))
divide_7 = DivideCurve(Curve=seam, Count=Slider(2, range=0..10), Kinks=False)  # -> Points, Tangents, Parameters
item_17 = ListItem(List=divide_7.Points, Index=0, Wrap=True)  # -> Item, Item1
ln_16 = Line(StartPoint=item_17.Item, EndPoint=item_17.Item1)
Z_3 = UnitZ(Factor=Slider(10, range=0..10))
Z_4 = UnitZ(Factor=Slider(5, range=0..10))
swp1 = Sweep1(Rail=flip.Curve, Sections=ln_16, Miter=1)
neg_2 = Negative(Value=Z_3)
Z_5 = UnitZ(Factor=1)
extr = Extrude(Base=swp1, Direction=neg_2)
neg_3 = Negative(Value=Z_5)
join_12 = BrepJoin(Breps=path_mapper)  # -> Breps, Closed
move_2 = Move(Geometry=extr, Motion=Z_4)  # -> Geometry, Transform
extr_2 = Extrude(Base=join_12.Breps, Direction=neg_3)
sdiff = SolidDifference(BrepsA=extr_2, BrepsB=move_2.Geometry)
brep = Brep(sdiff)
preview = CustomPreview(Geometry=brep, Material=ColourSwatch(SwatchColor=RGB(125, 125, 125)))  # disabled
preview_2 = CustomPreview(Geometry=swp1, Material=ColourSwatch(SwatchColor=RGB(184, 103, 103)))  # disabled
debrep_21 = DeconstructBrep(Brep=brep)  # -> Faces, Edges, Vertices
area_20 = Area(Geometry=debrep_21.Faces)  # -> Area, Centroid
pdecon_6 = Deconstruct(Point=area_20.Centroid)  # -> XComponent, YComponent, ZComponent
bnd_6 = Bounds(Numbers=pdecon_6.ZComponent)
dedomain_6 = DeconstructDomain(Domain=bnd_6)  # -> Start, End
larger_5 = LargerThan(FirstNumber=pdecon_6.ZComponent, SecondNumber=dedomain_6.End)  # -> LargerThan, OrEqualTo
smaller_12 = SmallerThan(FirstNumber=pdecon_6.ZComponent, SecondNumber=dedomain_6.Start)  # -> SmallerThan, OrEqualTo
dispatch_16 = Dispatch(List=debrep_21.Faces, DispatchPattern=larger_5.OrEqualTo)  # -> ListA, ListB
srf_12 = Surface(dispatch_16.ListA)
srf_13 = Surface(flatten(srf_12))
merge_11 = Merge(Data1=boundary_7, Data2=boundary_8, Data3=boundary_9, Data4=boundary_10)  # -> flatten(Result)
sdiff_2 = SolidDifference(BrepsA=srf_13, BrepsB=merge_11)

extr_3 = Extrude(Base=swp1, Direction=neg)
# POINTS FOR STRUCTURE
# TO ANCHOR
pt_13 = Point(dispatch_15.ListB)

number_slider_43 = Slider(0.36, range=0.3..0.5)
panel_11 = Panel("0.5")
series_3 = Series(Start=0, Step="0.6", Count=Slider(3, range=1..10))
series_4 = Series(Start=number_slider_43, Step=number_slider_43, Count=Slider(3, range=1..10))
neg_4 = Negative(Value=series_3)
Z_6 = UnitZ(Factor=series_4)
neg_5 = Negative(Value=Z_6)
offset_5 = OffsetCurve(Curve=graft(join_9), Distance=neg_4, Corners=1)
boundary_11 = BoundarySurfaces(Edges=offset_5)
partition = PartitionList(List=flatten(boundary_11), Size="3")
extr_4 = Extrude(Base=partition, Direction=neg_5)
item_18 = ListItem(List=extr_4, Index=0, Wrap=True)  # -> Item, Item1, Item2
sunion_2 = SolidUnion(Breps=[item_18.Item, item_18.Item1, item_18.Item2])
md_slider = MDSlider(SliderMode=0, slider_value=Point(0.5, 0.5, 0.5), x_domain=Domain(0, 1), y_domain=Domain(0, 1), z_domain=Domain(0, 1))
debrep_22 = DeconstructBrep(Brep=sunion_2)  # -> Faces, Edges, Vertices
evalsrf = EvaluateSurface(Surface=reparameterize(debrep_22.Faces), Point=md_slider)  # -> Point, Normal, UDirection, VDirection, Frame
devec = DeconstructVector(Vector=evalsrf.Normal)  # -> XComponent, YComponent, ZComponent
equalst = EqualityWithinTolerance(FirstNumber=devec.ZComponent, SecondNumber="0", Tolerance=0.01)  # -> Equality, Inequality
panel_12 = Panel(devec.ZComponent)
dispatch_17 = Dispatch(List=debrep_22.Faces, DispatchPattern=equalst.Equality)  # -> ListA, ListB
srf_14 = Surface(dispatch_17.ListB)
item_19 = ListItem(List=srf_14, Index=0, Wrap=True)  # -> Item, Item1, Item2, Item3
srf_15 = Surface(dispatch_17.ListA)
merge_12 = Merge(Data1=item_19.Item, Data2=item_19.Item1, Data3=item_19.Item3, Data4=srf_15)
panel_13 = Panel(""" spa

cold bath
hot bath""")
join_13 = BrepJoin(Breps=merge_12)  # -> Breps, Closed

number_slider_44 = Slider(0.36, range=0.3..0.5)
series_5 = Series(Start=0, Step="0.6", Count=Slider(3, range=1..10))
series_6 = Series(Start=number_slider_44, Step=number_slider_44, Count=Slider(3, range=1..10))
neg_6 = Negative(Value=series_5)
Z_7 = UnitZ(Factor=series_6)
offset_6 = OffsetCurve(Curve=graft(join_8), Distance=neg_6, Corners=1)
neg_7 = Negative(Value=Z_7)
boundary_12 = BoundarySurfaces(Edges=offset_6)
partition_2 = PartitionList(List=flatten(boundary_12), Size="3")
extr_5 = Extrude(Base=partition_2, Direction=neg_7)
item_20 = ListItem(List=extr_5, Index=0, Wrap=True)  # -> Item, Item1, Item2
md_slider_2 = MDSlider(SliderMode=0, slider_value=Point(0.5, 0.5, 0.5), x_domain=Domain(0, 1), y_domain=Domain(0, 1), z_domain=Domain(0, 1))
sunion_3 = SolidUnion(Breps=[item_20.Item, item_20.Item1, item_20.Item2])
debrep_23 = DeconstructBrep(Brep=sunion_3)  # -> Faces, Edges, Vertices
evalsrf_2 = EvaluateSurface(Surface=reparameterize(debrep_23.Faces), Point=md_slider_2)  # -> Point, Normal, UDirection, VDirection, Frame
devec_2 = DeconstructVector(Vector=evalsrf_2.Normal)  # -> XComponent, YComponent, ZComponent
equalst_2 = EqualityWithinTolerance(FirstNumber=devec_2.ZComponent, SecondNumber="0", Tolerance=0.01)  # -> Equality, Inequality
panel_15 = Panel(devec_2.ZComponent)
dispatch_18 = Dispatch(List=debrep_23.Faces, DispatchPattern=equalst_2.Equality)  # -> ListA, ListB
srf_16 = Surface(dispatch_18.ListB)
item_21 = ListItem(List=srf_16, Index=0, Wrap=True)  # -> Item, Item1, Item2, Item3
srf_17 = Surface(dispatch_18.ListA)
merge_13 = Merge(Data1=item_21.Item, Data2=item_21.Item1, Data3=item_21.Item3, Data4=srf_17)

# ----
# SCRIPT FOR ENCLOSURES
number_slider_45 = Slider(5, range=1..10)
item_22 = ListItem(List=join_9, Index=0, Wrap=True)  # -> Item, Item1, Item2, Item3
series_7 = Series(Start=0, Step=Slider(0.3, range=0.3..0.5), Count=number_slider_45)
relay = Relay([item_22.Item1, item_22.Item3])
neg_8 = Negative(Value=series_7)
offset_7 = OffsetCurve(Curve=graft(relay), Distance=neg_8, Corners=1)  # -> simplify(flatten(Curve))
series_8 = Series(Start=0, Step=Slider(0.51, range=0..1), Count=number_slider_45)  # -> simplify(Series)
lng_3 = ListLength(List=series_8)
multiplication = Multiplication(A=number_slider_45, B=lng_3)
join_14 = JoinCurves(Curves=offset_7, Preserve=False)
repeat = RepeatData(Data=series_8, Length=multiplication)
reb_2 = RebuildCurve(Curve=join_14, Degree=Slider(3, range=0..10), Count=10, Tangents=False)
Z_8 = UnitZ(Factor=repeat)
move_3 = Move(Geometry=reb_2, Motion=Z_8)  # -> Geometry, Transform
Z_9 = UnitZ(Factor=Slider(0.2, range=0..1))

xy_3 = XYPlane(Origin=Point(0, 0, 0))

series_9 = Series(Start=0, Step="0.6", Count=Slider(3, range=1..10))
series_10 = Series(Start="0.2", Step="0.2", Count=Slider(3, range=1..10))
neg_9 = Negative(Value=series_9)
Z_10 = UnitZ(Factor=series_10)
offset_8 = OffsetCurve(Curve=graft(join_10), Distance=neg_9, Corners=1)
boundary_13 = BoundarySurfaces(Edges=offset_8)
# CREATE VOLUME
partition_3 = PartitionList(List=flatten(boundary_13), Size="3")

# ----
# make this efficient
partition_4 = PartitionList(List=move_3.Geometry, Size=lng_3)  # -> simplify(Chunks)
bang = ExplodeTree(Data=partition_4)  # -> flatten(Branch0), Branch1, Branch2, Branch3, Branch4, Branch5
loft = Loft(
    Curves=flatten(bang.Branch1),
    Options={Adjust=False, Closed=False, LoftEnds=0, LoftSimp=0, LoftType=0, Rebuild=10, Refit=0.01})
loft_2 = Loft(
    Curves=flatten(bang.Branch0),
    Options={Adjust=False, Closed=False, LoftEnds=0, LoftSimp=0, LoftType=0, Rebuild=10, Refit=0.01})
cap = CapHoles(Brep=loft)
cap_2 = CapHoles(Brep=loft_2)

extr_6 = Extrude(Base=partition_3, Direction=Z_10)  # -> flatten(Extrusion)

extr_7 = Extrude(Base=cap_2, Direction=Z_9)
extr_8 = Extrude(Base=cap, Direction=Z_9)

# ---- group: Brep Join
join_15 = BrepJoin(Breps=merge_13)  # -> Breps, Closed

# ----
panel_16 = Panel("https://macad.speckle.xyz/streams/23fc2460c6/branches/meditation_floors")
panel_17 = Panel("""BIMSC-PROJECT
BIMSC-ORIGINATORS
BIMSC-VOLUME
BIMSC-LEVEL
BIMSC-TYPE
BIMSC-MATERIAL""")
panel_18 = Panel("""BIMSC-PROJECT
G06
A4
????
FLOOR
PRINTED EARTH""")
esokv = ExtendSpeckleObjectByKeyValue(Keys=panel_17, Values=panel_18, selectedKitName="Objects")
send = Send(
    Stream=panel_16,
    Message="level 0 extra floors",
    Data=esokv,
    AutoSend=False,
    CurrentComponentState="needs_input",
    KitName="Objects",
    UseDefaultCache=True,
    selectedKitName="Objects")

# ----
# SCRIPT FOR ENCLOSURES
item_23 = ListItem(List=join_7, Index=0, Wrap=True)  # -> Item, Item1, Item2, Item3, Item4, Item5, Item6
crv_31 = Curve([item_23.Item1, item_23.Item2, item_23.Item3, item_23.Item4, item_23.Item5])
crv_32 = Curve([item_23.Item6, item_23.Item])
number_slider_46 = Slider(0.3, range=0.3..0.5)
number_slider_47 = Slider(5, range=1..10)
series_11 = Series(Start=0, Step=Slider(0.26, range=0..1), Count=number_slider_47)
neg_10 = Negative(Value=series_11)
offset_9 = OffsetCurve(Curve=graft(crv_31), Distance=neg_10, Corners=1)  # -> simplify(flatten(Curve))
series_12 = Series(Start=0, Step=Slider(0.61, range=0..1), Count=number_slider_47)  # -> simplify(Series)
lng_4 = ListLength(List=series_12)
multiplication_2 = Multiplication(A=number_slider_47, B=lng_4)
join_16 = JoinCurves(Curves=offset_9, Preserve=False)
repeat_2 = RepeatData(Data=series_12, Length=multiplication_2)
reb_3 = RebuildCurve(Curve=join_16, Degree=Slider(3, range=0..10), Count=10, Tangents=False)
Z_11 = UnitZ(Factor=repeat_2)
move_4 = Move(Geometry=reb_3, Motion=Z_11)  # -> Geometry, Transform

number_slider_48 = Slider(0.36, range=0.3..0.5)
series_13 = Series(Start=0, Step="0.6", Count=Slider(3, range=1..10))
series_14 = Series(Start=number_slider_48, Step=number_slider_48, Count=Slider(3, range=1..10))
neg_11 = Negative(Value=series_13)
Z_12 = UnitZ(Factor=series_14)
offset_10 = OffsetCurve(Curve=graft(crv_31), Distance=neg_11, Corners=1)
neg_12 = Negative(Value=Z_12)
boundary_14 = BoundarySurfaces(Edges=offset_10)
partition_5 = PartitionList(List=flatten(boundary_14), Size="3")
extr_9 = Extrude(Base=partition_5, Direction=neg_12)
item_24 = ListItem(List=extr_9, Index=0, Wrap=True)  # -> Item, Item1, Item2
md_slider_3 = MDSlider(SliderMode=0, slider_value=Point(0.5, 0.5, 0.5), x_domain=Domain(0, 1), y_domain=Domain(0, 1), z_domain=Domain(0, 1))
sunion_4 = SolidUnion(Breps=[item_24.Item, item_24.Item1, item_24.Item2])
debrep_24 = DeconstructBrep(Brep=sunion_4)  # -> Faces, Edges, Vertices
evalsrf_3 = EvaluateSurface(Surface=reparameterize(debrep_24.Faces), Point=md_slider_3)  # -> Point, Normal, UDirection, VDirection, Frame
devec_3 = DeconstructVector(Vector=evalsrf_3.Normal)  # -> XComponent, YComponent, ZComponent
equalst_3 = EqualityWithinTolerance(FirstNumber=devec_3.ZComponent, SecondNumber="0", Tolerance=0.01)  # -> Equality, Inequality
panel_20 = Panel(devec_3.ZComponent)
dispatch_19 = Dispatch(List=debrep_24.Faces, DispatchPattern=equalst_3.Equality)  # -> ListA, ListB
srf_18 = Surface(dispatch_19.ListB)
item_25 = ListItem(List=srf_18, Index=0, Wrap=True)  # -> Item, Item1, Item2, Item3
srf_19 = Surface(dispatch_19.ListA)
merge_14 = Merge(Data1=item_25.Item, Data2=item_25.Item1, Data3=item_25.Item3, Data4=srf_19)

series_15 = Series(Start=0, Step="0.6", Count=Slider(3, range=1..10))
series_16 = Series(Start="0.2", Step="0.2", Count=Slider(3, range=1..10))
neg_13 = Negative(Value=series_15)
Z_13 = UnitZ(Factor=series_16)
offset_11 = OffsetCurve(Curve=graft(crv_32), Distance=neg_13, Plane=xy_3, Corners=1)
boundary_15 = BoundarySurfaces(Edges=offset_11)
partition_6 = PartitionList(List=flatten(boundary_15), Size="3")
extr_10 = Extrude(Base=partition_6, Direction=Z_13)

# ----
# make this efficient
partition_7 = PartitionList(List=move_4.Geometry, Size=lng_4)  # -> simplify(Chunks)
bang_2 = ExplodeTree(Data=partition_7)  # -> flatten(Branch0), Branch1, Branch2, Branch3, Branch4, Branch5
loft_3 = Loft(
    Curves=flatten(bang_2.Branch4),
    Options={Adjust=False, Closed=False, LoftEnds=0, LoftSimp=0, LoftType=0, Rebuild=10, Refit=0.01})
loft_4 = Loft(
    Curves=flatten(bang_2.Branch0),
    Options={Adjust=False, Closed=False, LoftEnds=0, LoftSimp=0, LoftType=0, Rebuild=10, Refit=0.01})
loft_5 = Loft(
    Curves=flatten(bang_2.Branch1),
    Options={Adjust=False, Closed=False, LoftEnds=0, LoftSimp=0, LoftType=0, Rebuild=10, Refit=0.01})
loft_6 = Loft(
    Curves=flatten(bang_2.Branch2),
    Options={Adjust=False, Closed=False, LoftEnds=0, LoftSimp=0, LoftType=0, Rebuild=10, Refit=0.01})
loft_7 = Loft(
    Curves=flatten(bang_2.Branch3),
    Options={Adjust=False, Closed=False, LoftEnds=0, LoftSimp=0, LoftType=0, Rebuild=10, Refit=0.01})
cap_3 = CapHoles(Brep=loft_7)
cap_4 = CapHoles(Brep=loft_6)
cap_5 = CapHoles(Brep=loft_3)
cap_6 = CapHoles(Brep=loft_4)
cap_7 = CapHoles(Brep=loft_5)

srf_cp = SurfaceClosestPoint(Point=area_9.Centroid, Surface=[loft_4, loft_5, loft_6, loft_7, loft_3])  # -> Point, UVPoint, Distance
sph = Sphere(Base=srf_cp.Point, Radius=Slider(2, range=0..10))
sdiff_3 = SolidDifference(BrepsA=[cap_6, cap_7, cap_4, cap_3, cap_5], BrepsB=sph)

# ---- group: Brep Join
join_17 = BrepJoin(Breps=merge_14)  # -> Breps, Closed

# ----
# SCRIPT FOR ENCLOSURES
join_18 = JoinCurves(Curves=fillet_3, Preserve=False)
item_26 = ListItem(List=join_18, Index=0, Wrap=True)  # -> Item, Item1, Item2, Item3
relay_2 = Relay([item_26.Item, item_26.Item1, item_26.Item3])
number_slider_49 = Slider(6, range=1..10)
series_17 = Series(Start=0, Step=Slider(0.3, range=0.3..0.5), Count=number_slider_49)
neg_14 = Negative(Value=series_17)
offset_12 = OffsetCurve(Curve=graft(relay_2), Distance=neg_14, Corners=1)  # -> simplify(flatten(Curve))
series_18 = Series(Start=0, Step=Slider(0.51, range=0..1), Count=number_slider_49)  # -> simplify(Series)
lng_5 = ListLength(List=series_18)
multiplication_3 = Multiplication(A=number_slider_49, B=lng_5)
join_19 = JoinCurves(Curves=offset_12, Preserve=False)
repeat_3 = RepeatData(Data=series_18, Length=multiplication_3)
reb_4 = RebuildCurve(Curve=join_19, Degree=Slider(3, range=0..10), Count=10, Tangents=False)
Z_14 = UnitZ(Factor=repeat_3)
move_5 = Move(Geometry=reb_4, Motion=Z_14)  # -> Geometry, Transform

# ----
# make this efficient
partition_8 = PartitionList(List=move_5.Geometry, Size=lng_5)  # -> simplify(Chunks)
bang_3 = ExplodeTree(Data=partition_8)  # -> flatten(Branch0), Branch1, Branch2, Branch3, Branch4, Branch5
loft_8 = Loft(
    Curves=flatten(bang_3.Branch4),
    Options={Adjust=False, Closed=False, LoftEnds=0, LoftSimp=0, LoftType=0, Rebuild=10, Refit=0.01})
loft_9 = Loft(
    Curves=flatten(bang_3.Branch0),
    Options={Adjust=False, Closed=False, LoftEnds=0, LoftSimp=0, LoftType=0, Rebuild=10, Refit=0.01})
loft_10 = Loft(
    Curves=flatten(bang_3.Branch1),
    Options={Adjust=False, Closed=False, LoftEnds=0, LoftSimp=0, LoftType=0, Rebuild=10, Refit=0.01})
loft_11 = Loft(
    Curves=flatten(bang_3.Branch2),
    Options={Adjust=False, Closed=False, LoftEnds=0, LoftSimp=0, LoftType=0, Rebuild=10, Refit=0.01})
loft_12 = Loft(
    Curves=flatten(bang_3.Branch3),
    Options={Adjust=False, Closed=False, LoftEnds=0, LoftSimp=0, LoftType=0, Rebuild=10, Refit=0.01})
cap_8 = CapHoles(Brep=loft_12)
cap_9 = CapHoles(Brep=loft_11)
cap_10 = CapHoles(Brep=loft_8)
cap_11 = CapHoles(Brep=loft_9)
cap_12 = CapHoles(Brep=loft_10)

srf_cp_2 = SurfaceClosestPoint(Point=area_11.Centroid, Surface=[loft_9, loft_10, loft_11, loft_12, loft_8])  # -> Point, UVPoint, Distance
sph_2 = Sphere(Base=srf_cp_2.Point, Radius=Slider(2, range=0..10))
sdiff_4 = SolidDifference(BrepsA=[cap_11, cap_12, cap_9, cap_8, cap_10], BrepsB=sph_2)
