# Grasshopper definition Terrain & Walls & Roofs.gh (Grasshopper 1.0.7)
# plug-ins: Pufferfish, Weaverbird, Speckle 2, Kangaroo2 Components, Human, MetaHopper, Rhino.Inside for Autodesk Revit, MeshEdit Components, ShapeDiverForGrasshopper, LunchBox, DendroGH

sddp = ShapeDiverDocumentPayload({AbsoluteTolerance=0, AngleTolerance=0, DistanceDisplayPrecision=0, GltfVersion="Gltf2", GrasshopperVersion="1.0.0007", InputGroups="{}", OutputGroups="{}", RelativeTolerance=0, RhinoVersion="7.36.23346.16351", UnitSystem=0, VersionCreated="1.14.0.0", VersionSaved="1.14.0.0"})

# ----
# TURN OFF
# BEFORE
# OPENING
# RHINO
# FILE
# UNITS & FLOORS (Sorted by Levels)
toggle = GroupToggle(ToggleActive=True, ToggleVisible=False)  # disabled

# ---- group: New Site Mesh (A4)
mesh = Mesh(<mesh referenced from the Rhino model>)

# ---- group: Projection Plane Point
pt = Point(<point referenced from the Rhino model>)

# ---- group: UNITS (LATEST LOCATION)
brep = Brep([<brep referenced from the Rhino model> x74])

# ---- group: Units Internalised LATEST LOCATION
brep_2 = Brep([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])

# ----
volume = Volume(Geometry=brep_2)  # -> Volume, Centroid
# 03
# 02
# 01
# 00
pdecon = Deconstruct(Point=volume.Centroid)  # -> XComponent, YComponent, ZComponent
cset = CreateSet(List=pdecon.ZComponent)  # -> Set, Map
sort = SortList(Keys=cset.Set)  # -> Keys, ValuesA
mindex = MemberIndex(Set=pdecon.ZComponent, Member=graft(sort.Keys))  # -> Index, Count

# ---- group: Units Grouped by Level
item = ListItem(List=brep_2, Index=mindex.Index, Wrap=True)

# ----
# Contour Lines (Projected on plane above)
xy = XYPlane(Origin=pt)
project = Project(Geometry=flatten(item), Plane=xy)  # -> Geometry, Transform
debrep = DeconstructBrep(Brep=project.Geometry)  # -> Faces, flatten(Edges), Vertices
len = Length(Curve=debrep.Edges)
larger = LargerThan(FirstNumber=len, SecondNumber="0.001")  # -> LargerThan, OrEqualTo
cull = CullPattern(List=debrep.Edges, CullPattern=larger.LargerThan)
panel = Panel("""0
1""")
cull_2 = CullPattern(List=cull, CullPattern=panel)
join = JoinCurves(Curves=cull_2, Preserve=False)
runion = RegionUnion(Curves=flatten(join))
item_2 = ListItem(List=runion, Index=0, Wrap=True)  # -> Item, Item1
number_slider = Slider(0.49, range=0..20)
disc = Discontinuity(Curve=item_2.Item, Level=1)  # -> Points, Parameters
nurbs = NurbsCurve(Vertices=disc.Points, Degree=3, Periodic=True)  # -> Curve, Length, Domain
neg = Negative(Value=number_slider)
xy_2 = XYPlane(Origin=Point(0, 0, 0))
offset = OffsetCurve(Curve=nurbs.Curve, Distance=number_slider, Corners=3)
offset_2 = OffsetCurve(Curve=offset, Distance=neg, Plane=xy_2, Corners=1)
offset_3 = OffsetCurve(Curve=offset_2, Distance=neg, Plane=xy_2, Corners=1)
series = Series(Start=Slider(0.06, range=-2..5), Step=Slider(2.03, range=-2..5), Count=Slider(7, range=0..10))
offset_4 = OffsetCurve(Curve=nurbs.Curve, Distance=series, Corners=1)  # -> flatten(Curve)

debrep_2 = DeconstructBrep(Brep=item)  # -> Faces, Edges, Vertices
bang = ExplodeTree(Data=item)  # -> Branch0, Branch1, Branch2, Branch3
area = Area(Geometry=debrep_2.Faces)  # -> Area, Centroid
pdecon_2 = Deconstruct(Point=area.Centroid)  # -> XComponent, YComponent, ZComponent
brep_3 = Brep(bang.Branch3)
brep_4 = Brep(item)  # disabled
# https://macad.speckle.xyz/streams/4975f9f0a8/commits/8fbb543497
panel_2 = Panel()  # disabled
panel_3 = Panel()  # disabled
sort_2 = SortList(Keys=pdecon_2.ZComponent, ValuesA=debrep_2.Faces)  # -> Keys, ValuesA
brep_5 = Brep([<brep referenced from the Rhino model> x71])  # disabled
item_3 = ListItem(List=sort_2.ValuesA, Index=0, Wrap=True)  # -> Item1, Item
esokv = ExtendSpeckleObjectByKeyValue(Keys=panel_3, Values=panel_2, selectedKitName="Objects")  # disabled

# ---- group: Floors Grouped by Levels
trim = TrimTree(Tree=item_3.Item, Depth=1)

# ----
panel_4 = Panel("https://macad.speckle.xyz/streams/4975f9f0a8/branches/site%2F04-community-site")  # disabled
area_2 = Area(Geometry=trim)  # -> Area, Centroid
Z = UnitZ(Factor="-1")
move = Move(Geometry=area_2.Centroid, Motion=Z)  # -> Geometry, Transform
panel_5 = Panel("First one here :)")  # disabled
project_2 = ProjectPoint(Point=move.Geometry, Direction=Vector(0, 0, -1), Geometry=flatten(trim))  # -> Point, Index
bbox = BoundingBox(Content=brep_5, Plane=PlaneXY(0, 0, 0), UnionBox=True)  # -> Box, Box_2; disabled
number_slider_2 = Slider(100, range=0..1000)  # disabled
null = NullItem(Item=project_2.Point)  # -> NullFlags, InvalidFlags, Description
volume_2 = Volume(Geometry=bbox.Box_2)  # -> Volume, Centroid; disabled

# ---- group: Floors by Levels (no duplication)
cull_3 = CullPattern(List=trim, CullPattern=null.NullFlags)

# ----
send = Send(
    Stream=panel_4,
    Message=panel_5,
    Brep=brep_5,
    AutoSend=False,
    BaseId="4211a9499277c30a864f8af716dcf53c",
    CurrentComponentState="expired",
    KitName="Objects",
    OutputWrappers="https://macad.speckle.xyz\t4975f9f0a8\t25e44ca5db",
    UseDefaultCache=True,
    selectedKitName="Objects")  # disabled
# https://macad.speckle.xyz/streams/4975f9f0a8/commits/d13e3ec6c6
sph = Sphere(Base=volume_2.Centroid, Radius=number_slider_2)  # disabled
edges = BrepEdges(Brep=cull_3)  # -> Naked, Interior, NonManifold
join_2 = BrepJoin(Breps=cull_3)  # -> Breps, Closed

crv = Curve(item_2.Item1)
disc_2 = Discontinuity(Curve=crv, Level=1)  # -> Points, Parameters
nurbs_2 = NurbsCurve(Vertices=disc_2.Points, Degree=3, Periodic=True)  # -> Curve, Length, Domain

panel_6 = Panel("""ELEMENTAL MARS
G06
VOLUME
MULTIPLE
SITE-PLACE HOLDER
NO MATERIAL""")  # disabled
panel_7 = Panel("""BIMSC-PROJECT
BIMSC-ORIGINATOR
BIMSC-VOLUME
BIMSC-LEVEL
BIMSC-TYPE
BIMSC-MATERIAL""")  # disabled
edges_2 = BrepEdges(Brep=join_2.Breps)  # -> Naked, Interior, NonManifold
trim_2 = TrimTree(Tree=edges.Naked, Depth=1)
pt_2 = Point([<point referenced from the Rhino model> x4])
# https://macad.speckle.xyz/streams/4975f9f0a8/commits/8fbb543497
dso = DeconstructSpeckleObject(selectedKitName="Objects")  # disabled
geo = Geometry(edges_2.Naked)

# ---- group: G06 Stream
panel_8 = Panel("https://macad.speckle.xyz/streams/4975f9f0a8/branches/students%2Fg06-site_locations")  # disabled

# ----
number_slider_3 = Slider(3, range=0..20)  # disabled
panel_9 = Panel("A4")  # disabled

crv_2 = Curve(runion)
Z_2 = UnitZ(Factor=Slider(24, range=0..50))
extr = Extrude(Base=crv_2, Direction=Z_2)
cap = CapHoles(Brep=extr)
item_4 = ListItem(List=cap, Index=0, Wrap=True)  # -> Item, Item1, Item2
sdiff = SolidDifference(BrepsA=item_4.Item, BrepsB=item_4.Item1)
sdiff_2 = SolidDifference(BrepsA=sdiff, BrepsB=item_4.Item2)

mesh_2 = Mesh(dso)  # disabled
boundary = BoundarySurfaces(Edges=geo)
rev = ReverseList(List=pt_2)
esokv_2 = ExtendSpeckleObjectByKeyValue(SpeckleObject=brep_4, Keys=panel_7, Values=panel_6, selectedKitName="Objects")  # disabled
sovk = SpeckleObjectValueByKey(Key=panel_9, selectedKitName="Objects")  # disabled
area_3 = Area(Geometry=boundary)  # -> Area, Centroid
cps = ClosestPoints(Point=pt_2, Cloud=disc_2.Points, Count="24")  # -> ClosestPoint, CPIndex, Distance
cir = Circle(Plane=pt_2, Radius=1)  # -> graft(Circle)
panel_10 = Panel("Footprint")  # disabled
dso_2 = DeconstructSpeckleObject(selectedKitName="Objects")  # disabled
trim_3 = TrimTree(Tree=area_3.Centroid, Depth=1)
item_5 = ListItem(List=flatten(mesh_2), Index=number_slider_3, Wrap=True)  # disabled
disc_3 = Discontinuity(Curve=geo, Level=1)  # -> flatten(Points), Parameters
pdecon_3 = Deconstruct(Point=trim_3)  # -> XComponent, YComponent, ZComponent
alongcrv = SortAlongCurve(Points=cps.ClosestPoint, Curve=cir)  # -> Points, Indices
send_2 = Send(
    Stream=panel_8,
    Message=panel_10,
    Data=esokv_2,
    AutoSend=False,
    BaseId="5c085f5baf2f57c841840d9e65b2c551",
    CurrentComponentState="expired",
    KitName="Objects",
    OutputWrappers="https://macad.speckle.xyz\t4975f9f0a8\t123ad7dd3c",
    UseDefaultCache=True,
    selectedKitName="Objects")  # disabled
# Speckle
panel_11 = Panel(dso_2)  # disabled
preview = CustomPreview(Geometry=boundary, Material=ColourSwatch(SwatchColor=RGB(117, 117, 117)))
item_6 = ListItem(List=pdecon_3.ZComponent, Index=0, Wrap=True)
merge = Merge(Data1=Slider(1, range=0..23), Data2=Slider(1, range=0..23), Data3=Slider(1, range=0..23), Data4=Slider(7, range=0..23))  # -> graft(Result)
pt_3 = Point(<point referenced from the Rhino model>)
shift = ShiftList(List=alongcrv.Points, Shift=merge, Wrap=True)
pdecon_4 = Deconstruct(Point=pt_3)  # -> XComponent, YComponent, ZComponent
flatten = FlattenTree(Tree=item_6, Path="{0}")
pline = PolyLine(Vertices=shift, Closed=True)
roundd = RoundToDecimalPlace(NumberX=pdecon_4.XComponent, DecimalPlace="2", RoundType=0)  # -> Rounded, Difference
roundd_2 = RoundToDecimalPlace(NumberX=pdecon_4.YComponent, DecimalPlace="2", RoundType=0)  # -> Rounded, Difference
boundary_2 = BoundarySurfaces(Edges=pline)
points = PointList(Points=shift, Size=Slider(1, range=0..10))
item_7 = ListItem(List=flatten, Index=Slider(3, range=0..3), Wrap=True)
panel_12 = Panel(roundd_2.Rounded)
panel_13 = Panel(roundd.Rounded)
panel_14 = Panel(item_7)
area_4 = Area(Geometry=boundary_2)  # -> Area, Centroid
pdecon_5 = Deconstruct(Point=area_4.Centroid)  # -> XComponent, YComponent, ZComponent
subtraction = Subtraction(A=item_6, B=pdecon_5.ZComponent)
Z_3 = UnitZ(Factor=subtraction)
move_2 = Move(Geometry=boundary_2, Motion=Z_3)  # -> Geometry, Transform

# ----
# TURN OFF
# BEFORE
# OPENING
# RHINO
# FILE
toggle_2 = GroupToggle(ToggleActive=True, ToggleVisible=False)  # disabled

# ----
# Pavilions Outline - Curved
number_slider_4 = Slider(-0.4, range=-2..2)
brep_6 = Brep(item)
volume_3 = Volume(Geometry=brep_6)  # -> Volume, Centroid
plfit = PlaneFit(Points=flatten(volume_3.Centroid))  # -> Plane, Deviation
Z_4 = UnitZ(Factor=Slider(1.5, range=-5..5))
offset_5 = OffsetCurve(Curve=nurbs_2.Curve, Distance=number_slider_4, Corners=1)
Z_5 = UnitZ(Factor=Slider(-1.2, range=-5..0))
move_3 = Move(Geometry=plfit.Plane, Motion=Z_4)  # -> Geometry, Transform
move_4 = Move(Geometry=plfit.Plane, Motion=Z_5)  # -> Geometry, Transform
Z_6 = UnitZ(Factor=1)
projecta = ProjectAlong(Geometry=offset_5, Plane=move_3.Geometry, Direction=Z_6)  # -> Geometry, Transform

Z_7 = UnitZ(Factor=1)
projecta_2 = ProjectAlong(Geometry=offset_4, Plane=move_4.Geometry, Direction=Z_7)  # -> Geometry, Transform

# ----
# Pavilions Ground
projecta_3 = ProjectAlong(Geometry=crv, Plane=move_4.Geometry, Direction=Z_7)  # -> Geometry, Transform
patch = Patch(Points=disc_3.Points, Spans=20, Flexibility=5, Trim=True)
project_3 = Project(Curve=crv, Brep=patch, Direction=Vector(0, 0, 1))
srfsplit = SurfaceSplit(Surface=patch, Curves=project_3)
boundary_3 = BoundarySurfaces(Edges=projecta_3.Geometry)
item_8 = ListItem(List=srfsplit, Index="1", Wrap=True)
swatch = ColourSwatch(SwatchColor=RGB(77, 87, 62))
contour = Contour(Shape=item_8, Point=Point(0, 0, 0), Direction=Vector(0, 0, 1), Distance="0.5")
preview_2 = CustomPreview(Geometry=item_8, Material=ColourSwatch(SwatchColor=RGB(99, 99, 99)))  # disabled

# ----
# Units (Pebbles)
brep_7 = Brep(item)
mesh_3 = MeshBrep(
    Brep=brep_7,
    Settings={GridMaxCount=0, GridMinCount=16, JaggedSeams=False, MaxEdgeLength=0, MinEdgeLength=0.0001, MinTolerance=0, Refine=True, RefineAngle=0, RelativeTolerance=0.65, SimplePlanes=True, Tolerance=0})
wbcatmullclark = WeaverbirdsCatmullClarkSubdivision(MeshCurves=mesh_3, Level=Slider(2, range=0..2), SmoothNakedEdges=Slider(0, range=0..2))
preview_3 = CustomPreview(Geometry=brep_7, Material=ColourSwatch(SwatchColor=RGBA(189, 189, 189, 205)))  # disabled
preview_4 = CustomPreview(Geometry=wbcatmullclark, Material=ColourSwatch(SwatchColor=RGB(145, 142, 132)))  # disabled

panel_15 = Panel("""0
0
1""")

# ---- group: Original Wall Control Points
# Pavilions Outline - Dispatched Points
pt_4 = Point(disc_2.Points)

# ----
Z_8 = UnitZ(Factor=Slider(-0.5, range=-10..10))
move_5 = Move(Geometry=patch, Motion=Z_8)  # -> Geometry, Transform
cull_4 = CullPattern(List=pt_4, CullPattern=invert(panel_15))
cull_5 = CullPattern(List=pt_4, CullPattern=panel_15)
partition = PartitionList(List=cull_4, Size="2")
avr = Average(Input=partition)
scale = Scale(Geometry=partition, Center=avr, Factor=Slider(0.16, range=0..1))  # -> flatten(Geometry), Transform

crv_cp = CurveClosestPoint(Point=cull_5, Curve=offset_5)  # -> Point, Parameter, Distance
eval = EvaluateCurve(Curve=offset_5, Parameter=crv_cp.Parameter)  # -> Point, Tangent, Angle
rotate = Rotate(Geometry=eval.Tangent, Angle=1.570796327, Plane=PlaneXY(0, 0, 0))  # -> Geometry, Transform
amp = Amplitude(Vector=rotate.Geometry, Amplitude=Slider(4, range=-10..10))
vdis = VectorDisplay(Anchor=eval.Point, Vector=rotate.Geometry)
move_6 = Move(Geometry=cull_5, Motion=amp)  # -> Geometry, Transform

crv_cp_2 = CurveClosestPoint(Point=scale.Geometry, Curve=offset_5)  # -> Point, Parameter, Distance
eval_2 = EvaluateCurve(Curve=offset_5, Parameter=crv_cp_2.Parameter)  # -> Point, Tangent, Angle
rotate_2 = Rotate(Geometry=eval_2.Tangent, Angle=1.570796327, Plane=PlaneXY(0, 0, 0))  # -> Geometry, Transform
amp_2 = Amplitude(Vector=rotate_2.Geometry, Amplitude=Slider(-0.5, range=-10..10))
vdis_2 = VectorDisplay(Anchor=eval_2.Point, Vector=rotate_2.Geometry)
move_7 = Move(Geometry=cull_4, Motion=amp_2)  # -> Geometry, Transform

previewlw = CustomPreviewLineweights(
    Geometry=contour,
    Shader=ColourSwatch(SwatchColor=RGB(255, 255, 255)),
    Thickness=Slider(3.07, range=0..5),
    Absolute=False)

# ---- group: 1s
index = ItemIndex(List=pt_4, Item=cull_5)

# ----
Z_9 = UnitZ(Factor=Slider(-112, range=-200..0))

# ---- group: 2s
index_2 = ItemIndex(List=pt_4, Item=cull_4)

# ----
move_8 = Move(Geometry=sdiff_2, Motion=Z_9)  # -> Geometry, Transform
panel_16 = Panel("""0
1
12
13
16
17
32
33
44
45
48
49""")
replace = ReplaceItems(List=pt_4, Item=move_6.Geometry, Indices=index, Wrap=False)
item_9 = ListItem(List=cull_4, Index=panel_16, Wrap=True)

crv_cp_3 = CurveClosestPoint(Point=item_9, Curve=offset_5)  # -> Point, Parameter, Distance
eval_3 = EvaluateCurve(Curve=offset_5, Parameter=crv_cp_3.Parameter)  # -> Point, Tangent, Angle
rotate_3 = Rotate(Geometry=eval_3.Tangent, Angle=1.570796327, Plane=PlaneXY(0, 0, 0))  # -> Geometry, Transform
vdis_3 = VectorDisplay(Anchor=eval_3.Point, Vector=rotate_3.Geometry)
amp_3 = Amplitude(Vector=rotate_3.Geometry, Amplitude=Slider(0.5, range=-10..10))
move_9 = Move(Geometry=item_9, Motion=amp_3)  # -> Geometry, Transform

replace_2 = ReplaceItems(List=replace, Item=move_7.Geometry, Indices=index_2, Wrap=False)
panel_17 = Panel("""0
1
18
19
24
25
48
49
66
67
72
73""")
replace_3 = ReplaceItems(List=replace_2, Item=item_9, Indices=panel_17, Wrap=False)
Z_10 = UnitZ(Factor=Slider(3.5, range=-5..15))
nurbs_3 = NurbsCurve(Vertices=replace_3, Degree=3, Periodic=True)  # -> Curve, Length, Domain
move_10 = Move(Geometry=patch, Motion=Z_10)  # -> Geometry, Transform
crv_3 = Curve([<curve referenced from the Rhino model> x24])  # disabled
crv_4 = Curve([<curve referenced from the Rhino model> x24])  # disabled
crv_5 = Curve([<curve referenced from the Rhino model> x24])  # disabled
crv_6 = Curve([<curve referenced from the Rhino model> x24])  # disabled
project_4 = ProjectPoint(Point=replace_3, Direction=Vector(0, 0, -1), Geometry=move_10.Geometry)  # -> Point, Index
join_3 = JoinCurves(Curves=crv_3, Preserve=False)  # disabled
join_4 = JoinCurves(Curves=crv_4, Preserve=False)  # disabled
join_5 = JoinCurves(Curves=crv_5, Preserve=False)  # disabled
join_6 = JoinCurves(Curves=crv_6, Preserve=False)  # disabled
Z_11 = UnitZ(Factor=Slider(-4, range=-20..0))
boundary_4 = BoundarySurfaces(Edges=join_3)  # disabled
boundary_5 = BoundarySurfaces(Edges=join_4)  # disabled
boundary_6 = BoundarySurfaces(Edges=join_5)  # disabled
boundary_7 = BoundarySurfaces(Edges=join_6)  # disabled
Z_12 = UnitZ(Factor=Slider(2, range=-5..5))
merge_2 = Merge(Data1=boundary_4, Data2=boundary_5, Data3=boundary_6, Data4=boundary_7)  # disabled
item_10 = ListItem(List=project_4.Point, Index=index, Wrap=True)
move_11 = Move(Geometry=item_10, Motion=Z_12)  # -> Geometry, Transform
panel_18 = Panel("""0
1
18
19
24
25
48
49
66
67
72
73""")
replace_4 = ReplaceItems(List=project_4.Point, Item=move_11.Geometry, Indices=index, Wrap=False)
materials = QueryMaterials()

# ---- group: Floors Reference Planes
srf = Surface([<surface referenced from the Rhino model> x4])

# ----
item_11 = ListItem(List=replace_4, Index=panel_18, Wrap=True)
Z_13 = UnitZ(Factor=Slider(2.06, range=0..10))
move_12 = Move(Geometry=item_11, Motion=Z_13)  # -> Geometry, Transform
project_5 = Project(Curve=offset_5, Brep=patch, Direction=Vector(0, 0, 1))  # -> flatten(Curve)
Z_14 = UnitZ(Factor=Slider(1, range=-10..10))
project_6 = Project(Curve=offset_5, Brep=patch, Direction=Vector(0, 0, 1))
Z_15 = UnitZ(Factor=Slider(-0.5, range=-10..10))
replace_5 = ReplaceItems(List=replace_4, Item=move_12.Geometry, Indices=panel_18, Wrap=False)
move_13 = Move(Geometry=project_5, Motion=Z_15)  # -> Geometry, Transform
move_14 = Move(Geometry=project_6, Motion=Z_14)  # -> Geometry, Transform
area_5 = Area(Geometry=srf)  # -> Area, Centroid
edges_3 = BrepEdges(Brep=srf)  # -> Naked, Interior, NonManifold
preview_5 = CustomPreview(Geometry=srf, Material=ColourSwatch(SwatchColor=RGB(242, 255, 0)))  # disabled
number_slider_5 = Slider(-5.47, range=-10..0)
shift_2 = ShiftList(List=area_5.Centroid, Shift=1, Wrap=False)
rebcrv = RebuildCurve(Curve=move_14.Geometry, EndTangents=False)
rebcrv_2 = RebuildCurve(Curve=move_13.Geometry, EndTangents=False)
join_7 = JoinCurves(Curves=edges_3.Naked, Preserve=False)  # -> flatten(Curves)
ln = Line(StartPoint=area_5.Centroid, EndPoint=shift_2)
nurbs_4 = NurbsCurve(Vertices=replace_5, Degree=3, Periodic=True)  # -> Curve, Length, Domain
ext = ExtendCurve(Curve=ln, Type=0, Start=number_slider_5, End=number_slider_5)
end = EndPoints(Curve=ext)  # -> Start, End
project_7 = ProjectPoint(Point=[end.Start, end.End], Direction=Vector(0, 0, -1), Geometry=srf)  # -> Point, Index
project_8 = ProjectPoint(Point=[end.Start, end.End], Direction=Vector(0, 0, 1), Geometry=srf)  # -> Point, Index
xy_3 = XYPlane(Origin=Point(0, 0, 0))
null_2 = NullItem(Item=project_7.Point)  # -> NullFlags, InvalidFlags, Description
null_3 = NullItem(Item=project_8.Point)  # -> NullFlags, InvalidFlags, Description
cull_6 = CullPattern(List=project_7.Point, CullPattern=invert(null_2.NullFlags))
cull_7 = CullPattern(List=project_8.Point, CullPattern=invert(null_3.NullFlags))
previewlw_2 = CustomPreviewLineweights(
    Geometry=[nurbs_4.Curve, move_14.Geometry, move_13.Geometry],
    Shader=ColourSwatch(SwatchColor=RGB(153, 0, 0)),
    Thickness=Slider(6.3, range=0..10),
    Absolute=False)
ln_2 = Line(StartPoint=cull_6, EndPoint=cull_7)
project_9 = Project(Geometry=ln_2, Plane=xy_3)  # -> Geometry, Transform
angle = Angle(VectorA=ln_2, VectorB=project_9.Geometry)  # -> Angle, Reflex
deg = Degrees(Radians=angle.Angle)
panel_19 = Panel(deg)
number_slider_6 = Slider(1.25, range=0..2)
neg_2 = Negative(Value=number_slider_6)
offset_6 = OffsetCurve(Curve=ln_2, Distance=graft([number_slider_6, neg_2]), Corners=1)

# ---- group: Doors Locations
# Doors
crv_7 = Curve([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])

# ----
# Wall
merge_3 = Merge(Data1=flatten(nurbs_4.Curve), Data2=flatten(rebcrv), Data3=flatten(rebcrv_2))
toggle_3 = GroupToggle(ToggleActive=True, ToggleVisible=False)  # disabled
loft_opt = LoftOptions(Closed=False, Adjust=True, Rebuild=Slider(800, range=0..1000), Refit=0, Type=Slider(0, range=0..5))
loft = Loft(Curves=merge_3, Options=loft_opt)
offsrf = OffsetSurface(Surface=loft, Distance=Slider(-0.3, range=-1..1), BothSides=0, CreateSolid=True)

# ----
# Openings
crv_8 = Curve(crv_7)
disc_4 = Discontinuity(Curve=crv_8, Level=1)  # -> Points, Parameters
area_6 = Area(Geometry=crv_8)  # -> Area, Centroid
nurbs_5 = NurbsCurve(Vertices=disc_4.Points, Degree=3, Periodic=True)  # -> Curve, Length, Domain
scale_2 = Scale(Geometry=flatten(nurbs_5.Curve), Center=area_6.Centroid, Factor=Slider(0.74, range=0..1))  # -> Geometry, Transform
boundary_8 = BoundarySurfaces(Edges=scale_2.Geometry)
offsrf_2 = OffsetSurface(Surface=boundary_8, Distance=Slider(2.4, range=-3..5), BothSides=0, CreateSolid=True)
join_8 = BrepJoin(Breps=flatten(offsrf_2))  # -> Breps, Closed
Z_16 = UnitZ(Factor=Slider(-0.4, range=-2..2))
move_15 = Move(Geometry=join_8.Breps, Motion=Z_16)  # -> Geometry, Transform

# ----
# Windows
crv_9 = Curve([<curve referenced from the Rhino model> x10])
pt_5 = Point(<point referenced from the Rhino model>)
crv_10 = Curve([<curve referenced from the Rhino model> x6])
pt_6 = Point(<point referenced from the Rhino model>)
pt_7 = Point(<point referenced from the Rhino model>)
crv_11 = Curve([<curve referenced from the Rhino model> x4])
crv_12 = Curve([<curve referenced from the Rhino model> x12])
pt_8 = Point(<point referenced from the Rhino model>)
disc_5 = Discontinuity(Curve=crv_9, Level=1)  # -> Points, Parameters
disc_6 = Discontinuity(Curve=crv_10, Level=1)  # -> Points, Parameters
disc_7 = Discontinuity(Curve=crv_11, Level=1)  # -> Points, Parameters
disc_8 = Discontinuity(Curve=crv_12, Level=1)  # -> Points, Parameters
number_slider_7 = Slider(0.36, range=0..1)
number_slider_8 = Slider(1.62, range=0..2)
nurbs_6 = NurbsCurve(Vertices=disc_5.Points, Degree=3, Periodic=True)  # -> Curve, Length, Domain
nurbs_7 = NurbsCurve(Vertices=disc_6.Points, Degree=3, Periodic=True)  # -> Curve, Length, Domain
nurbs_8 = NurbsCurve(Vertices=disc_7.Points, Degree=3, Periodic=True)  # -> Curve, Length, Domain
nurbs_9 = NurbsCurve(Vertices=disc_8.Points, Degree=3, Periodic=True)  # -> Curve, Length, Domain
area_7 = Area(Geometry=nurbs_6.Curve)  # -> Area, Centroid
area_8 = Area(Geometry=nurbs_8.Curve)  # -> Area, Centroid
area_9 = Area(Geometry=nurbs_7.Curve)  # -> Area, Centroid
area_10 = Area(Geometry=nurbs_9.Curve)  # -> Area, Centroid
scale_3 = Scale(Geometry=nurbs_6.Curve, Center=area_7.Centroid, Factor=number_slider_7)  # -> Geometry, Transform
scale_4 = Scale(Geometry=nurbs_8.Curve, Center=area_8.Centroid, Factor=number_slider_7)  # -> Geometry, Transform
scale_5 = Scale(Geometry=nurbs_7.Curve, Center=area_9.Centroid, Factor=number_slider_7)  # -> Geometry, Transform
scale_6 = Scale(Geometry=nurbs_9.Curve, Center=area_10.Centroid, Factor=number_slider_7)  # -> Geometry, Transform
scale_nu = ScaleNU(Geometry=scale_3.Geometry, Plane=area_7.Centroid, ScaleX=1, ScaleY=1, ScaleZ=number_slider_8)  # -> Geometry, Transform
scale_nu_2 = ScaleNU(Geometry=scale_5.Geometry, Plane=area_9.Centroid, ScaleX=1, ScaleY=1, ScaleZ=number_slider_8)  # -> Geometry, Transform
scale_nu_3 = ScaleNU(Geometry=scale_4.Geometry, Plane=area_8.Centroid, ScaleX=1, ScaleY=1, ScaleZ=number_slider_8)  # -> Geometry, Transform
scale_nu_4 = ScaleNU(Geometry=scale_6.Geometry, Plane=area_10.Centroid, ScaleX=1, ScaleY=1, ScaleZ=number_slider_8)  # -> Geometry, Transform
ln_3 = Line(StartPoint=area_10.Centroid, EndPoint=pt_8)
ln_4 = Line(StartPoint=area_8.Centroid, EndPoint=pt_7)
ln_5 = Line(StartPoint=area_7.Centroid, EndPoint=pt_5)
ln_6 = Line(StartPoint=area_9.Centroid, EndPoint=pt_6)
extrcrv = ExtrudeAlong(Base=scale_nu.Geometry, Curve=ln_5)
extrcrv_2 = ExtrudeAlong(Base=scale_nu_2.Geometry, Curve=ln_6)
extrcrv_3 = ExtrudeAlong(Base=scale_nu_3.Geometry, Curve=ln_4)
extrcrv_4 = ExtrudeAlong(Base=scale_nu_4.Geometry, Curve=ln_3)
cap_2 = CapHoles(Brep=extrcrv)
cap_3 = CapHoles(Brep=extrcrv_2)
cap_4 = CapHoles(Brep=extrcrv_3)
cap_5 = CapHoles(Brep=extrcrv_4)

# ----
# Roof Base Frame
number_slider_9 = Slider(0.18, range=0..1)
debrep_3 = DeconstructBrep(Brep=offsrf)  # -> Faces, Edges, Vertices
Z_17 = UnitZ(Factor=number_slider_9)
item_12 = ListItem(List=debrep_3.Edges, Index=Slider(2, range=0..7), Wrap=True)
move_16 = Move(Geometry=nurbs_4.Curve, Motion=Z_17)  # -> Geometry, Transform
len_2 = Length(Curve=move_16.Geometry)
division = Division(A=len_2, B="0.5")
divide = DivideCurve(Curve=move_16.Geometry, Count=division, Kinks=False)  # -> Points, Tangents, Parameters
pl = PlaneNormal(Origin=divide.Points, ZAxis=divide.Tangents)
planesrf = PlaneSurface(Plane=pl, XSize=Domain(-1, 1), YSize=Domain(-1, 1))
bcx = BrepCurve(Brep=planesrf, Curve=nurbs_4.Curve)  # -> Curves, Points
bcx_2 = BrepCurve(Brep=planesrf, Curve=item_12)  # -> Curves, Points
merge_4 = Merge(Data1=graft(divide.Points), Data2=bcx.Points, Data3=bcx_2.Points)
pline_2 = PolyLine(Vertices=merge_4, Closed=True)  # -> flatten(Polyline)
loft_2 = Loft(Curves=pline_2, Options={Adjust=False, Closed=True, LoftEnds=0, LoftSimp=0, LoftType=0, Rebuild=10, Refit=0.01})

merge_5 = Merge(Data1=cap_2, Data2=cap_3, Data3=cap_4, Data4=cap_5)  # -> flatten(Result)
sdiff_3 = SolidDifference(BrepsA=offsrf, BrepsB=[move_15.Geometry, merge_5])

bbx = BrepBrep(BrepA=offsrf, BrepB=srf)  # -> Curves, Points
bang_2 = ExplodeTree(Data=bbx.Curves)  # -> Branch0, Branch1, Branch2, Branch3
panel_20 = Panel("""0
2""")
item_13 = ListItem(List=bang_2.Branch1, Index=0, Wrap=True)  # -> Item, Item1, Item2
item_14 = ListItem(List=bang_2.Branch2, Index=0, Wrap=True)  # -> Item, Item1
# Pavilions Floor
item_15 = ListItem(List=bang_2.Branch0, Index=0, Wrap=True)
item_16 = ListItem(List=bang_2.Branch3, Index=0, Wrap=True)
patch_2 = Patch(
    Curves=flatten([item_15, item_13.Item, item_13.Item2, item_14.Item, item_14.Item1, item_16, offset_6]),
    Spans=20,
    Flexibility=Slider(6, range=0..6),
    Trim=True)
project_10 = Project(Curve=offset_5, Brep=patch_2, Direction=Vector(0, 0, 1))
patch_3 = Patch(Curves=project_10, Spans=Slider(95, range=0..100), Flexibility=Slider(6, range=0..6), Trim=True)
mesh_4 = MeshBrep(
    Brep=patch_3,
    Settings={GridMaxCount=0, GridMinCount=16, JaggedSeams=False, MaxEdgeLength=0, MinEdgeLength=0.0001, MinTolerance=0, Refine=True, RefineAngle=0, RelativeTolerance=0.65, SimplePlanes=True, Tolerance=0})
triremesh = TriRemesh(Geometry=mesh_4, Length=Slider(0.58, range=0..1), Iterations=25)  # -> Triangulation, Dual, Creases
nv = NakedVertices(Mesh=triremesh.Triangulation)  # -> ClothedIndex, NakedIndex, ClothedPts, NakedPts
edgelengths = EdgeLengths(Mesh=triremesh.Triangulation, LengthFactor=Slider(0.58, range=0..1), Strength=1)
anchor = Anchor(Point=nv.NakedPts, Strength=10000)
show = Show(G=triremesh.Triangulation)
zombiesolver = ZombieSolver(GoalObjects=[show, edgelengths, anchor], Threshold=1e-10, Tolerance=0.0001, MaxIterations=50000)  # -> I, V, O
item_17 = ListItem(List=zombiesolver.O, Index=0, Wrap=True)

swatch_2 = ColourSwatch(SwatchColor=RGB(166, 40, 40))
preview_6 = CustomPreview(Geometry=sdiff_3, Material=ColourSwatch(SwatchColor=RGB(125, 89, 45)))  # disabled

# ---- group: Anchors
pt_9 = Point([<point referenced from the Rhino model> x4])

pt_10 = Point([<point referenced from the Rhino model> x4])

# ----
preview_7 = CustomPreview(Geometry=loft_2, Material=ColourSwatch(SwatchColor=RGB(0, 45, 112)))  # disabled
vmesh = MeshToVolume()

# ----
# Pavilions
# Steps
crv_13 = Curve(Tree({0;0;0;0;0;0;0;0}: [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], {0;0;0;0;0;0;0;1}: [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], {0;0;0;0;0;0;0;2}: [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], {0;0;0;0;0;0;1;0}: [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], {0;0;0;0;0;0;1;1}: [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], {0;0;0;0;0;0;1;2}: [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]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))  # disabled
crv_14 = Curve(Tree({0;0;0;0;0;0;0;0}: [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], {0;0;0;0;0;0;0;1}: [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], {0;0;0;0;0;0;0;2}: [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], {0;0;0;0;0;0;1;0}: [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], {0;0;0;0;0;0;1;1}: [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], {0;0;0;0;0;0;1;2}: [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], {0;0;0;0;0;0;2;0}: [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], {0;0;0;0;0;0;2;1}: [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], {0;0;0;0;0;0;2;2}: [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], {0;0;0;0;0;0;3;0}: [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], {0;0;0;0;0;0;3;1}: [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], {0;0;0;0;0;0;3;2}: [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]))  # disabled
crv_15 = Curve(Tree({0;0;0;0;0;0;0;0}: [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], {0;0;0;0;0;0;0;1}: [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], {0;0;0;0;0;0;0;2}: [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], {0;0;0;0;0;0;1;0}: [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], {0;0;0;0;0;0;1;1}: [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], {0;0;0;0;0;0;1;2}: [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], {0;0;0;0;0;0;2;0}: [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], {0;0;0;0;0;0;2;1}: [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], {0;0;0;0;0;0;2;2}: [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]))  # disabled
crv_16 = Curve(Tree({0;0;0;0;0;0;0;0}: [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], {0;0;0;0;0;0;0;1}: [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], {0;0;0;0;0;0;0;2}: [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], {0;0;0;0;0;0;1;0}: [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], {0;0;0;0;0;0;1;1}: [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], {0;0;0;0;0;0;1;2}: [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]))  # disabled
crv_17 = Curve(Tree({0;0;0;0;0;0;0;0}: [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], {0;0;0;0;0;0;0;1}: [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], {0;0;0;0;0;0;0;2}: [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], {0;0;0;0;0;0;1;0}: [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], {0;0;0;0;0;0;1;1}: [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], {0;0;0;0;0;0;1;2}: [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]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))  # disabled

trim_4 = TrimTree(Tree=crv_13, Depth=1)  # disabled
trim_5 = TrimTree(Tree=crv_16, Depth=1)  # disabled
trim_6 = TrimTree(Tree=crv_17, Depth=1)  # disabled
trim_7 = TrimTree(Tree=crv_14, Depth=1)  # disabled
trim_8 = TrimTree(Tree=crv_15, Depth=1)  # disabled
panel_21 = Panel("""0
1""")  # disabled
item_18 = ListItem(List=trim_8, Index=panel_21, Wrap=True)  # disabled
panel_22 = Panel("""0.2
0.4""")  # disabled
Z_18 = UnitZ(Factor=panel_22)  # disabled
item_19 = ListItem(List=trim_4, Index=0, Wrap=True)  # disabled
item_20 = ListItem(List=trim_5, Index=0, Wrap=True)  # disabled
item_21 = ListItem(List=trim_6, Index=0, Wrap=True)  # disabled
item_22 = ListItem(List=trim_8, Index=0, Wrap=True)  # disabled
item_23 = ListItem(List=trim_7, Index=0, Wrap=True)  # disabled
move_17 = Move(Geometry=item_18, Motion=Z_18)  # -> Geometry, Transform; disabled
merge_6 = Merge(Data1=item_19, Data2=item_20, Data3=item_21, Data4=item_23, Data5=item_22)  # disabled
panel_23 = Panel("-0.2")  # disabled
Z_19 = UnitZ(Factor=1)  # disabled
Z_20 = UnitZ(Factor=panel_23)  # disabled
move_18 = Move(Geometry=merge_6, Motion=Z_19)  # -> Geometry, Transform; disabled
panel_24 = Panel("-2.5")  # disabled
extr_2 = Extrude(Base=move_17.Geometry, Direction=Z_20)  # disabled
boundary_9 = BoundarySurfaces(Edges=move_17.Geometry)  # disabled
Z_21 = UnitZ(Factor=panel_24)  # disabled
extr_3 = Extrude(Base=move_18.Geometry, Direction=Z_21)  # disabled
cap_6 = CapHoles(Brep=extr_3)  # disabled
toggle_4 = GroupToggle(ToggleActive=True, ToggleVisible=False)  # disabled
mesh_5 = MeshBrep(
    Brep=cap_6,
    Settings={GridMaxCount=0, GridMinCount=16, JaggedSeams=False, MaxEdgeLength=0, MinEdgeLength=0.0001, MinTolerance=0, Refine=True, RefineAngle=0, RelativeTolerance=0.65, SimplePlanes=True, Tolerance=0})  # disabled

mshoffset = MeshOffset(Mesh=item_17, OffsetDistance="0.3", SolidToggle=True, OffsetBothSidesToggle=False)
item_24 = ListItem(List=join_7, Index=0, Wrap=True)  # -> Item, Item1, Item2, Item3; disabled
levels = QueryLevels(BuildingStory=True)
# To Revit...  and Beyond
number_slider_10 = Slider(1, range=0..1)

# ---- group: Building Pads
join_9 = JoinCurves(Curves=geo, Preserve=False)  # -> flatten(Curves)

# ---- group: Roof Mesh
mesh_6 = Mesh(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)

# ----
brep_8 = Brep(<brep referenced from the Rhino model>)
brep_9 = Brep(<brep referenced from the Rhino model>)
brep_10 = Brep(<brep referenced from the Rhino model>)
brep_11 = Brep(<brep referenced from the Rhino model>)
contour_2 = Contour(Shape=item_17, Point=Point(0, 0, 0), Direction=Vector(0, 0, 1), Distance=Slider(0.33, range=0..1))
preview_8 = CustomPreview(Geometry=mshoffset, Material=ColourSwatch(SwatchColor=RGB(72, 89, 52)))
item_25 = ListItem(Index=0, Wrap=True)  # -> Item, Item1, Item2, Item3
edges_4 = BrepEdges(Brep=brep_8)  # -> Naked, Interior, NonManifold
edges_5 = BrepEdges(Brep=brep_9)  # -> Naked, Interior, NonManifold
edges_6 = BrepEdges(Brep=brep_10)  # -> Naked, Interior, NonManifold
edges_7 = BrepEdges(Brep=brep_11)  # -> Naked, Interior, NonManifold
item_26 = ListItem(List=join_9, Index=0, Wrap=True)  # -> Item, Item1, Item2, Item3, Item4, Item5, Item6, Item7, Item8
trigger = Trigger(Interval=-1000, TimerInterval=1000, Target=g_shape_3)

# ---- group: Pavilions
geo_2 = Geometry([<brep referenced from the Rhino model> x26, <curve referenced from the Rhino model>, <brep referenced from the Rhino model>])

# ----
join_10 = JoinCurves(Curves=edges_7.Naked, Preserve=False)
join_11 = JoinCurves(Curves=edges_6.Naked, Preserve=False)
join_12 = JoinCurves(Curves=edges_4.Naked, Preserve=False)
join_13 = JoinCurves(Curves=edges_5.Naked, Preserve=False)
g_shape = AddDirectShapeGeometry(Category=<geometry referenced from the Revit model>, Geometry=mesh_6, TrackingMode=2)
g_shape_2 = AddDirectShapeGeometry(Category=<geometry referenced from the Revit model>, Geometry=sdiff_3, TrackingMode=2)
g_shape_3 = AddDirectShapeGeometry(Category=<geometry referenced from the Revit model>, Geometry=geo_2, TrackingMode=2)
buildingpad = AddBuildingPad(Boundary=item_26.Item1, Level=item_25.Item1, TrackingMode=2)  # disabled
buildingpad_2 = AddBuildingPad(Boundary=item_26.Item1, Level=item_25.Item1, TrackingMode=2)  # disabled
buildingpad_3 = AddBuildingPad(Boundary=item_26.Item2, Level=item_25.Item1, TrackingMode=2)  # disabled
buildingpad_4 = AddBuildingPad(Boundary=item_26.Item7, Level=item_25.Item3, TrackingMode=2)  # disabled
buildingpad_5 = AddBuildingPad(Boundary=item_26.Item8, Level=item_25.Item3, TrackingMode=2)  # disabled
trigger_2 = Trigger(
    Interval=-1000,
    TimerInterval=1000,
    Target=[buildingpad_10, buildingpad_2, buildingpad_3, buildingpad_6, buildingpad_8, buildingpad_7, buildingpad_9, buildingpad_4, buildingpad_5, buildingpad])
buildingpad_6 = AddBuildingPad(Boundary=item_26.Item3, Level=item_25.Item2, TrackingMode=2)  # disabled
buildingpad_7 = AddBuildingPad(Boundary=item_26.Item5, Level=item_25.Item2, TrackingMode=2)  # disabled
buildingpad_8 = AddBuildingPad(Boundary=item_26.Item4, Level=item_25.Item2, TrackingMode=2)  # disabled
buildingpad_9 = AddBuildingPad(Boundary=item_26.Item6, Level=item_25.Item2, TrackingMode=2)  # disabled
trigger_3 = Trigger(Interval=-1000, TimerInterval=1000, Target=topography)
buildingpad_10 = AddBuildingPad(Boundary=item_26.Item, Level=item_25.Item, TrackingMode=2)  # disabled
trigger_4 = Trigger(Interval=-1000, TimerInterval=1000, Target=[buildingpad_13, buildingpad_12, buildingpad_11, buildingpad_14])  # disabled

crv_18 = Curve([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])  # disabled
# Windows Option
toggle_5 = GroupToggle(ToggleActive=True, ToggleVisible=False)  # disabled
number_slider_11 = Slider(3, range=0..10)  # disabled
number_slider_12 = Slider(0.61, range=0..1)  # disabled
number_slider_13 = Slider(0.37, range=0..1)  # disabled
boundary_10 = BoundarySurfaces(Edges=crv_18)  # disabled
quads = QuadPanels(Surface=boundary_10, UDivisions=number_slider_11, VDivisions=number_slider_11)  # disabled
dom = ConstructDomain(DomainStart=number_slider_12, DomainEnd=number_slider_13)  # disabled
area_11 = Area(Geometry=quads)  # -> Area, Centroid; disabled
area_12 = Area(Geometry=crv_18)  # -> Area, Centroid; disabled
graph = GraphMapper(
    dom,
    x0=0,
    x1=1,
    y0=0,
    y1=1,
    container_name="Bezier",
    cpx=[0, 0.2898975313, 0.5899852514, 1],
    cpy=[0, 0, 0.8516721725, 0.8945418596])  # disabled
dist = Distance(PointA=graft(area_12.Centroid), PointB=area_11.Centroid)  # disabled
bnd = Bounds(Numbers=dist)  # disabled
remap = RemapNumbers(Value=dist, Source=bnd, Target=graph)  # -> Mapped, Clipped; disabled
scale_7 = Scale(Geometry=quads, Center=area_11.Centroid, Factor=remap.Mapped)  # -> Geometry, Transform; disabled
debrep_4 = DeconstructBrep(Brep=scale_7.Geometry)  # -> Faces, Edges, Vertices; disabled
number_slider_14 = Slider(3, range=0..3)  # disabled
item_27 = ListItem(List=debrep_4.Vertices, Index=0, Wrap=True)  # -> Item, Item1, Item2, Item3; disabled
pt_11 = Point([item_27.Item1, item_27.Item3])  # disabled
area_13 = Area(Geometry=debrep_4.Faces)  # -> Area, Centroid; disabled
reb = RebuildCurve(Curve=scale_7.Geometry, Degree=number_slider_14, Count=10, Tangents=False)  # disabled
number_slider_15 = Slider(0.51, range=0..1)  # disabled
scale_8 = Scale(Geometry=pt_11, Center=area_13.Centroid, Factor=number_slider_15)  # -> Geometry, Transform; disabled
pt_12 = Point([item_27.Item, item_27.Item2])  # disabled
item_28 = ListItem(List=scale_8.Geometry, Index=0, Wrap=True)  # -> Item, Item1; disabled
item_29 = ListItem(List=pt_12, Index=0, Wrap=True)  # -> Item, Item1; disabled
number_slider_16 = Slider(3, range=0..3)  # disabled
merge_7 = Merge(Data1=item_29.Item1, Data2=item_28.Item, Data3=item_29.Item, Data4=item_28.Item1)  # disabled
number_slider_17 = Slider(2, range=0..5)  # disabled
item_30 = ListItem(List=merge_7, Index=number_slider_16, Wrap=True)  # disabled
nurbs_10 = NurbsCurve(Vertices=merge_7, Degree=number_slider_17, Periodic=True)  # -> Curve, Length, Domain; disabled
intcrv = Interpolate(Vertices=merge_7, Degree=3, Periodic=True, KnotStyle=1)  # -> Curve, Length, Domain; disabled

buildingpad_11 = AddBuildingPad(Boundary=join_10, Level=item_25.Item3, TrackingMode=2)
buildingpad_12 = AddBuildingPad(Boundary=join_13, Level=item_25.Item1, TrackingMode=2)
buildingpad_13 = AddBuildingPad(Boundary=join_12, Level=item_25.Item, TrackingMode=2)
buildingpad_14 = AddBuildingPad(Boundary=join_11, Level=item_25.Item2, TrackingMode=2)
category_types = CategoryTypes({"Model": 1, "Annotation": 2, "Internal": 4, "Analytical": 5}, selected="Model")
Y = UnitY(Factor=250)
move_19 = Move(Motion=Y)  # -> Geometry, Transform
swatch_3 = ColourSwatch(SwatchColor=RGB(88, 108, 135))
swatch_4 = ColourSwatch(SwatchColor=RGB(135, 121, 88))
swatch_5 = ColourSwatch(SwatchColor=RGBA(88, 108, 135, 146))

triremesh_2 = TriRemesh(Geometry=mesh, Iterations=25)  # -> Triangulation, Dual, Creases
# Terrain
medges = MeshEdges(Mesh=triremesh_2.Triangulation)  # -> NakedEdges, InteriorEdges, NonManifoldEdges
dom_2 = ConstructDomain(DomainStart=Slider(0.49, range=0..1), DomainEnd=Slider(0.69, range=0..1))
dom_3 = ConstructDomain(DomainStart=Slider(0.4, range=0..1), DomainEnd=Slider(0.55, range=0..1))
dom² = ConstructDomain²(DomainU=dom_2, DomainV=dom_3)

item_31 = ListItem(List=triremesh_2.Triangulation, Index="1", Wrap=True)
Z_22 = UnitZ(Factor=1)
move_20 = Move(Geometry=item_31, Motion=Z_22)  # -> Geometry, Transform
medges_2 = MeshEdges(Mesh=move_20.Geometry)  # -> NakedEdges, InteriorEdges, NonManifoldEdges
previewlw_3 = CustomPreviewLineweights(
    Geometry=medges_2.NakedEdges,
    Shader=ColourSwatch(SwatchColor=RGB(0, 0, 0)),
    Thickness=Slider(2, range=0..100),
    Absolute=False)

contour_3 = Contour(Shape=item_31, Point=Point(0, 0, 0), Direction=Vector(0, 0, 1), Distance=Slider(1, range=0..50))
patch_4 = Patch(Curves=flatten(contour_3), Spans=20, Flexibility=1, Trim=True)

preview_9 = CustomPreview(Geometry=item_31, Material=ColourSwatch(SwatchColor=RGB(194, 194, 194)))  # disabled
subsrf = Isotrim(Surface=patch_4, Domain=dom²)

debrep_5 = DeconstructBrep(Brep=subsrf)  # -> Faces, Edges, Vertices
contour_4 = Contour(Shape=subsrf, Point=Point(0, 0, 0), Direction=Vector(0, 0, 1), Distance=Slider(1, range=0..50))
join_14 = JoinCurves(Curves=debrep_5.Edges, Preserve=False)
project_11 = Project(Curve=offset_4, Brep=subsrf, Direction=Vector(0, 0, 1))  # -> flatten(Curve)

# ---- group: Patch - Terrain
# Terrain & Contours (Patch)
toggle_6 = GroupToggle(ToggleActive=True, ToggleVisible=False)  # disabled
item_32 = ListItem(List=project_11, Index=0, Wrap=True)  # -> Item2, Item1, Item
Z_23 = UnitZ(Factor=Slider(1, range=0..6))
move_21 = Move(Geometry=geo, Motion=Z_23)  # -> Geometry, Transform
plfit_2 = PlaneFit(Points=debrep_5.Vertices)  # -> Plane, Deviation
offset_7 = OffsetCurve(Curve=join_14, Distance=Slider(-5, range=-5..5), Plane=plfit_2.Plane, Corners=1)  # -> flatten(Curve)
merge_8 = Merge(Data1=flatten(move_21.Geometry), Data2=item_32.Item2, Data3=join_14, Data4=offset_7)  # -> flatten(Result)
patch_5 = Patch(Curves=merge_8, Spans=20, Flexibility=Slider(5, range=1..15), Trim=True)
project_12 = Project(Curve=crv, Brep=patch_5, Direction=Vector(0, 0, 1))
srfsplit_2 = SurfaceSplit(Surface=patch_5, Curves=project_12)
item_33 = ListItem(List=srfsplit_2, Index=0, Wrap=True)
bbx_2 = BrepBrep(BrepA=item_33, BrepB=move_8.Geometry)  # -> Curves, Points
srfsplit_3 = SurfaceSplit(Surface=item_33, Curves=bbx_2.Curves)
item_34 = ListItem(List=srfsplit_3, Index=0, Wrap=True)  # -> Item, Item1
contour_5 = Contour(Shape=item_33, Point=Point(0, 0, 0), Direction=Vector(0, 0, 1), Distance="0.5")

# ---- group: Not Clipped
mesh_7 = MeshBrep(
    Brep=patch_5,
    Settings={GridMaxCount=0, GridMinCount=16, JaggedSeams=False, MaxEdgeLength=0, MinEdgeLength=0.0001, MinTolerance=0, Refine=True, RefineAngle=0, RelativeTolerance=0.65, SimplePlanes=True, Tolerance=0})

# ---- group: Trimmed
mesh_8 = MeshBrep(
    Brep=[item_34.Item, item_34.Item1],
    Settings={GridMaxCount=0, GridMinCount=16, JaggedSeams=False, MaxEdgeLength=0, MinEdgeLength=0.0001, MinTolerance=0, Refine=True, RefineAngle=0, RelativeTolerance=0.65, SimplePlanes=True, Tolerance=0})

# ----
medges_3 = MeshEdges(Mesh=mesh_8)  # -> NakedEdges, InteriorEdges, NonManifoldEdges
previewlw_4 = CustomPreviewLineweights(Geometry=contour_5, Shader=ColourSwatch(SwatchColor=RGB(0, 0, 0)), Thickness=Slider(1.9, range=0..5), Absolute=False)
extr_4 = Extrude(Base=medges_3.NakedEdges, Direction=Z_11)
mesh_9 = MeshBrep(
    Brep=extr_4,
    Settings={GridMaxCount=0, GridMinCount=16, JaggedSeams=False, MaxEdgeLength=0, MinEdgeLength=0.0001, MinTolerance=0, Refine=True, RefineAngle=0, RelativeTolerance=0.65, SimplePlanes=True, Tolerance=0})
preview_10 = CustomPreview(Geometry=mesh_8, Material=ColourSwatch(SwatchColor=RGB(166, 140, 103)))  # disabled

# ---- group: Trimmed 2
mjoin = MeshJoin(Meshes=[mesh_8, mesh_9])

# ----
triremesh_3 = TriRemesh(Geometry=mesh_7, Length=number_slider_10, Iterations=25)  # -> Triangulation, Dual, Creases
medges_4 = MeshEdges(Mesh=triremesh_3.Triangulation)  # -> NakedEdges, InteriorEdges, NonManifoldEdges
mesh_10 = Mesh(triremesh_3.Triangulation)
unweld = UnweldMesh(Mesh=mesh_10, Angle=degrees(Slider(9, range=0..10)))
topography = AddTopographyMesh(Mesh=unweld, TrackingMode=2)  # disabled

toggle_7 = GroupToggle(ToggleActive=True, ToggleVisible=False)  # disabled
# Roof (Upper Layer)
cps_2 = ClosestPoints(Point=pt_9, Cloud=item_10, Count="8")  # -> ClosestPoint, CPIndex, Distance
crv_cp_4 = CurveClosestPoint(Point=cps_2.ClosestPoint, Curve=move_16.Geometry)  # -> Point, Parameter, Distance
avr_2 = Average(Input=crv_cp_4.Point)
cir_2 = Circle(Plane=avr_2, Radius=1)
alongcrv_2 = SortAlongCurve(Points=crv_cp_4.Point, Curve=cir_2)  # -> Points, Indices
vec2pt = Vector2Pt(PointA=alongcrv_2.Points, PointB=avr_2, Unitize=False)  # -> Vector, Length
shatter = Shatter(Curve=move_16.Geometry, Parameters=flatten(crv_cp_4.Parameter))
amp_4 = Amplitude(Vector=vec2pt.Vector, Amplitude=Slider(7, range=0..20))
move_22 = Move(Geometry=alongcrv_2.Points, Motion=amp_4)  # -> Geometry, Transform
ln_7 = Line(StartPoint=alongcrv_2.Points, EndPoint=move_22.Geometry)
panel_25 = Panel("""2
4""")
panel_26 = Panel("""0
6""")
panel_27 = Panel("""7
15
21
5
23
31""")
end_2 = EndPoints(Curve=ln_7)  # -> Start, End
entwine = Entwine(Branch00="0", Branch01=panel_25, Branch02=panel_26, Branch03="4", FlattenInputs=True)
dispdexs = DispatchIndices(List=shatter, Indices=panel_27)  # -> AtI, NotI
shift_3 = ShiftList(List=end_2.End, Shift=1, Wrap=True)
ln_8 = Line(StartPoint=end_2.End, EndPoint=shift_3)
number_slider_18 = Slider(12, range=0..100)
partition_2 = PartitionList(List=dispdexs.AtI, Size="2")
end_3 = EndPoints(Curve=partition_2)  # -> Start, End
dispdexs_2 = DispatchIndices(List=ln_8, Indices=entwine)  # -> flatten(AtI), flatten(NotI)
shift_4 = ShiftList(List=end_3.End, Shift=1, Wrap=True)
ln_9 = Line(StartPoint=end_3.Start, EndPoint=shift_4)
divide_2 = DivideCurve(Curve=ln_7, Count=number_slider_18, Kinks=False)  # -> Points, Tangents, Parameters
flatten_2 = FlattenTree(Tree=ln_9, Path="{0}")
divide_3 = DivideCurve(Curve=dispdexs.NotI, Count=number_slider_18, Kinks=False)  # -> Points, Tangents, Parameters
divide_4 = DivideCurve(Curve=partition_2, Count=number_slider_18, Kinks=False)  # -> Points, Tangents, Parameters
divide_5 = DivideCurve(Curve=ln_9, Count=number_slider_18, Kinks=False)  # -> Points, Tangents, Parameters
bang_3 = ExplodeTree(Data=simplify(divide_4.Points))  # -> Branch0, Branch1, Branch2, Branch3, Branch4, Branch5
rev_2 = ReverseList(List=bang_3.Branch1)
rev_3 = ReverseList(List=bang_3.Branch3)
rev_4 = ReverseList(List=bang_3.Branch5)
ln_10 = Line(StartPoint=bang_3.Branch0, EndPoint=rev_2)
ln_11 = Line(StartPoint=bang_3.Branch2, EndPoint=rev_3)
ln_12 = Line(StartPoint=bang_3.Branch4, EndPoint=rev_4)
divide_6 = DivideCurve(Curve=[ln_10, ln_11, ln_12], Count=number_slider_18, Kinks=False)  # -> Points, Tangents, Parameters
addition = Addition(A=number_slider_18, B="1")
trim_9 = TrimTree(Tree=divide_6.Points, Depth=1)
frompoints = MeshFromPoints(Points=trim_9, UDirection=addition, VDirection=addition)
shift_5 = ShiftList(List=divide_2.Points, Shift=1, Wrap=False)
shift_6 = ShiftList(List=divide_5.Points, Shift=1, Wrap=False)
shift_7 = ShiftList(List=divide_6.Points, Shift=1, Wrap=True)
ln_13 = Line(StartPoint=divide_2.Points, EndPoint=shift_5)
ln_14 = Line(StartPoint=divide_5.Points, EndPoint=shift_6)
ln_15 = Line(StartPoint=divide_6.Points, EndPoint=shift_7)
cull_i = CullIndex(List=ln_13, Indices=-1, Wrap=True)
cull_i_2 = CullIndex(List=ln_14, Indices=-1, Wrap=True)
cull_i_3 = CullIndex(List=ln_15, Indices=-1, Wrap=True)
midpt = CurveMiddle(Curve=flatten(cull_i))
Z_24 = UnitZ(Factor=Slider(4.04, range=-10..20))
Z_25 = UnitZ(Factor=Slider(2.53, range=0..10))

# ---- group: Sorting Cores List
midpt_2 = CurveMiddle(Curve=dispdexs_2.NotI)
midpt_3 = CurveMiddle(Curve=dispdexs.NotI)  # -> graft(Midpoint)
dist_2 = Distance(PointA=midpt_3, PointB=midpt_2)
sort_3 = SortList(Keys=dist_2, ValuesA=dispdexs_2.NotI)  # -> Keys, ValuesA
item_35 = ListItem(List=sort_3.ValuesA, Index=0, Wrap=True)  # -> flatten(Item)

midpt_4 = CurveMiddle(Curve=dispdexs_2.AtI)
midpt_5 = CurveMiddle(Curve=flatten_2)  # -> graft(Midpoint)
dist_3 = Distance(PointA=midpt_5, PointB=midpt_4)
sort_4 = SortList(Keys=dist_3, ValuesA=dispdexs_2.AtI)  # -> Keys, ValuesA
item_36 = ListItem(List=sort_4.ValuesA, Index=0, Wrap=True)  # -> flatten(Item)

# ---- group: Anchors (Perimeter)
pt_13 = Point(flatten([divide_3.Points, divide_4.Points]))

# ----
midpt_6 = CurveMiddle(Curve=flatten(cull_i_3))

toggle_8 = GroupToggle(ToggleActive=True, ToggleVisible=False)  # disabled
# Roof (Lower Layer)
cps_3 = ClosestPoints(Point=pt_10, Cloud=item_10, Count="8")  # -> ClosestPoint, CPIndex, Distance
crv_cp_5 = CurveClosestPoint(Point=cps_3.ClosestPoint, Curve=item_12)  # -> Point, Parameter, Distance
avr_3 = Average(Input=crv_cp_5.Point)
cir_3 = Circle(Plane=avr_3, Radius=1)
alongcrv_3 = SortAlongCurve(Points=crv_cp_5.Point, Curve=cir_3)  # -> Points, Indices
vec2pt_2 = Vector2Pt(PointA=alongcrv_3.Points, PointB=avr_3, Unitize=False)  # -> Vector, Length
shatter_2 = Shatter(Curve=item_12, Parameters=flatten(crv_cp_5.Parameter))
amp_5 = Amplitude(Vector=vec2pt_2.Vector, Amplitude=Slider(6.5, range=0..20))
move_23 = Move(Geometry=alongcrv_3.Points, Motion=amp_5)  # -> Geometry, Transform
ln_16 = Line(StartPoint=alongcrv_3.Points, EndPoint=move_23.Geometry)
panel_28 = Panel("""2
4""")
panel_29 = Panel("""0
6""")
panel_30 = Panel("""7
15
21
5
23
31""")
end_4 = EndPoints(Curve=ln_16)  # -> Start, End
entwine_2 = Entwine(Branch00="0", Branch01=panel_28, Branch02=panel_29, Branch03="4", FlattenInputs=True)
dispdexs_3 = DispatchIndices(List=shatter_2, Indices=panel_30)  # -> AtI, NotI
shift_8 = ShiftList(List=end_4.End, Shift=1, Wrap=True)
ln_17 = Line(StartPoint=end_4.End, EndPoint=shift_8)
number_slider_19 = Slider(12, range=0..100)
partition_3 = PartitionList(List=dispdexs_3.AtI, Size="2")
end_5 = EndPoints(Curve=partition_3)  # -> Start, End
dispdexs_4 = DispatchIndices(List=ln_17, Indices=entwine_2)  # -> flatten(AtI), flatten(NotI)
shift_9 = ShiftList(List=end_5.End, Shift=1, Wrap=True)
ln_18 = Line(StartPoint=end_5.Start, EndPoint=shift_9)
divide_7 = DivideCurve(Curve=ln_16, Count=number_slider_19, Kinks=False)  # -> Points, Tangents, Parameters
flatten_3 = FlattenTree(Tree=ln_18, Path="{0}")
divide_8 = DivideCurve(Curve=dispdexs_3.NotI, Count=number_slider_19, Kinks=False)  # -> Points, Tangents, Parameters
divide_9 = DivideCurve(Curve=partition_3, Count=number_slider_19, Kinks=False)  # -> Points, Tangents, Parameters
divide_10 = DivideCurve(Curve=ln_18, Count=number_slider_19, Kinks=False)  # -> Points, Tangents, Parameters
bang_4 = ExplodeTree(Data=simplify(divide_9.Points))  # -> Branch0, Branch1, Branch2, Branch3, Branch4, Branch5
rev_5 = ReverseList(List=bang_4.Branch1)
rev_6 = ReverseList(List=bang_4.Branch3)
rev_7 = ReverseList(List=bang_4.Branch5)
ln_19 = Line(StartPoint=bang_4.Branch0, EndPoint=rev_5)
ln_20 = Line(StartPoint=bang_4.Branch2, EndPoint=rev_6)
ln_21 = Line(StartPoint=bang_4.Branch4, EndPoint=rev_7)
divide_11 = DivideCurve(Curve=[ln_19, ln_20, ln_21], Count=number_slider_19, Kinks=False)  # -> Points, Tangents, Parameters
addition_2 = Addition(A=number_slider_19, B="1")
trim_10 = TrimTree(Tree=divide_11.Points, Depth=1)
frompoints_2 = MeshFromPoints(Points=trim_10, UDirection=addition_2, VDirection=addition_2)
shift_10 = ShiftList(List=divide_7.Points, Shift=1, Wrap=False)
shift_11 = ShiftList(List=divide_10.Points, Shift=1, Wrap=False)
shift_12 = ShiftList(List=divide_11.Points, Shift=1, Wrap=True)
ln_22 = Line(StartPoint=divide_7.Points, EndPoint=shift_10)
ln_23 = Line(StartPoint=divide_10.Points, EndPoint=shift_11)
ln_24 = Line(StartPoint=divide_11.Points, EndPoint=shift_12)
cull_i_4 = CullIndex(List=ln_22, Indices=-1, Wrap=True)
cull_i_5 = CullIndex(List=ln_23, Indices=-1, Wrap=True)
cull_i_6 = CullIndex(List=ln_24, Indices=-1, Wrap=True)
midpt_7 = CurveMiddle(Curve=flatten(cull_i_4))
Z_26 = UnitZ(Factor=Slider(-5.67, range=-10..5))
Z_27 = UnitZ(Factor=Slider(4, range=0..10))

# ---- group: Sorting Cores List
midpt_8 = CurveMiddle(Curve=dispdexs_4.NotI)
midpt_9 = CurveMiddle(Curve=dispdexs_3.NotI)  # -> graft(Midpoint)
dist_4 = Distance(PointA=midpt_9, PointB=midpt_8)
sort_5 = SortList(Keys=dist_4, ValuesA=dispdexs_4.NotI)  # -> Keys, ValuesA
item_37 = ListItem(List=sort_5.ValuesA, Index=0, Wrap=True)  # -> flatten(Item)

midpt_10 = CurveMiddle(Curve=dispdexs_4.AtI)
midpt_11 = CurveMiddle(Curve=flatten_3)  # -> graft(Midpoint)
dist_5 = Distance(PointA=midpt_11, PointB=midpt_10)
sort_6 = SortList(Keys=dist_5, ValuesA=dispdexs_4.AtI)  # -> Keys, ValuesA
item_38 = ListItem(List=sort_6.ValuesA, Index=0, Wrap=True)  # -> flatten(Item)

# ---- group: Anchors (Perimeter)
pt_14 = Point(flatten([divide_8.Points, divide_9.Points]))

# ----
midpt_12 = CurveMiddle(Curve=flatten(cull_i_6))

divide_12 = DivideCurve(Curve=item_35, Count=number_slider_18, Kinks=False)  # -> Points, Tangents, Parameters
divide_13 = DivideCurve(Curve=item_36, Count=number_slider_18, Kinks=False)  # -> Points, Tangents, Parameters
ln_25 = Line(StartPoint=divide_12.Points, EndPoint=divide_3.Points)
ln_26 = Line(StartPoint=divide_5.Points, EndPoint=divide_13.Points)
divide_14 = DivideCurve(Curve=ln_25, Count=number_slider_18, Kinks=False)  # -> Points, Tangents, Parameters
divide_15 = DivideCurve(Curve=ln_26, Count=number_slider_18, Kinks=False)  # -> Points, Tangents, Parameters
trim_11 = TrimTree(Tree=divide_15.Points, Depth=1)
trim_12 = TrimTree(Tree=divide_14.Points, Depth=1)
frompoints_3 = MeshFromPoints(Points=trim_11, UDirection=addition, VDirection=addition)
frompoints_4 = MeshFromPoints(Points=trim_12, UDirection=addition, VDirection=addition)
flip = MeshFlip(Mesh=frompoints_4)
duppt = RemoveDuplicatePts(Points=pt_13, Tolerance=0.01)

# ---- group: Anchors (Center)
pt_15 = Point(flatten([divide_12.Points, divide_13.Points]))

# ----
merge_9 = Merge(Data1=flatten(flip), Data2=flatten(frompoints_3), Data3=flatten(frompoints))

divide_16 = DivideCurve(Curve=item_37, Count=number_slider_19, Kinks=False)  # -> Points, Tangents, Parameters
divide_17 = DivideCurve(Curve=item_38, Count=number_slider_19, Kinks=False)  # -> Points, Tangents, Parameters
ln_27 = Line(StartPoint=divide_16.Points, EndPoint=divide_8.Points)
ln_28 = Line(StartPoint=divide_10.Points, EndPoint=divide_17.Points)
divide_18 = DivideCurve(Curve=ln_27, Count=number_slider_19, Kinks=False)  # -> Points, Tangents, Parameters
divide_19 = DivideCurve(Curve=ln_28, Count=number_slider_19, Kinks=False)  # -> Points, Tangents, Parameters
trim_13 = TrimTree(Tree=divide_19.Points, Depth=1)
trim_14 = TrimTree(Tree=divide_18.Points, Depth=1)
frompoints_5 = MeshFromPoints(Points=trim_13, UDirection=addition_2, VDirection=addition_2)
frompoints_6 = MeshFromPoints(Points=trim_14, UDirection=addition_2, VDirection=addition_2)
flip_2 = MeshFlip(Mesh=frompoints_6)
duppt_2 = RemoveDuplicatePts(Points=pt_14, Tolerance=0.01)

# ---- group: Anchors (Center)
pt_16 = Point(flatten([divide_16.Points, divide_17.Points]))

# ----
merge_10 = Merge(Data1=flatten(flip_2), Data2=flatten(frompoints_5), Data3=flatten(frompoints_2))

duppt_3 = RemoveDuplicatePts(Points=pt_15, Tolerance=0.01)
mjoin_2 = MeshJoin(Meshes=merge_9)
weldvertices = MeshWeldVertices(Mesh=mjoin_2, Tolerance=0.005)  # -> RuntimeMessage, Mesh
medges_5 = MeshEdges(Mesh=weldvertices.Mesh)  # -> NakedEdges, InteriorEdges, NonManifoldEdges
demesh = DeconstructMesh(Mesh=weldvertices.Mesh)  # -> Vertices, Faces, Colours, Normals
cp = ClosestPoint(Point=duppt_3, Cloud=demesh.Vertices)  # -> ClosestPoint, CPIndex, Distance
cp_2 = ClosestPoint(Point=duppt, Cloud=demesh.Vertices)  # -> ClosestPoint, CPIndex, Distance
midpt_13 = CurveMiddle(Curve=medges_5.InteriorEdges)
cp_3 = ClosestPoint(Point=midpt, Cloud=midpt_13)  # -> ClosestPoint, CPIndex, Distance
merge_11 = Merge(Data1=cp_2.CPIndex, Data2=cp.CPIndex)
cull_i_7 = CullIndex(List=demesh.Vertices, Indices=merge_11, Wrap=True)
dispdexs_5 = DispatchIndices(List=medges_5.InteriorEdges, Indices=cp_3.CPIndex)  # -> AtI, NotI
project_13 = ProjectPoint(Point=cp.ClosestPoint, Direction=Vector(0, 0, -1), Geometry=srf)  # -> Point, Index
line = Line(dispdexs_5.AtI)
move_24 = Move(Geometry=project_13.Point, Motion=Z_24)  # -> Geometry, Transform
anchor_2 = Anchor(Point=cp_2.ClosestPoint, Strength=1000000)
anchor_3 = Anchor(Point=cp.ClosestPoint, Target=move_24.Geometry, Strength=1000000)
length_line = LengthLine(Line=dispdexs_5.AtI, Length=Slider(0, range=0..1), Strength=Slider(80, range=0..100))
length_line_2 = LengthLine(Line=dispdexs_5.NotI, Length=Slider(0, range=0..1), Strength=Slider(20, range=0..100))
load = Load(Point=cull_i_7, ForceVector=Z_25, Weighting=1)
show_2 = Show(G=medges_5.InteriorEdges)  # disabled

midpt_14 = CurveMiddle(Curve=medges_5.InteriorEdges)
cp_4 = ClosestPoint(Point=midpt_6, Cloud=midpt_14)  # -> ClosestPoint, CPIndex, Distance
dispdexs_6 = DispatchIndices(List=medges_5.InteriorEdges, Indices=cp_4.CPIndex)  # -> AtI, NotI
line_2 = Line(dispdexs_6.AtI)
join_15 = JoinCurves(Curves=dispdexs_5.AtI, Preserve=False)
join_16 = JoinCurves(Curves=dispdexs_6.AtI, Preserve=False)
length_line_3 = LengthLine(Line=dispdexs_6.AtI, Length=Slider(0, range=0..1), Strength=Slider(40, range=0..100))
show_3 = Show(G=weldvertices.Mesh)

show_4 = Show(G=join_15)
show_5 = Show(G=join_16)
entwine_3 = Entwine(
    Branch0X=show_4,
    Branch1X=show_3,
    Branch2X=show_5,
    Branch3X=length_line,
    Branch4X=length_line_3,
    Branch5X=length_line_2,
    Branch6X=load,
    Branch7X=anchor_2,
    Branch8X=anchor_3,
    FlattenInputs=False)
bouncysolver = BouncySolver(GoalObjects=entwine_3, Reset=Button(), Threshold=1e-15, Tolerance=0.0001, Damping=0.99, Iterations=10, On=Toggle(False))  # -> I, V, O

bang_5 = ExplodeTree(Data=entwine_3)  # -> _0000, Branch1, _2000, Branch3, Branch4, Branch5, _6000, Branch7, Branch8

line_3 = Line(bouncysolver.O)
previewlw_5 = CustomPreviewLineweights(Geometry=line_3, Shader=ColourSwatch(SwatchColor=RGB(0, 0, 0)), Absolute=False)

lng = ListLength(List=bang_5._0000)
dom_4 = ConstructDomain(DomainStart="0", DomainEnd=expr("x-1", lng))
range = Range(Domain=dom_4, Steps=expr("x-1", lng))
item_39 = ListItem(List=bouncysolver.O, Index=range, Wrap=True)

lng_2 = ListLength(List=bang_5.Branch1)
ma = MassAddition(Input=flatten([lng, lng_2]))  # -> Result, PartialResults
item_40 = ListItem(List=bouncysolver.O, Index=expr("x-1", ma.Result), Wrap=True)

mesh_11 = Mesh(item_40)
preview_11 = CustomPreview(Geometry=mesh_11, Material=ColourSwatch(SwatchColor=RGBA(135, 121, 88, 135)))  # disabled

# ----
# Roof Structure (Upper Layer)
end_6 = EndPoints(Curve=item_39)  # -> Start, End
ln_29 = Line(StartPoint=end_6.Start, EndPoint=end_6.End)
Z_28 = UnitZ(Factor="-1")
midpt_15 = CurveMiddle(Curve=ln_29)
disc_9 = Discontinuity(Curve=item_39, Level=1)  # -> Points, Parameters
move_25 = Move(Geometry=midpt_15, Motion=Z_28)  # -> Geometry, Transform
intcrv_2 = Interpolate(Vertices=disc_9.Points, Degree=3, Periodic=False, KnotStyle=1)  # -> flatten(Curve), Length, Domain
lnpt = LinePt(Line=ln_29, Point=move_25.Geometry)
offset_8 = OffsetCurve(Curve=intcrv_2.Curve, Distance=Slider(-0.3, range=-1..1), Plane=lnpt, Corners=1)
offset_9 = OffsetCurve(Curve=intcrv_2.Curve, Distance=Slider(-0.02, range=-1..1), Plane=lnpt, Corners=1)
entwine_4 = Entwine(Branch00=flatten(offset_9), Branch01=flatten(offset_8), FlattenInputs=True)
flip_3 = FlipMatrix(Data=entwine_4)
loft_3 = Loft(Curves=flip_3, Options={Adjust=False, Closed=False, LoftEnds=0, LoftSimp=0, LoftType=0, Rebuild=200, Refit=8.0001})  # -> flatten(Loft)
debrep_6 = DeconstructBrep(Brep=loft_3)  # -> Faces, Edges, Vertices
item_41 = ListItem(List=debrep_6.Edges, Index=0, Wrap=True)  # -> flatten(Item)
partition_4 = PartitionList(List=item_41, Size="8")
loft_4 = Loft(Curves=partition_4, Options={Adjust=False, Closed=True, LoftEnds=0, LoftSimp=0, LoftType=0, Rebuild=10, Refit=0.01})
neg_3 = Negative(Value="0.025")
neg_4 = Negative(Value="0.025")
offsrf_3 = OffsetSurface(Surface=loft_3, Distance="0.025", BothSides=neg_4, CreateSolid=True)
offsrf_4 = OffsetSurface(Surface=loft_4, Distance="0.025", BothSides=neg_3, CreateSolid=True)

duppt_4 = RemoveDuplicatePts(Points=pt_16, Tolerance=0.01)
mjoin_3 = MeshJoin(Meshes=merge_10)
weldvertices_2 = MeshWeldVertices(Mesh=mjoin_3, Tolerance=0.005)  # -> RuntimeMessage, Mesh
medges_6 = MeshEdges(Mesh=weldvertices_2.Mesh)  # -> NakedEdges, InteriorEdges, NonManifoldEdges
demesh_2 = DeconstructMesh(Mesh=weldvertices_2.Mesh)  # -> Vertices, Faces, Colours, Normals
cp_5 = ClosestPoint(Point=duppt_4, Cloud=demesh_2.Vertices)  # -> ClosestPoint, CPIndex, Distance
cp_6 = ClosestPoint(Point=duppt_2, Cloud=demesh_2.Vertices)  # -> ClosestPoint, CPIndex, Distance
midpt_16 = CurveMiddle(Curve=medges_6.InteriorEdges)
cp_7 = ClosestPoint(Point=midpt_7, Cloud=midpt_16)  # -> ClosestPoint, CPIndex, Distance
merge_12 = Merge(Data1=cp_6.CPIndex, Data2=cp_5.CPIndex)
cull_i_8 = CullIndex(List=demesh_2.Vertices, Indices=merge_12, Wrap=True)
move_26 = Move(Geometry=cp_5.ClosestPoint, Motion=Z_26)  # -> Geometry, Transform
dispdexs_7 = DispatchIndices(List=medges_6.InteriorEdges, Indices=cp_7.CPIndex)  # -> AtI, NotI
project_14 = ProjectPoint(Point=cp_5.ClosestPoint, Direction=Vector(0, 0, -1), Geometry=srf)  # -> Point, Index
line_4 = Line(dispdexs_7.AtI)
anchor_4 = Anchor(Point=cp_6.ClosestPoint, Strength=1000000)
anchor_5 = Anchor(Point=cp_5.ClosestPoint, Target=project_14.Point, Strength=1000000)
length_line_4 = LengthLine(Line=dispdexs_7.NotI, Length=Slider(0, range=0..1), Strength=Slider(20, range=0..100))
load_2 = Load(Point=cull_i_8, ForceVector=Z_27, Weighting=1)
show_6 = Show(G=medges_6.InteriorEdges)

midpt_17 = CurveMiddle(Curve=medges_6.InteriorEdges)
cp_8 = ClosestPoint(Point=midpt_12, Cloud=midpt_17)  # -> ClosestPoint, CPIndex, Distance
dispdexs_8 = DispatchIndices(List=medges_6.InteriorEdges, Indices=cp_8.CPIndex)  # -> AtI, NotI
line_5 = Line(dispdexs_8.AtI)
join_17 = JoinCurves(Curves=dispdexs_7.AtI, Preserve=False)
join_18 = JoinCurves(Curves=dispdexs_8.AtI, Preserve=False)
show_7 = Show(G=weldvertices_2.Mesh)

length_line_5 = LengthLine(Line=[dispdexs_7.AtI, dispdexs_8.AtI], Length=Slider(0, range=0..1), Strength=Slider(66, range=0..100))
show_8 = Show(G=join_17)
show_9 = Show(G=join_18)
entwine_5 = Entwine(
    Branch0X=show_8,
    Branch1X=show_7,
    Branch2X=show_6,
    Branch3X=show_9,
    Branch4X=length_line_5,
    Branch5X=length_line_4,
    Branch6X=load_2,
    Branch7X=anchor_4,
    Branch8X=anchor_5,
    FlattenInputs=False)
bouncysolver_2 = BouncySolver(GoalObjects=entwine_5, Reset=Button(), Threshold=1e-15, Tolerance=0.0001, Damping=0.99, Iterations=10, On=Toggle(False))  # -> I, V, O

bang_6 = ExplodeTree(Data=entwine_5)  # -> _0000, Branch1, Branch2, _3000, Branch4, Branch5, _6000, Branch7, Branch8

lng_3 = ListLength(List=bang_6._0000)
dom_5 = ConstructDomain(DomainStart="0", DomainEnd=expr("x-1", lng_3))
range_2 = Range(Domain=dom_5, Steps=expr("x-1", lng_3))
item_42 = ListItem(List=bouncysolver_2.O, Index=range_2, Wrap=True)

lng_4 = ListLength(List=bang_6.Branch1)
ma_2 = MassAddition(Input=flatten([lng_3, lng_4]))  # -> Result, PartialResults
item_43 = ListItem(List=bouncysolver_2.O, Index=expr("x-1", ma_2.Result), Wrap=True)

line_6 = Line(bouncysolver_2.O)
previewlw_6 = CustomPreviewLineweights(Geometry=line_6, Shader=ColourSwatch(SwatchColor=RGB(0, 0, 0)), Absolute=False)

mesh_12 = Mesh(item_43)
preview_12 = CustomPreview(Geometry=mesh_12, Material=ColourSwatch(SwatchColor=RGBA(88, 108, 135, 146)))  # disabled

# ----
# Roof Structure (Lower Layer)
end_7 = EndPoints(Curve=item_42)  # -> Start, End
ln_30 = Line(StartPoint=end_7.Start, EndPoint=end_7.End)
Z_29 = UnitZ(Factor="-1")
midpt_18 = CurveMiddle(Curve=ln_30)
disc_10 = Discontinuity(Curve=item_42, Level=1)  # -> Points, Parameters
move_27 = Move(Geometry=midpt_18, Motion=Z_29)  # -> Geometry, Transform
intcrv_3 = Interpolate(Vertices=disc_10.Points, Degree=3, Periodic=False, KnotStyle=1)  # -> flatten(Curve), Length, Domain
lnpt_2 = LinePt(Line=ln_30, Point=move_27.Geometry)
offset_10 = OffsetCurve(Curve=intcrv_3.Curve, Distance=Slider(0.3, range=-1..1), Plane=lnpt_2, Corners=1)
offset_11 = OffsetCurve(Curve=intcrv_3.Curve, Distance=Slider(0.05, range=-1..1), Plane=lnpt_2, Corners=1)
entwine_6 = Entwine(Branch00=flatten(offset_11), Branch01=flatten(offset_10), FlattenInputs=True)
flip_4 = FlipMatrix(Data=entwine_6)
loft_5 = Loft(Curves=flip_4, Options={Adjust=False, Closed=False, LoftEnds=0, LoftSimp=0, LoftType=0, Rebuild=200, Refit=8.0001})  # -> flatten(Loft)
neg_5 = Negative(Value="0.025")
offsrf_5 = OffsetSurface(Surface=loft_5, Distance="0.025", BothSides=neg_5, CreateSolid=True)

preview_13 = CustomPreview(Geometry=[offsrf_3, offsrf_4, offsrf_5], Material=ColourSwatch(SwatchColor=RGB(127, 148, 176)))  # disabled
