# Grasshopper definition assembled_revit_Paulatest.gh (Grasshopper 1.0.7)
# plug-ins: eleFront, Speckle 2, Rhino.Inside for Autodesk Revit, treesloth01, Nautilus

# ---- group: BIMSC-PROJECT
# Send a message to James M. to add
# new materials. This list will be updated
# for all groups to have a common material
# library and common material names.
panel = Panel("ELEMENTAL MARS")
bimsc_project = Text(panel)

# ---- group: RECEIVE MATERIALS
# RECIEVE
# MATERIALS
panel_2 = Panel("https://macad.speckle.xyz/projects/4975f9f0a8/models/d59a568f9e")
receive = Receive(
    Stream=panel_2,
    AutoReceive=False,
    CurrentComponentState="up_to_date",
    ExpandOutput=True,
    LastInfoMessage="James McBennett @ 03/02/2024 01:57:29: Materials 01-03-2024 (id:6ecf38526e)",
    ReceiveOnOpen=False,
    ReceivedCommitId="6ecf38526e",
    StreamWrapper="https://macad.speckle.xyz/streams/4975f9f0a8/branches/d59a568f9e",
    selectedKitName="Objects")  # -> Info, Materials
dso = DeconstructSpeckleObject(SpeckleObject=receive.Materials, selectedKitName="Objects")  # -> Glass, Inflatable, Insulation, Mineral, Regolith, Site, Soil, Steel

# ---- group: FLOOR_LEVELS
# Set your 'Project' name, your 'Group'
# number, your 'Volume' Location that
# connect wirelessly.
series = Series(Start=0, Step=1, Count="5")
expression = Expression(x=series, Expression="Format(\"{0:00}\", x)")
concat = Concatenate(FragmentA="L", FragmentB=expression)  # -> simplify(graft(Result))
floor_levels = Text(concat)

# ----
# filter terrain
# add actual units
panel_3 = Panel("TopoBrep")  # disabled
panel_4 = Panel("Contours")  # disabled
panel_5 = Panel("TopoMesh")  # disabled
panel_6 = Panel("BakedStudioMarsTopoMain")  # disabled
list = ValueList({"AngularDimension", "Arc", "Block", "Brep", "Circle", "Curve", "Dimension", "Ellipse", "Extrusion", "Hatch", "Leader", "Line", "LinearDimension", "Mesh", "Point", "Polyline", "Polysurface", "RadialDimension", "Surface", "Text", "TextDot"}, selected="Mesh")  # disabled
reflay = ReferenceByLayer(LayerName=panel_4, lightweight=False)  # disabled
reflay_2 = ReferenceByLayer(LayerName=panel_3, lightweight=False)  # disabled
reflay_3 = ReferenceByLayer(LayerName=panel_5, lightweight=False)  # disabled
reflay_4 = ReferenceByLayer(LayerName=panel_6, lightweight=False)  # disabled
mesh = MeshBrep(
    Brep=reflay_2,
    Settings={GridMaxCount=0, GridMinCount=16, JaggedSeams=False, MaxEdgeLength=0, MinEdgeLength=0.0001, MinTolerance=0, Refine=True, RefineAngle=0, RelativeTolerance=0.65, SimplePlanes=True, Tolerance=0})  # disabled
filtertype = FilterByType(ObjectType=list, Geometry=reflay_4, invertFilter=False, returnNulls=False)  # -> ExcludedGeometry, IncludedGeometry; disabled
brep = Brep(reflay_2)  # disabled
mesh_2 = Mesh(reflay_3)  # disabled
faceb = FaceBoundaries(Mesh=mesh_2)  # disabled
mesh_3 = Mesh(filtertype.IncludedGeometry)  # disabled
faceb_2 = FaceBoundaries(Mesh=mesh_3)  # disabled
boundary = BoundarySurfaces(Edges=faceb)  # disabled
boundary_2 = BoundarySurfaces(Edges=faceb_2)  # disabled
join = BrepJoin(Breps=boundary)  # -> Breps, Closed; disabled
join_2 = BrepJoin(Breps=boundary_2)  # -> Breps, Closed; disabled

# ----
# ASSEMBLY PHASES
number_slider = Slider(8, range=1..8)
series_2 = Series(Start=1, Step=1, Count=number_slider)
item = ListItem(List=series_2, Index=0, Wrap=True)  # -> Item, Item1, Item2, Item3, Item4, Item5, Item6, Item7

# ---- group: BIMSC-ORIGINATOR
bimsc_originator = Text("G06")

# ---- group: WorksForBrepsAndMeshes
list_2 = ValueList({"Srf/Brep": 0, "Mesh": 1}, selected="Mesh")

# ---- group: BIMSC-VOLUME
bimsc_volume = Text("A4")

# ---- group: PHASE 2
num = Number(item.Item1)

# ---- group: PHASE 1
num_2 = Number(item.Item)

# ---- group: PHASE 3
num_3 = Number(item.Item2)

# ---- group: PHASE 4
num_4 = Number(item.Item3)

# ---- group: PHASE 5
num_5 = Number(item.Item4)

# ---- group: PHASE 6
num_6 = Number(item.Item5)

# ---- group: PHASE 7
num_7 = Number(item.Item6)

# ---- group: PHASE 8
num_8 = Number(item.Item7)

# ----
# UNITS
panel_7 = Panel("UnitsRawVolumes")
reflay_5 = ReferenceByLayer(LayerName=panel_7, lightweight=False)
volume = Volume(Geometry=reflay_5)  # -> Volume, Centroid
int = Integer(volume.Volume)
cset = CreateSet(List=int)  # -> Set, Map
cset_2 = CreateSet(List=cset.Map)  # -> Set, Map
mindex = MemberIndex(Set=cset.Map, Member=cset_2.Set)  # -> Index, Count
item_2 = ListItem(List=reflay_5, Index=mindex.Index, Wrap=True)  # -> simplify(Item)
bang = ExplodeTree(Data=item_2)  # -> Branch0, Branch1

# ----
# PHASE 2 (50P) - HUMANS / MACHINE COLLABORATION
panel_8 = Panel("")
# PHASE 1 (50p)- NO HUMANS
panel_9 = Panel("")

# ---- group: All Blocks for Pods
# UNITS BLOCKS
panel_10 = Panel("Default")
reflay_6 = ReferenceByLayer(LayerName=panel_10, lightweight=False)  # -> simplify(graft(Geometry))
block_info = GetBlockInfo(Block=reflay_6)  # -> Name, simplify(Plane), Transform, BlockType, FilePath, Active
pt = Point(block_info.Plane)

# ----
area = Area(Geometry=bang.Branch1)  # -> Area, Centroid
prox = Proximity3D(Points=area.Centroid, Group="2", MaxRadius="5")  # -> simplify(Links), Topology
clean = CleanTree(RemoveNulls=True, RemoveInvalid=True, RemoveEmpty=True, Tree=prox.Links)
tstat = TreeStatistics(Tree=clean)  # -> Paths, Length, Count
duplines = RemoveDuplicateLines(Lines=flatten(clean), Tolerance=0.01)  # -> graft(Lines)
split = SplitTree(Data=simplify(graft(bang.Branch1)), Masks=flatten(tstat.Paths))  # -> graft(Positive), flatten(Negative)

panel_11 = Panel(reflay_6)

# ---- group: All Blocks for Pods / Units Planes
bang_2 = ExplodeTree(Data=pt)  # -> Branch0, Branch1, Branch2

# ----
# ADD UNITS FLOOR
panel_12 = Panel("Floors")
reflay_7 = ReferenceByLayer(LayerName=panel_12, lightweight=False, DisableAutoUpdate=False)
mesh_4 = MeshBrep(
    Brep=reflay_7,
    Settings={GridMaxCount=0, GridMinCount=16, JaggedSeams=False, MaxEdgeLength=0, MinEdgeLength=0.0001, MinTolerance=0, Refine=True, RefineAngle=0, RelativeTolerance=0.65, SimplePlanes=True, Tolerance=0})
mjoin = MeshJoin(Meshes=mesh_4)
weld = WeldMesh(Mesh=mjoin, Angle=3.141592654)
brep_2 = Brep(reflay_7)
phase = Panel(num)
filter = StreamFilter(Gate=list_2, Stream0=brep_2, Stream1=weld)
name = ExtendSpeckleObject(
    SpeckleObject=filter,
    BIMSCPROJECT=bimsc_project,
    BIMSCORIGINATOR=bimsc_originator,
    BIMSCVOLUME=bimsc_volume,
    BIMSCTYPE="FLOORS",
    BIMSCMATERIAL="Regolith",
    RenderMaterial=dso.Regolith,
    BIMSCPHASE=phase,
    selectedKitName="Objects")  # -> flatten(ExtendedSpeckleObject)

# ----
# ADD COURTYARD PODS
panel_13 = Panel("Pods")
reflay_8 = ReferenceByLayer(LayerName=panel_13, lightweight=False, DisableAutoUpdate=False)
mesh_5 = MeshBrep(
    Brep=reflay_8,
    Settings={GridMaxCount=0, GridMinCount=16, JaggedSeams=False, MaxEdgeLength=0, MinEdgeLength=0.0001, MinTolerance=0, Refine=True, RefineAngle=0, RelativeTolerance=0.65, SimplePlanes=True, Tolerance=0})
brep_3 = Brep(reflay_8)
mjoin_2 = MeshJoin(Meshes=mesh_5)
weld_2 = WeldMesh(Mesh=mjoin_2, Angle=3.141592654)
filter_2 = StreamFilter(Gate=list_2, Stream0=brep_3, Stream1=weld_2)
phase_2 = Panel(num_3)
name_2 = ExtendSpeckleObject(
    SpeckleObject=filter_2,
    BIMSCPROJECT=bimsc_project,
    BIMSCORIGINATOR=bimsc_originator,
    BIMSCVOLUME=bimsc_volume,
    BIMSCTYPE="PODS",
    BIMSCMATERIAL="Regolith",
    RenderMaterial=dso.Regolith,
    BIMSCPHASE=phase_2,
    selectedKitName="Objects")  # -> flatten(ExtendedSpeckleObject)

# ----
# ADD WALLS
panel_14 = Panel("Wall")
reflay_9 = ReferenceByLayer(LayerName=panel_14, lightweight=False, DisableAutoUpdate=False)
mesh_6 = MeshBrep(
    Brep=reflay_9,
    Settings={GridMaxCount=0, GridMinCount=16, JaggedSeams=False, MaxEdgeLength=0, MinEdgeLength=0.0001, MinTolerance=0, Refine=True, RefineAngle=0, RelativeTolerance=0.65, SimplePlanes=True, Tolerance=0})
brep_4 = Brep(reflay_9)
mjoin_3 = MeshJoin(Meshes=mesh_6)
weld_3 = WeldMesh(Mesh=mjoin_3, Angle=3.141592654)
phase_3 = Panel(num_7)
filter_3 = StreamFilter(Gate=list_2, Stream0=brep_4, Stream1=weld_3)  # -> reverse(simplify(graft(Stream)))
name_3 = ExtendSpeckleObject(
    SpeckleObject=filter_3,
    BIMSCPROJECT=bimsc_project,
    BIMSCORIGINATOR=bimsc_originator,
    BIMSCVOLUME=bimsc_volume,
    BIMSCTYPE="WALLS",
    BIMSCMATERIAL="Regolith",
    RenderMaterial=dso.Regolith,
    BIMSCPHASE=phase_3,
    selectedKitName="Objects")

# ----
# ADD ROOF
panel_15 = Panel("Roof")
reflay_10 = ReferenceByLayer(LayerName=panel_15, lightweight=False, DisableAutoUpdate=False)
mesh_7 = Mesh(reflay_10)
faceb_3 = FaceBoundaries(Mesh=mesh_7)
boundary_3 = BoundarySurfaces(Edges=faceb_3)
join_3 = BrepJoin(Breps=boundary_3)  # -> Breps, Closed
mesh_8 = Mesh(reflay_10)
phase_4 = Panel(num_8)
filter_4 = StreamFilter(Gate=list_2, Stream0=join_3.Breps, Stream1=mesh_8)  # -> reverse(simplify(graft(Stream)))
name_4 = ExtendSpeckleObject(
    SpeckleObject=filter_4,
    BIMSCPROJECT=bimsc_project,
    BIMSCORIGINATOR=bimsc_originator,
    BIMSCVOLUME=bimsc_volume,
    BIMSCTYPE="ROOF",
    BIMSCMATERIAL="Inflatable",
    RenderMaterial=dso.Inflatable,
    BIMSCPHASE=phase_4,
    selectedKitName="Objects")

# ----
# SORTING UNITS BY VOLUME
end = EndPoints(Curve=simplify(duplines))  # -> Start, End
pdecon = Deconstruct(Point=[end.Start, end.End])  # -> XComponent, YComponent, ZComponent
int_2 = Integer(pdecon.ZComponent)
bnd = Bounds(Numbers=int_2)
dedomain = DeconstructDomain(Domain=bnd)  # -> Start, End
equals = Equality(FirstNumber=int_2, SecondNumber=dedomain.Start)  # -> Equality, Inequality
volume_2 = Volume(Geometry=split.Positive)  # -> Volume, simplify(flatten(Centroid))
cull = CullPattern(List=[end.Start, end.End], CullPattern=equals.Equality)
cp = ClosestPoint(Point=cull, Cloud=volume_2.Centroid)  # -> ClosestPoint, CPIndex, Distance
item_3 = ListItem(List=flatten(split.Positive), Index=cp.CPIndex, Wrap=True)
debrep = DeconstructBrep(Brep=item_3)  # -> Faces, Edges, Vertices
area_2 = Area(Geometry=debrep.Faces)  # -> Area, Centroid
pdecon_2 = Deconstruct(Point=area_2.Centroid)  # -> XComponent, YComponent, ZComponent
int_3 = Integer(pdecon_2.ZComponent)
bnd_2 = Bounds(Numbers=int_3)
dedomain_2 = DeconstructDomain(Domain=bnd_2)  # -> Start, End
equals_2 = Equality(FirstNumber=int_3, SecondNumber=dedomain_2.Start)  # -> Equality, Inequality
cull_2 = CullPattern(List=debrep.Faces, CullPattern=equals_2.Equality)  # -> simplify(List)
subtraction = Subtraction(A=dedomain.Start, B=dedomain.End)
wires = BrepWireframe(Brep=cull_2, Density=-1)
division = Division(A=subtraction, B="2")
abs = Absolute(Value=subtraction)
Z = UnitZ(Factor=division)
move = Move(Geometry=cull, Motion=Z)  # -> Geometry, Transform
project = Project(Geometry=wires, Plane=move.Geometry)  # -> simplify(Geometry), Transform

# ---- group: Units_Buffer
brep_5 = Brep(Tree({0}: [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], {1}: [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]))

# ---- group: Units_Habi
brep_6 = Brep(Tree({0}: [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], {1}: [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]))

# ---- group: Units_Support
brep_7 = Brep(Tree({0}: [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], {1}: [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]))

# ----
phase_5 = Panel(num_5)
phase_6 = Panel(num_4)
phase_7 = Panel(num_6)
phase_8 = Panel(num_2)

# ----
# EDIT SITE MESH
panel_16 = Panel("https://macad.speckle.xyz/streams/4975f9f0a8/branches/site/04-community-site")
receive_2 = Receive(
    Stream=panel_16,
    AutoReceive=False,
    CurrentComponentState="up_to_date",
    ExpandOutput=True,
    LastInfoMessage="James McBennett @ 03/01/2024 23:14:17: 2024 Mar-01 (id:9ec35295b2)",
    ReceiveOnOpen=False,
    ReceivedCommitId="9ec35295b2",
    StreamWrapper="https://macad.speckle.xyz/streams/4975f9f0a8/branches/site/04-community-site",
    selectedKitName="Objects")  # -> Info, CONTOURS, SOIL
item_4 = ListItem(List=flatten(receive_2.SOIL), Index=Slider(3, range=0..17), Wrap=True)
srf = Surface(<surface referenced from the Rhino model>)
bbox = BoundingBox(Content=srf, Plane=PlaneXY(0, 0, 0))  # -> Box, Box_2
volume_3 = Volume(Geometry=bbox.Box)  # -> Volume, Centroid
msphere = MeshSphere(Base=volume_3.Centroid, Radius="80", UCount="100", VCount="100")
msplit = MeshSplit(Mesh=item_4, Splitters=msphere)
item_5 = ListItem(List=msplit, Index=Slider(0, range=0..1), Wrap=True)
name_5 = ExtendSpeckleObject(
    SpeckleObject=item_5,
    BIMSCPROJECT=bimsc_project,
    BIMSCORIGINATOR=bimsc_originator,
    BIMSCVOLUME=bimsc_volume,
    BIMSCTYPE="SITE",
    BIMSCMATERIAL="soil",
    RenderMaterial=dso.Soil,
    BIMSCPHASE=phase_8,
    selectedKitName="Objects")  # -> flatten(ExtendedSpeckleObject)

# ----
# ADD SITE TERRAIN
panel_17 = Panel("TopoMesh")
reflay_11 = ReferenceByLayer(LayerName="TopoBrep", lightweight=False, DisableAutoUpdate=False)
reflay_12 = ReferenceByLayer(LayerName=panel_17, lightweight=False, DisableAutoUpdate=False)
filter_5 = StreamFilter(Gate=list_2, Stream0=reflay_11, Stream1=reflay_12)
msplit_2 = MeshSplit(Mesh=filter_5, Splitters=msphere)
item_6 = ListItem(List=msplit_2, Index=Slider(1, range=0..1), Wrap=True)
name_6 = ExtendSpeckleObject(
    SpeckleObject=item_6,
    BIMSCPROJECT=bimsc_project,
    BIMSCORIGINATOR=bimsc_originator,
    BIMSCVOLUME=bimsc_volume,
    BIMSCTYPE="TERRAIN",
    BIMSCMATERIAL="soil",
    RenderMaterial=dso.Soil,
    BIMSCPHASE=phase_8,
    selectedKitName="Objects")  # -> flatten(ExtendedSpeckleObject)

end_2 = EndPoints(Curve=project.Geometry)  # -> Start, End
multiplication = Multiplication(A=abs, B="2")
cullpt = CullDuplicates(Points=[end_2.Start, end_2.End], Tolerance=0.1, CullMode=3)  # -> Points, Indices, Valence
pline = PolyLine(Vertices=cullpt.Points, Closed=True)  # -> simplify(Polyline)
Z_2 = UnitZ(Factor=multiplication)
extr = Extrude(Base=pline, Direction=Z_2)
cap = CapHoles(Brep=extr)

active = ActiveDocument()
listblockd = ListBlocksInDocument(fullName=True)
panel_18 = Panel(listblockd)
location = ProjectLocation(Project=active)  # -> SiteLocation, SharedSite, SurveyPoint, ProjectBasePoint
keysearch = KeyValueSearch()
subcat = AddSubCategory(TrackingMode=2)

# ----
# G06 wip branch
# https://macad.speckle.xyz/projects/4975f9f0a8/models/0c407c0907
panel_19 = Panel("G06_WIPdModel_V10")

# ----
# G06 shared branch
# https://macad.speckle.xyz/streams/4975f9f0a8/branches/shared%2Fg06
panel_20 = Panel("G06_AssembledModel_V4")

# ----
# G06_test_Unreal
# https://macad.speckle.xyz/streams/5e4e4e4563
panel_21 = Panel("G06_UnrealdModel_V1")

# ---- group: Units_Buffer
# UNITS PLANES
debrep_2 = DeconstructBrep(Brep=bang.Branch0)  # -> Faces, Edges, Vertices
area_3 = Area(Geometry=debrep_2.Faces)  # -> Area, Centroid
pdecon_3 = Deconstruct(Point=area_3.Centroid)  # -> XComponent, YComponent, ZComponent
int_4 = Integer(pdecon_3.ZComponent)
bnd_3 = Bounds(Numbers=int_4)
dedomain_3 = DeconstructDomain(Domain=bnd_3)  # -> Start, End
equals_3 = Equality(FirstNumber=int_4, SecondNumber=dedomain_3.Start)  # -> Equality, Inequality
cull_3 = CullPattern(List=area_3.Centroid, CullPattern=equals_3.Equality)  # -> simplify(List)
pln = Plane(flatten(cull_3))

pln_2 = Plane(flatten(cull_3))

# ----
# BUFFER UNITS
bang_3 = ExplodeTree(Data=brep_5)  # -> Branch0, Branch1
sso = BlockDefinition(
    Name="Inflatable",
    Geometry=bang_3.Branch0,
    BasePoint=bang_2.Branch0,
    SelectedConstructorName="Objects.Other.BlockDefinition.ctor(System.String,System.Collections.Generic.List`1[Speckle.Core.Models.Base],Objects.Geometry.Point)",
    SelectedTypeName="Objects.Other.BlockDefinition",
    UseSchemaTag=False,
    UserSetSchemaTag=False,
    seed="e98ffe5e9bfe795355b2")
sso_2 = BlockDefinition(
    Name="Steel",
    Geometry=bang_3.Branch1,
    BasePoint=bang_2.Branch0,
    SelectedConstructorName="Objects.Other.BlockDefinition.ctor(System.String,System.Collections.Generic.List`1[Speckle.Core.Models.Base],Objects.Geometry.Point)",
    SelectedTypeName="Objects.Other.BlockDefinition",
    UseSchemaTag=False,
    UserSetSchemaTag=False,
    seed="19cce9d17a2992b002e5")
orient = Orient(Geometry=bang_2.Branch0, Source=bang_2.Branch0, Target=pln_2)  # -> Geometry, Transform
sso_3 = BlockInstance(
    BlockDefinition=sso,
    Transform=orient.Transform,
    SelectedConstructorName="Objects.Other.BlockInstance.ctor(Objects.Other.BlockDefinition,Objects.Other.Transform)",
    SelectedTypeName="Objects.Other.BlockInstance",
    UseSchemaTag=False,
    UserSetSchemaTag=False,
    seed="6ac40892a254094ba5bf")
sso_4 = BlockInstance(
    BlockDefinition=sso_2,
    Transform=orient.Transform,
    SelectedConstructorName="Objects.Other.BlockInstance.ctor(Objects.Other.BlockDefinition,Objects.Other.Transform)",
    SelectedTypeName="Objects.Other.BlockInstance",
    UseSchemaTag=False,
    UserSetSchemaTag=False,
    seed="56e02fcb1ef79a18a3fe")
name_7 = ExtendSpeckleObject(
    SpeckleObject=sso_3,
    BIMSCPROJECT=bimsc_project,
    BIMSCORIGINATOR=bimsc_originator,
    BIMSCVOLUME=bimsc_volume,
    BIMSCTYPE="INFLATABLES",
    BIMSCMATERIAL="Inflatable",
    RenderMaterial=dso.Inflatable,
    BIMSCPHASE=phase_7,
    selectedKitName="Objects")
name_8 = ExtendSpeckleObject(
    SpeckleObject=sso_4,
    BIMSCPROJECT=bimsc_project,
    BIMSCORIGINATOR=bimsc_originator,
    BIMSCVOLUME=bimsc_volume,
    BIMSCTYPE="STRUCTURE",
    BIMSCMATERIAL="Steel",
    RenderMaterial=dso.Steel,
    BIMSCPHASE=phase_7,
    selectedKitName="Objects")
in = CreateSpeckleObject(Inflatables=name_7, Structure=name_8, selectedKitName="Objects")

# ---- group: Units_Support
debrep_3 = DeconstructBrep(Brep=cap)  # -> Faces, Edges, Vertices
area_4 = Area(Geometry=debrep_3.Faces)  # -> Area, Centroid
pdecon_4 = Deconstruct(Point=area_4.Centroid)  # -> XComponent, YComponent, ZComponent
int_5 = Integer(pdecon_4.ZComponent)
bnd_4 = Bounds(Numbers=int_5)
dedomain_4 = DeconstructDomain(Domain=bnd_4)  # -> Start, End
equals_4 = Equality(FirstNumber=int_5, SecondNumber=dedomain_4.Start)  # -> Equality, Inequality
cull_4 = CullPattern(List=area_4.Centroid, CullPattern=equals_4.Equality)  # -> simplify(List)
pln_3 = Plane(flatten(cull_4))

pln_4 = Plane(flatten(cull_4))

# ----
pt_2 = Point(pln_4)

# ----
# SUPPORT UNITS
bang_4 = ExplodeTree(Data=brep_7)  # -> Branch0, Branch1
sso_5 = BlockDefinition(
    Name="Inflatable",
    Geometry=bang_4.Branch0,
    BasePoint=bang_2.Branch0,
    SelectedConstructorName="Objects.Other.BlockDefinition.ctor(System.String,System.Collections.Generic.List`1[Speckle.Core.Models.Base],Objects.Geometry.Point)",
    SelectedTypeName="Objects.Other.BlockDefinition",
    UseSchemaTag=False,
    UserSetSchemaTag=False,
    seed="e943e21153ec278cf34c")
sso_6 = BlockDefinition(
    Name="Steel",
    Geometry=bang_4.Branch1,
    BasePoint=bang_2.Branch0,
    SelectedConstructorName="Objects.Other.BlockDefinition.ctor(System.String,System.Collections.Generic.List`1[Speckle.Core.Models.Base],Objects.Geometry.Point)",
    SelectedTypeName="Objects.Other.BlockDefinition",
    UseSchemaTag=False,
    UserSetSchemaTag=False,
    seed="3ec79391879efae79a6e")
orient_2 = Orient(Geometry=bang_2.Branch0, Source=bang_2.Branch0, Target=pt_2)  # -> Geometry, Transform
sso_7 = BlockInstance(
    BlockDefinition=sso_5,
    Transform=orient_2.Transform,
    SelectedConstructorName="Objects.Other.BlockInstance.ctor(Objects.Other.BlockDefinition,Objects.Other.Transform)",
    SelectedTypeName="Objects.Other.BlockInstance",
    UseSchemaTag=False,
    UserSetSchemaTag=False,
    seed="45b434c764ae94fc6baa")
sso_8 = BlockInstance(
    BlockDefinition=sso_6,
    Transform=orient_2.Transform,
    SelectedConstructorName="Objects.Other.BlockInstance.ctor(Objects.Other.BlockDefinition,Objects.Other.Transform)",
    SelectedTypeName="Objects.Other.BlockInstance",
    UseSchemaTag=False,
    UserSetSchemaTag=False,
    seed="bc2b41bba78f8d3e6aa2")
name_9 = ExtendSpeckleObject(
    SpeckleObject=sso_7,
    BIMSCPROJECT=bimsc_project,
    BIMSCORIGINATOR=bimsc_originator,
    BIMSCVOLUME=bimsc_volume,
    BIMSCTYPE="INFLATABLES",
    BIMSCMATERIAL="Inflatable",
    RenderMaterial=dso.Inflatable,
    BIMSCPHASE=phase_6,
    selectedKitName="Objects")
name_10 = ExtendSpeckleObject(
    SpeckleObject=sso_8,
    BIMSCPROJECT=bimsc_project,
    BIMSCORIGINATOR=bimsc_originator,
    BIMSCVOLUME=bimsc_volume,
    BIMSCTYPE="STRUCTURE",
    BIMSCMATERIAL="Steel",
    RenderMaterial=dso.Steel,
    BIMSCPHASE=phase_6,
    selectedKitName="Objects")
in_2 = CreateSpeckleObject(Inflatables=name_9, Structure=name_10, selectedKitName="Objects")

# ----
# G6_STUDIO_MAIN_MODEL
# https://macad.speckle.xyz/projects/4975f9f0a8/models/37a2354197
panel_22 = Panel("G06_AssembledModel_V4")

# ---- group: Units_Habi
debrep_4 = DeconstructBrep(Brep=split.Negative)  # -> Faces, Edges, Vertices
area_5 = Area(Geometry=debrep_4.Faces)  # -> Area, Centroid
pdecon_5 = Deconstruct(Point=area_5.Centroid)  # -> XComponent, YComponent, ZComponent
int_6 = Integer(pdecon_5.ZComponent)
bnd_5 = Bounds(Numbers=int_6)
dedomain_5 = DeconstructDomain(Domain=bnd_5)  # -> Start, End
equals_5 = Equality(FirstNumber=int_6, SecondNumber=dedomain_5.Start)  # -> Equality, Inequality
cull_5 = CullPattern(List=area_5.Centroid, CullPattern=equals_5.Equality)  # -> simplify(List)
# //Temporarily
# disconnected
# to correct
# orientation
pln_5 = Plane(flatten(cull_5))

pln_6 = Plane(flatten(cull_5))

# ----
# HABITAD UNITS
bang_5 = ExplodeTree(Data=brep_6)  # -> Branch0, Branch1
sso_9 = BlockDefinition(
    Name="Inflatable",
    Geometry=bang_5.Branch0,
    BasePoint=bang_2.Branch0,
    SelectedConstructorName="Objects.Other.BlockDefinition.ctor(System.String,System.Collections.Generic.List`1[Speckle.Core.Models.Base],Objects.Geometry.Point)",
    SelectedTypeName="Objects.Other.BlockDefinition",
    UseSchemaTag=False,
    UserSetSchemaTag=False,
    seed="74c7ac9f915255a3e209")
sso_10 = BlockDefinition(
    Name="Steel",
    Geometry=bang_5.Branch1,
    BasePoint=bang_2.Branch0,
    SelectedConstructorName="Objects.Other.BlockDefinition.ctor(System.String,System.Collections.Generic.List`1[Speckle.Core.Models.Base],Objects.Geometry.Point)",
    SelectedTypeName="Objects.Other.BlockDefinition",
    UseSchemaTag=False,
    UserSetSchemaTag=False,
    seed="6d6048d8a75f62682faf")
orient_3 = Orient(Geometry=bang_2.Branch0, Source=bang_2.Branch0, Target=pln_6)  # -> Geometry, Transform
sso_11 = BlockInstance(
    BlockDefinition=sso_9,
    Transform=orient_3.Transform,
    SelectedConstructorName="Objects.Other.BlockInstance.ctor(Objects.Other.BlockDefinition,Objects.Other.Transform)",
    SelectedTypeName="Objects.Other.BlockInstance",
    UseSchemaTag=False,
    UserSetSchemaTag=False,
    seed="5ef6fa26b8afc923a02a")
sso_12 = BlockInstance(
    BlockDefinition=sso_10,
    Transform=orient_3.Transform,
    SelectedConstructorName="Objects.Other.BlockInstance.ctor(Objects.Other.BlockDefinition,Objects.Other.Transform)",
    SelectedTypeName="Objects.Other.BlockInstance",
    UseSchemaTag=False,
    UserSetSchemaTag=False,
    seed="2b6654ad513ddd9dd323")
name_11 = ExtendSpeckleObject(
    SpeckleObject=sso_11,
    BIMSCPROJECT=bimsc_project,
    BIMSCORIGINATOR=bimsc_originator,
    BIMSCVOLUME=bimsc_volume,
    BIMSCTYPE="INFLATABLES",
    BIMSCMATERIAL="Inflatable",
    RenderMaterial=dso.Inflatable,
    BIMSCPHASE=phase_5,
    selectedKitName="Objects")
name_12 = ExtendSpeckleObject(
    SpeckleObject=sso_12,
    BIMSCPROJECT=bimsc_project,
    BIMSCORIGINATOR=bimsc_originator,
    BIMSCVOLUME=bimsc_volume,
    BIMSCTYPE="STRUCTURE",
    BIMSCMATERIAL="Steel",
    RenderMaterial=dso.Steel,
    BIMSCPHASE=phase_5,
    selectedKitName="Objects")
in_3 = CreateSpeckleObject(Inflatables=name_11, Structure=name_12, selectedKitName="Objects")

# ----
# MERGED UNITS
in_4 = CreateSpeckleObject(Units_Buffer=in, Units_Habi=in_3, Units_Support=in_2, selectedKitName="Objects")

panel_23 = Panel(in_4)

# ----
# SEND TO SPLECKLE STREAMS
cso = CreateSpeckleObject(
    ROOF=name_4,
    WALL=name_3,
    FLOORS=name,
    PODS=name_2,
    UNITS=in_4,
    TERRAIN=name_6,
    SITE_A4=name_5,
    selectedKitName="Objects")

# ----
# 01 //Create Revit Materials from Rhino M Properties
trigger = Trigger(Interval=-1000, TimerInterval=1000, Target=[material, graphics])

# ----
# 02// Create New Unit Revit Family
trigger_2 = Trigger(Interval=-1000, TimerInterval=1000, Target=[new, famform, materials, active_2])  # disabled

# ----
# The figures in the circles from the trigger component
# for the revit families to work have to be from left to right:
# a triangle (play), a pointer (mouse), and a key.
# //Send Topo Meshes to Revit
trigger_3 = Trigger(Interval=-1000, TimerInterval=1000, Target=topography)

# ----
# 03//Add Units to Revit
trigger_4 = Trigger(Interval=-1000, TimerInterval=1000, Target=[types, l_component_3, l_component, l_component_2])

# ---- group: All Units (internalised)
srf_2 = Surface([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])

# ---- group: All Other Units
srf_3 = Surface([<surface referenced from the Rhino model> x56])

# ---- group: Support Units
srf_4 = Surface([<surface referenced from the Rhino model> x9])

# ----
# //Units Planes for positioning in model
area_6 = Area(Geometry=srf_3)  # -> Area, Centroid
area_7 = Area(Geometry=srf_4)  # -> Area, Centroid
pl_origin = PlaneOrigin(Base=srf_4, Origin=area_7.Centroid)
pl_origin_2 = PlaneOrigin(Base=srf_3, Origin=area_6.Centroid)
smaller = SmallerThan(FirstNumber=area_6.Area, SecondNumber="20")  # -> SmallerThan, OrEqualTo
dispatch = Dispatch(List=pl_origin_2, DispatchPattern=smaller.OrEqualTo)  # -> ListA, ListB
entwine = Entwine(Branch00=pl_origin, Branch01=dispatch.ListB, Branch02=dispatch.ListA, FlattenInputs=True)

# ----
# Always Leave Send Component Unplugged
# in the stream input before closing and
# saving this gh file
send = Send(
    Message=panel_19,
    D=cso,
    AutoSend=False,
    BaseId="61a5c0449fc9d2c6089ab465ac4f1933",
    CurrentComponentState="up_to_date",
    KitName="Objects",
    OutputWrappers="https://macad.speckle.xyz\t4975f9f0a8\t5050d2ac9e",
    UseDefaultCache=True,
    selectedKitName="Objects")
rec = DataRecorder(send, DataLimit=-10, RecordData=True)
panel_24 = Panel(rec)

categories = BuiltInCategories("autodesk.revit.category.local:walls-1.0.0", SearchPattern="walls")
categories_2 = BuiltInCategories("autodesk.revit.category.local:walls-1.0.0", SearchPattern="walls")
categories_3 = BuiltInCategories("autodesk.revit.category.local:walls-1.0.0", SearchPattern="walls")

# ----
# //Send topo meshes to Revit
number_slider_2 = Slider(9, range=0..10)
mesh_9 = Mesh(reflay_12)
unweld = UnweldMesh(Mesh=mesh_9, Angle=degrees(number_slider_2))
topography = AddTopographyMesh(Mesh=unweld, TrackingMode=2)  # disabled

# ----
# //Send block instances to Revit
block_info_2 = GetBlockInfo(Block=reflay_6)  # -> Name, Plane, Transform, BlockType, FilePath, Active
orient_4 = Orient(Geometry=reflay_6, Source=block_info_2.Plane, Target=PlaneXY(0, 0, 0))  # -> Geometry, Transform
expblock = ExplodeBlock(Block=orient_4.Geometry, recursive=False)  # -> Name, Transform, Geometry

element_type_picker = ElementTypePicker(
    categories_2,
    {"Basic Wall : Concrete_200 mm": "6375e9dc-f3f7-43b4-ba41-4b1149282f5f:df3ab8ed-b73d-4e38-803c-2cf05141eda7-00026de1", "Curtain Wall : BIMSC_A_Storefront": "6375e9dc-f3f7-43b4-ba41-4b1149282f5f:e3e052f9-0156-11d5-9301-0000863f27ad-0000014e"}, selected="Basic Wall : Concrete_200 mm")
element_type_picker_2 = ElementTypePicker(
    categories_3,
    {"Basic Wall : Concrete_200 mm": "6375e9dc-f3f7-43b4-ba41-4b1149282f5f:df3ab8ed-b73d-4e38-803c-2cf05141eda7-00026de1", "Curtain Wall : BIMSC_A_Storefront": "6375e9dc-f3f7-43b4-ba41-4b1149282f5f:e3e052f9-0156-11d5-9301-0000863f27ad-0000014e"}, selected="Basic Wall : Concrete_200 mm")
element_type_picker_3 = ElementTypePicker(
    categories,
    {"Basic Wall : Concrete_200 mm": "6375e9dc-f3f7-43b4-ba41-4b1149282f5f:df3ab8ed-b73d-4e38-803c-2cf05141eda7-00026de1", "Curtain Wall : BIMSC_A_Storefront": "6375e9dc-f3f7-43b4-ba41-4b1149282f5f:e3e052f9-0156-11d5-9301-0000863f27ad-0000014e"}, selected="Basic Wall : Concrete_200 mm")

# ----
# //Query materials' names using Elefront
geo = Geometry(expblock.Geometry)
ef_att = EleFrontAttributes(Attributes=geo)
ef_layer = EleFrontLayer(Layer=ef_att)
ef_layer_2 = EleFrontLayer(Layer=ef_layer)

split_2 = TextSplit(Text=ef_layer, Separators="::")
item_7 = ListItem(List=split_2, Index=-1, Wrap=True)
concat_2 = Concatenate(FragmentA="M-", FragmentB=item_7)  # -> simplify(Result)
pshift = ShiftPaths(Data=concat_2, Offset=-1)

ef_att_2 = EleFrontAttributes(Attributes=geo)  # -> Attributes, Keys, Values, Name, Layer, ColourSource, DisplayColour, MaterialSource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
bang_6 = ExplodeTree(Data=ef_att_2.Layer)  # -> Branch0, Branch1, Branch2
panel_25 = Panel(bang_6.Branch2)
panel_26 = Panel(bang_6.Branch1)
panel_27 = Panel(bang_6.Branch0)
lng = ListLength(List=panel_25)
lng_2 = ListLength(List=panel_26)
lng_3 = ListLength(List=panel_27)
cset_3 = CreateSet(List=panel_27)  # -> Set, Map
repeat = RepeatData(Data=categories, Length=lng)
repeat_2 = RepeatData(Data=categories_2, Length=lng_2)
repeat_3 = RepeatData(Data=categories_3, Length=lng_3)
panel_28 = Panel(repeat_3)
panel_29 = Panel(repeat)
panel_30 = Panel(repeat_2)
panel_31 = Panel(cset_3.Map)
item_8 = ListItem(List=bang_6.Branch0, Index=0, Wrap=True)

# ----
# SEND TO REVIT MODEL
bang_7 = ExplodeTree(Data=simplify(entwine))  # -> Branch0, Branch1, Branch2

entwine_2 = Entwine(Branch00=panel_28, Branch01=panel_30, Branch02=panel_29, FlattenInputs=True)
lng_4 = ListLength(List=entwine_2)  # -> flatten(Length)
repeat_4 = RepeatData(Data="poop", Length=lng_4)
panel_32 = Panel(ef_layer_2)
panel_33 = Panel(pshift)
pln_7 = Plane(bang_7.Branch1)
subcat_2 = AddSubCategory(Parent=entwine_2, Name=repeat_4, TrackingMode=2)

# ----
# 02// Create new component family
materials = QueryMaterials(Name=ef_layer_2)  # disabled
add_link_to_revit_family_in_from_your_la = Panel("C:\Users\paude\Desktop\FTemplate_GEN_WorkPlane.rft")  # "Add Link to Revit Family in from your laptop. [Final / Documentation]"
add_link_to_revit_family_in_from_your_la_2 = Panel("D:\FAD\MaCAD\Studio 2\GitHub\G06_studio_2024\Final\documentation\FTemplate_GEN_WorkPlane.rft")  # "Add Link to Revit Family in from your laptop. [Final / Documentation]"
famform = ComponentFamilyForm(Brep=graft(geo), Subcategory=subcat_2, Material=materials)  # disabled
active_2 = ActiveDocument()  # disabled
shift = ShiftPaths(Data=famform, Offset=-1)  # disabled
new = NewComponentFamily(
    Document=active_2,
    Template=add_link_to_revit_family_in_from_your_la,
    Overwrite=Toggle(True),
    Name=simplify(expblock.Name),
    Geometry=simplify(shift))  # disabled

# ----
# 03//Add components to RH Planes
types = QueryTypes(Document=active_2, Kind=3, FamilyName=expblock.Name)
bang_8 = ExplodeTree(Data=types)  # -> Branch0, Branch1, Branch2
l_component = AddComponentLocation(Document=active_2, Location=simplify(bang_7.Branch1), Type=simplify(bang_8.Branch1), TrackingMode=2)
l_component_2 = AddComponentLocation(Document=active_2, Location=simplify(bang_7.Branch2), Type=simplify(bang_8.Branch2), TrackingMode=2)
l_component_3 = AddComponentLocation(Document=active_2, Location=simplify(bang_7.Branch0), Type=simplify(bang_8.Branch0), TrackingMode=2)

panel_34 = Panel(subcat_2)
panel_35 = Panel(bang_8.Branch1)
panel_36 = Panel(bang_8.Branch0)
panel_37 = Panel(new)
reftype = ReferenceByType(ObjectType="brep", lightweight=False)
filterlay = FilterByLayer(Layer="*", invertFilter=False, returnNulls=False)  # -> ExcludedGeometry, IncludedGeometry

# ----
# 01 //Create Revit materials from Rhino M Properties
cset_4 = CreateSet(List=flatten(ef_layer_2))  # -> Set, Map
material = AddMaterial(Name=cset_4.Set, TrackingMode=2)  # disabled

# ---- group: MaterialProperties
python = GhPythonScript(Mname=cset_4.Set)  # -> out, Pvalue, Pname
# ---------- python: Python ----------
__author__ = "hesham.shawqy"
__version__ = "2024.02.25"

import rhinoscriptsyntax as rs
import Rhino.DocObjects as rd
import Rhino as rh

def get_material_properties(Mname):
    # Get the active Rhino document
    doc = rh.RhinoDoc.ActiveDoc
    
    # Search for the material by name
    material_index = doc.Materials.Find(Mname, True)
    if material_index < 0:
        print("Material not found.")
        return None
    
    # Retrieve the material object
    material = doc.Materials[material_index]
    
    # Extract material properties
    properties = {
        "DiffuseColor": material.DiffuseColor,
        "Transparency": material.Transparency,
        # Add more properties as needed
    }
    
    return properties

Pname = []
Pvalue = []
material_properties = get_material_properties(Mname)
if material_properties:
    for prop, value in material_properties.items():
        Pvalue.append(value)
        Pname.append(prop)
# ---------- end python ----------

# ----
item_9 = ListItem(List=simplify(python.Pvalue), Index=0, Wrap=True)  # -> Item, Item1
graphics = MaterialGraphics(
    Material=simplify(graft(material)),
    Color=item_9.Item,
    Transparency=item_9.Item1,
    ForegroundPatternCutPatterns=<geometry referenced from the Revit model>)  # -> Material, UseRenderAppearance, Color, Transparency, SurfacePatternsForegroundPattern, SurfacePatternsForegroundColor, CutPatternsForegroundPattern, CutPatternsForegroundColor; disabled

panel_38 = Panel(python.Pvalue)
