# Grasshopper definition units_detail_Paula.gh (Grasshopper 1.0.7)
# plug-ins: Speckle 2, treesloth01, Human, Pufferfish, eleFront

# https://macad.speckle.xyz/streams/4975f9f0a8/commits/9ec35295b2
mesh = Mesh()  # disabled

# ----
# https://macad.speckle.xyz/streams/0f1c84ad9c/commits/c4616ae012
dso = DeconstructSpeckleObject(selectedKitName="Objects")  # -> DisplayStyle, Elements
dso_2 = DeconstructSpeckleObject(SpeckleObject=dso.Elements, selectedKitName="Objects")
dso_3 = DeconstructSpeckleObject(SpeckleObject=dso.DisplayStyle, selectedKitName="Objects")

dso_4 = DeconstructSpeckleObject(selectedKitName="Objects")
reflay = ReferenceByLayer(LayerName="UnitsRawVolumes", lightweight=False)

volume = Volume(Geometry=reflay)  # -> Volume, Centroid
int = Integer(volume.Volume)
cset = CreateSet(List=int)  # -> Set, Map
cset_2 = CreateSet(List=cset.Map)  # -> Set, Map
mindex = MemberIndex(Set=cset.Map, Member=cset_2.Set)  # -> Index, Count
item = ListItem(List=reflay, Index=mindex.Index, Wrap=True)  # -> simplify(Item)
bang = ExplodeTree(Data=item)  # -> Branch0, Branch1

# ----
# HABIT
number_slider = Slider(1.2, range=0..2.02)
number_slider_2 = Slider(1.5, range=1..2)
range = Range(Domain=Slider(1.5, range=0..6.002), Steps=number_slider_2)
range_2 = Range(Domain=Domain(0, 1), Steps=number_slider_2)
graph = GraphMapper(range_2, x0=0, x1=1, y0=0, y1=1, container_name="Bezier", cpx=[0, 0.5185281634, 1, 1], cpy=[0, 0, 0.1436586976, 1])
pt = ConstructPoint(XCoordinate=0, YCoordinate=0, ZCoordinate=range)
dom = ConstructDomain(DomainStart=Slider(3.9, range=1..13), DomainEnd=number_slider)
bnd = Bounds(Numbers=graph)
prot = RotatePlane(Plane=pt, Angle="0.5*pi")
remap = RemapNumbers(Value=graph, Source=bnd, Target=dom)  # -> Mapped, Clipped
number_slider_3 = Slider(0.01, range=0..1)
cir = Circle(Plane=prot, Radius=remap.Mapped)
item_2 = ListItem(List=cir, Index=0, Wrap=True)
area = Area(Geometry=item_2)  # -> Area, Centroid
range_3 = Range(Domain=Domain(0, 1), Steps=Slider(8, range=0..50))
subtraction = Subtraction(A="1", B=number_slider_3)
merge = Merge(Data1="0", Data2=number_slider_3, Data3=subtraction, Data4="1")
shatter = Shatter(Curve=reparameterize(graft(cir)), Parameters=range_3)
consec = ConsecutiveDomains(Numbers=merge, Additive=invert(True))
panel = Panel(merge)
subcrv = SubCurve(BaseCurve=reparameterize(graft(shatter)), Domain=consec)
panel_2 = Panel("""0
2""")
panel_3 = Panel(consec)
cull_i = CullIndex(List=subcrv, Indices=panel_2, Wrap=True)  # -> simplify(List)
item_3 = ListItem(List=subcrv, Index=panel_2, Wrap=True)
pshift = ShiftPaths(Data=cull_i, Offset=-1)
flip = FlipMatrix(Data=pshift)
midpt = CurveMiddle(Curve=flip)
loft = Loft(Curves=cir, Options={Adjust=False, Closed=False, LoftEnds=0, LoftSimp=0, LoftType=0, Rebuild=10, Refit=0.01})
pshift_2 = ShiftPaths(Data=item_3, Offset=-1)
graph_2 = GraphMapper(range_2, x0=0, x1=1, y0=0, y1=1, container_name="Bezier", cpx=[0, 0.25, 0.75, 1], cpy=[0, 0.25, 0.75, 1])
join = JoinCurves(Curves=pshift_2, Preserve=False)
brep_cp = BrepClosestPoint(Point=midpt, Brep=loft)  # -> Point, Normal, Distance
dom_2 = ConstructDomain(DomainStart=Slider(0.1, range=0..10), DomainEnd=Slider(0.11, range=0..1))
flip_2 = FlipMatrix(Data=join)
bnd_2 = Bounds(Numbers=graph_2)
remap_2 = RemapNumbers(Value=graph_2, Source=bnd_2, Target=dom_2)  # -> Mapped, Clipped
amp = Amplitude(Vector=brep_cp.Normal, Amplitude=remap_2.Mapped)
rev = Reverse(Vector=amp)
end = EndPoints(Curve=flip)  # -> Start, End
move = Move(Geometry=midpt, Motion=rev)  # -> Geometry, Transform
arc = Arc3Pt(PointA=end.Start, PointB=move.Geometry, PointC=end.End)  # -> Arc, Plane, Radius; disabled
item_4 = ListItem(List=arc.Arc, Index=0, Wrap=True)  # disabled
project = Project(Geometry=item_4, Plane=PlaneXY(0, 0, 0))  # -> Geometry, Transform; disabled
panel_4 = Panel("0")  # disabled
panel_5 = Panel("0.01")  # disabled
replace = ReplaceItems(List=arc.Arc, Item=project.Geometry, Indices=panel_4, Wrap=False)  # disabled
loft_opt = LoftOptions(Closed=False, Adjust=False, Rebuild=0, Refit=panel_5, Type=0)  # disabled

area_2 = Area(Geometry=bang.Branch1)  # -> Area, Centroid
prox = Proximity3D(Points=area_2.Centroid, Group="1", MaxRadius="5")  # -> simplify(Links), Topology
clean = CleanTree(RemoveNulls=True, RemoveInvalid=True, RemoveEmpty=True, Tree=prox.Links)
tstat = TreeStatistics(Tree=clean)  # -> Paths, Length, Count
split = SplitTree(Data=simplify(graft(bang.Branch1)), Masks=flatten(tstat.Paths))  # -> flatten(Positive), flatten(Negative)

# ----
# BUFFER
number_slider_4 = Slider(1.2, range=0..2.02)
number_slider_5 = Slider(1.5, range=1..2)
range_4 = Range(Domain=Slider(3.7, range=0..6.002), Steps=number_slider_5)
range_5 = Range(Domain=Domain(0, 1), Steps=number_slider_5)
graph_3 = GraphMapper(range_5, x0=0, x1=1, y0=0, y1=1, container_name="Bezier", cpx=[0, 0.5185281634, 1, 1], cpy=[0, 0, 0.1436586976, 1])
pt_2 = ConstructPoint(XCoordinate=0, YCoordinate=0, ZCoordinate=range_4)
dom_3 = ConstructDomain(DomainStart=Slider(4.2, range=1..13), DomainEnd=number_slider_4)
bnd_3 = Bounds(Numbers=graph_3)
prot_2 = RotatePlane(Plane=pt_2, Angle="0.5*pi")
remap_3 = RemapNumbers(Value=graph_3, Source=bnd_3, Target=dom_3)  # -> Mapped, Clipped
cir_2 = Circle(Plane=prot_2, Radius=remap_3.Mapped)
item_5 = ListItem(List=cir_2, Index=0, Wrap=True)
area_3 = Area(Geometry=item_5)  # -> Area, Centroid
number_slider_6 = Slider(0.01, range=0..1)
range_6 = Range(Domain=Domain(0, 1), Steps=Slider(8, range=0..50))
shatter_2 = Shatter(Curve=reparameterize(graft(cir_2)), Parameters=range_6)
subtraction_2 = Subtraction(A="1", B=number_slider_6)
merge_2 = Merge(Data1="0", Data2=number_slider_6, Data3=subtraction_2, Data4="1")
consec_2 = ConsecutiveDomains(Numbers=merge_2, Additive=invert(True))
panel_6 = Panel(merge_2)
subcrv_2 = SubCurve(BaseCurve=reparameterize(graft(shatter_2)), Domain=consec_2)
panel_7 = Panel("""0
2""")
panel_8 = Panel(consec_2)
cull_i_2 = CullIndex(List=subcrv_2, Indices=panel_7, Wrap=True)  # -> simplify(List)
item_6 = ListItem(List=subcrv_2, Index=panel_7, Wrap=True)
pshift_3 = ShiftPaths(Data=cull_i_2, Offset=-1)
flip_3 = FlipMatrix(Data=pshift_3)
midpt_2 = CurveMiddle(Curve=flip_3)
loft_2 = Loft(Curves=cir_2, Options={Adjust=False, Closed=False, LoftEnds=0, LoftSimp=0, LoftType=0, Rebuild=10, Refit=0.01})
pshift_4 = ShiftPaths(Data=item_6, Offset=-1)
graph_4 = GraphMapper(range_5, x0=0, x1=1, y0=0, y1=1, container_name="Bezier", cpx=[0, 0.25, 0.75, 1], cpy=[0, 0.25, 0.75, 1])
join_2 = JoinCurves(Curves=pshift_4, Preserve=False)
brep_cp_2 = BrepClosestPoint(Point=midpt_2, Brep=loft_2)  # -> Point, Normal, Distance
dom_4 = ConstructDomain(DomainStart=Slider(0.1, range=0..10), DomainEnd=Slider(0.11, range=0..1))
flip_4 = FlipMatrix(Data=join_2)
bnd_4 = Bounds(Numbers=graph_4)
remap_4 = RemapNumbers(Value=graph_4, Source=bnd_4, Target=dom_4)  # -> Mapped, Clipped
amp_2 = Amplitude(Vector=brep_cp_2.Normal, Amplitude=remap_4.Mapped)
rev_2 = Reverse(Vector=amp_2)
end_2 = EndPoints(Curve=flip_3)  # -> Start, End
move_2 = Move(Geometry=midpt_2, Motion=rev_2)  # -> Geometry, Transform
arc_2 = Arc3Pt(PointA=end_2.Start, PointB=move_2.Geometry, PointC=end_2.End)  # -> Arc, Plane, Radius
item_7 = ListItem(List=arc_2.Arc, Index=0, Wrap=True)
project_2 = Project(Geometry=item_7, Plane=PlaneXY(0, 0, 0))  # -> Geometry, Transform
loft_opt_2 = LoftOptions(Closed=False, Adjust=False, Rebuild=0, Refit="0.01", Type=0)
replace_2 = ReplaceItems(List=arc_2.Arc, Item=project_2.Geometry, Indices="0", Wrap=False)
loft_3 = Loft(Curves=flip_4, Options=loft_opt_2)
loft_4 = Loft(Curves=replace_2, Options=loft_opt_2)

item_8 = ListItem(List=bang.Branch0, Index=0, Wrap=True)
item_9 = ListItem(List=split.Negative, Index=0, Wrap=True)

renumber = RenumberPaths(Data=clean)
end_3 = EndPoints(Curve=renumber)  # -> Start, End
pdecon = Deconstruct(Point=[end_3.Start, end_3.End])  # -> XComponent, YComponent, ZComponent
int_2 = Integer(pdecon.ZComponent)
bnd_5 = Bounds(Numbers=int_2)
dedomain = DeconstructDomain(Domain=bnd_5)  # -> Start, End
equals = Equality(FirstNumber=int_2, SecondNumber=dedomain.Start)  # -> Equality, Inequality
subtraction_3 = Subtraction(A=dedomain.Start, B=dedomain.End)
cull = CullPattern(List=[end_3.Start, end_3.End], CullPattern=equals.Equality)
division = Division(A=subtraction_3, B="2")
abs = Absolute(Value=subtraction_3)
Z = UnitZ(Factor=division)
wires = BrepWireframe(Brep=split.Positive, Density=-1)
move_3 = Move(Geometry=cull, Motion=Z)  # -> Geometry, Transform
project_3 = Project(Geometry=wires, Plane=move_3.Geometry)  # -> simplify(Geometry), Transform

loft_5 = Loft(Curves=replace, Options=loft_opt)  # disabled
loft_6 = Loft(Curves=flip_2, Options=loft_opt)  # disabled

end_4 = EndPoints(Curve=project_3.Geometry)  # -> Start, End
multiplication = Multiplication(A=abs, B="2")
cullpt = CullDuplicates(Points=[end_4.Start, end_4.End], Tolerance=0.1, CullMode=3)  # -> Points, Indices, Valence
pline = PolyLine(Vertices=cullpt.Points, Closed=True)  # -> simplify(Polyline)
Z_2 = UnitZ(Factor=multiplication)
extr = Extrude(Base=pline, Direction=Z_2)
cap = CapHoles(Brep=extr)

panel_9 = Panel("-1")  # disabled
item_10 = ListItem(List=end.End, Index=0, Wrap=True)  # -> flatten(Item); disabled
item_11 = ListItem(List=cir, Index=panel_9, Wrap=True)  # disabled
crv_cp = CurveClosestPoint(Point=item_10, Curve=item_11)  # -> flatten(Point), Parameter, Distance; disabled
number_slider_7 = Slider(0.1, range=0..0.1)  # disabled
avr = Average(Input=crv_cp.Point)  # disabled
vec2pt = Vector2Pt(PointA=avr, PointB=crv_cp.Point, Unitize=False)  # -> Vector, Length; disabled
amp_3 = Amplitude(Vector=vec2pt.Vector, Amplitude=number_slider_7)  # disabled
move_4 = Move(Geometry=crv_cp.Point, Motion=amp_3)  # -> Geometry, Transform; disabled
ln = Line(StartPoint=crv_cp.Point, EndPoint=move_4.Geometry)  # disabled

item_12 = ListItem(List=end_2.End, Index=0, Wrap=True)  # -> flatten(Item)
item_13 = ListItem(List=cir_2, Index="-1", Wrap=True)
crv_cp_2 = CurveClosestPoint(Point=item_12, Curve=item_13)  # -> flatten(Point), Parameter, Distance
avr_2 = Average(Input=crv_cp_2.Point)
vec2pt_2 = Vector2Pt(PointA=avr_2, PointB=crv_cp_2.Point, Unitize=False)  # -> Vector, Length
amp_4 = Amplitude(Vector=vec2pt_2.Vector, Amplitude=Slider(0.1, range=0..0.1))
move_5 = Move(Geometry=crv_cp_2.Point, Motion=amp_4)  # -> Geometry, Transform
ln_2 = Line(StartPoint=crv_cp_2.Point, EndPoint=move_5.Geometry)

debrep = DeconstructBrep(Brep=loft_5)  # -> Faces, Edges, Vertices; disabled
midpt_3 = CurveMiddle(Curve=debrep.Edges)  # disabled
pdecon_2 = Deconstruct(Point=midpt_3)  # -> XComponent, YComponent, ZComponent; disabled
panel_10 = Panel("0.1")  # disabled
smaller = SmallerThan(FirstNumber=pdecon_2.ZComponent, SecondNumber=panel_10)  # -> SmallerThan, OrEqualTo; disabled
cull_2 = CullPattern(List=midpt_3, CullPattern=smaller.SmallerThan)  # disabled
flatten = FlattenTree(Tree=cull_2, Path="{0}")  # disabled

debrep_2 = DeconstructBrep(Brep=loft_4)  # -> Faces, Edges, Vertices
midpt_4 = CurveMiddle(Curve=debrep_2.Edges)
pdecon_3 = Deconstruct(Point=midpt_4)  # -> XComponent, YComponent, ZComponent
smaller_2 = SmallerThan(FirstNumber=pdecon_3.ZComponent, SecondNumber="0.1")  # -> SmallerThan, OrEqualTo
cull_3 = CullPattern(List=midpt_4, CullPattern=smaller_2.SmallerThan)
flatten_2 = FlattenTree(Tree=cull_3, Path="{0}")

srf = Surface(flatten(loft_4))

# ----
# FLOOR DOWN
avr_3 = Average(Input=item_12)
neg = Negative(Value=Slider(2.5, range=0..5))
Z_3 = UnitZ(Factor=neg)
move_6 = Move(Geometry=avr_3, Motion=Z_3)  # -> Geometry, Transform
ln_3 = Line(StartPoint=move_6.Geometry, EndPoint=avr_3)
circle = CircleCNR(Center=move_6.Geometry, Normal=Vector(0, 0, 1), Radius=Slider(5, range=0..10))
boundary = BoundarySurfaces(Edges=circle)
mirror = Mirror(Geometry=srf, Plane=avr_3)  # -> Geometry, Transform
bbx = BrepBrep(BrepA=mirror.Geometry, BrepB=boundary)  # -> Curves, Points
end_5 = EndPoints(Curve=bbx.Curves)  # -> flatten(Start), End
pline_2 = PolyLine(Vertices=end_5.Start, Closed=True)
offset = OffsetCurve(Curve=pline_2, Distance="-0.1", Corners=1)
boundary_2 = BoundarySurfaces(Edges=offset)
Z_4 = UnitZ(Factor=Slider(0.05, range=0.05..0.1))
extr_2 = Extrude(Base=boundary_2, Direction=Z_4)

# ----
# CEILING
number_slider_8 = Slider(0.5, range=0..5)
neg_2 = Negative(Value=number_slider_8)
Z_5 = UnitZ(Factor=neg_2)
move_7 = Move(Geometry=avr_2, Motion=Z_5)  # -> Geometry, Transform
ln_4 = Line(StartPoint=move_7.Geometry, EndPoint=avr_2)
circle_2 = CircleCNR(Center=move_7.Geometry, Normal=Vector(0, 0, 1), Radius=Slider(5, range=0..10))
boundary_3 = BoundarySurfaces(Edges=circle_2)
bbx_2 = BrepBrep(BrepA=srf, BrepB=boundary_3)  # -> Curves, Points
number_slider_9 = Slider(0.14, range=0..0.2)
end_6 = EndPoints(Curve=bbx_2.Curves)  # -> flatten(Start), End
pline_3 = PolyLine(Vertices=end_6.Start, Closed=True)
offset_2 = OffsetCurve(Curve=pline_3, Distance="-0.1", Corners=1)
Y = UnitY(Factor=1)
boundary_4 = BoundarySurfaces(Edges=offset_2)
X = UnitX(Factor=1)
number_slider_10 = Slider(0.02, range=0..0.1)
contour = Contour(Shape=boundary_4, Point=Point(0, 0, 0), Direction=Y, Distance=number_slider_9)
contour_2 = Contour(Shape=boundary_4, Point=Point(0, 0, 0), Direction=X, Distance=number_slider_9)
Z_6 = UnitZ(Factor=number_slider_10)
neg_3 = Negative(Value=Z_6)
move_8 = Move(Geometry=contour, Motion=neg_3)  # -> Geometry, Transform
pipe = Pipe(Curve=contour_2, Radius=number_slider_10, Caps=0)
pipe_2 = Pipe(Curve=move_8.Geometry, Radius=number_slider_10, Caps=0)
merge_3 = Merge(Data1=pipe_2, Data2=pipe)

# ----
# FLOOR UP
number_slider_11 = Slider(0, range=0..5)
neg_4 = Negative(Value=number_slider_11)
Z_7 = UnitZ(Factor=neg_4)
move_9 = Move(Geometry=avr_3, Motion=Z_7)  # -> Geometry, Transform
ln_5 = Line(StartPoint=move_9.Geometry, EndPoint=avr_3)
circle_3 = CircleCNR(Center=move_9.Geometry, Normal=Vector(0, 0, 1), Radius=Slider(5, range=0..10))
boundary_5 = BoundarySurfaces(Edges=circle_3)
mirror_2 = Mirror(Geometry=srf, Plane=avr_3)  # -> Geometry, Transform
bbx_3 = BrepBrep(BrepA=mirror_2.Geometry, BrepB=boundary_5)  # -> Curves, Points
end_7 = EndPoints(Curve=bbx_3.Curves)  # -> flatten(Start), End
pline_4 = PolyLine(Vertices=end_7.Start, Closed=True)
offset_3 = OffsetCurve(Curve=pline_4, Distance="-0.1", Corners=1)
boundary_6 = BoundarySurfaces(Edges=offset_3)
Z_8 = UnitZ(Factor=Slider(0.05, range=0.05..0.1))
area_4 = Area(Geometry=boundary_6)  # -> Area, Centroid
cir_3 = Circle(Plane=area_4.Centroid, Radius=Slider(0.9, range=0..1))
rdiff = RegionDifference(CurvesA=offset_3, CurvesB=cir_3)
boundary_7 = BoundarySurfaces(Edges=rdiff)
extr_3 = Extrude(Base=boundary_7, Direction=Z_8)

avr_4 = Average(Input=flatten(flatten))  # disabled

number_slider_12 = Slider(0.05, range=0..0.1)  # disabled
offcrv = OffsetCurve(Curve=item_11, Plane=PlaneXY(0, 0, 0), Distance=number_slider_12, BothSides=0, Kinks=0, CapType=1)  # disabled
merge_4 = Merge(Data1=offcrv, Data2=item_11)  # -> flatten(Result); disabled
loft_7 = Loft(Curves=merge_4, Options={Adjust=False, Closed=False, LoftEnds=0, LoftSimp=0, LoftType=0, Rebuild=10, Refit=0.01})  # disabled
number_slider_13 = Slider(0.2, range=0..0.2)  # disabled
number_slider_14 = Slider(0.05, range=0..0.1)  # disabled
panel_11 = Panel("-0.5")  # disabled
Z_9 = UnitZ(Factor=number_slider_13)  # disabled
multiplication_2 = Multiplication(A=number_slider_13, B=panel_11)  # disabled
extr_4 = Extrude(Base=loft_7, Direction=Z_9)  # disabled
Z_10 = UnitZ(Factor=multiplication_2)  # disabled

panel_12 = Panel("1")  # disabled

panel_13 = Panel("""0
3""")  # disabled
item_14 = ListItem(List=flatten, Index=panel_13, Wrap=True)  # disabled
ln_6 = Line(StartPoint=avr_4, EndPoint=item_14)  # disabled
panel_14 = Panel("0.5")  # disabled
panel_15 = Panel("0")  # disabled
panel_16 = Panel("1")  # disabled
panel_17 = Panel("0")  # disabled
pframe = PerpFrame(Curve=simplify(ln_6), Parameter=panel_14)  # -> graft(Frame); disabled
ext = ExtendCurve(Curve=ln_6, Type=panel_17, Start=panel_15, End=panel_16)  # disabled
pipe_3 = Pipe(Curve=ext, Radius=panel_12, Caps=0)  # disabled
number_slider_15 = Slider(0.88, range=0..1)  # disabled
number_slider_16 = Slider(1.1, range=0..1.1)  # disabled
scale_nu = ScaleNU(Geometry=pipe_3, Plane=pframe, ScaleX=number_slider_16, ScaleY=number_slider_15, ScaleZ=1)  # -> flatten(Geometry), Transform; disabled
cap_2 = CapHoles(Brep=scale_nu.Geometry)  # disabled

offcrv_2 = OffsetCurve(Curve=item_13, Plane=PlaneXY(0, 0, 0), Distance=Slider(0.05, range=0..0.1), BothSides=0, Kinks=0, CapType=1)
merge_5 = Merge(Data1=offcrv_2, Data2=item_13)  # -> flatten(Result)
loft_8 = Loft(Curves=merge_5, Options={Adjust=False, Closed=False, LoftEnds=0, LoftSimp=0, LoftType=0, Rebuild=10, Refit=0.01})
number_slider_17 = Slider(0.2, range=0..0.2)
Z_11 = UnitZ(Factor=number_slider_17)
multiplication_3 = Multiplication(A=number_slider_17, B="-0.5")
extr_5 = Extrude(Base=loft_8, Direction=Z_11)
Z_12 = UnitZ(Factor=multiplication_3)

srf_2 = Surface(flatten(loft_5))  # disabled

# ----
# FLOOR
number_slider_18 = Slider(2.81, range=0..5)  # disabled
neg_5 = Negative(Value=number_slider_18)  # disabled
Z_13 = UnitZ(Factor=neg_5)  # disabled
move_10 = Move(Geometry=avr, Motion=Z_13)  # -> Geometry, Transform; disabled
number_slider_19 = Slider(5, range=0..10)  # disabled
ln_7 = Line(StartPoint=move_10.Geometry, EndPoint=avr)  # disabled
circle_4 = CircleCNR(Center=move_10.Geometry, Normal=Vector(0, 0, 1), Radius=number_slider_19)  # disabled
avr_5 = Average(Input=item_10)  # disabled
boundary_8 = BoundarySurfaces(Edges=circle_4)  # disabled
mirror_3 = Mirror(Geometry=srf_2, Plane=avr_5)  # -> Geometry, Transform; disabled
bbx_4 = BrepBrep(BrepA=mirror_3.Geometry, BrepB=boundary_8)  # -> Curves, Points; disabled
end_8 = EndPoints(Curve=bbx_4.Curves)  # -> flatten(Start), End; disabled
pline_5 = PolyLine(Vertices=end_8.Start, Closed=True)  # disabled
panel_18 = Panel("-0.1")  # disabled
number_slider_20 = Slider(0.05, range=0.05..0.1)  # disabled
offset_4 = OffsetCurve(Curve=pline_5, Distance=panel_18, Corners=1)  # disabled
boundary_9 = BoundarySurfaces(Edges=offset_4)  # disabled
Z_14 = UnitZ(Factor=number_slider_20)  # disabled

# ----
# CEILING
number_slider_21 = Slider(0.15, range=0..5)  # disabled
neg_6 = Negative(Value=number_slider_21)  # disabled
Z_15 = UnitZ(Factor=neg_6)  # disabled
number_slider_22 = Slider(5, range=0..10)  # disabled
move_11 = Move(Geometry=avr, Motion=Z_15)  # -> Geometry, Transform; disabled
ln_8 = Line(StartPoint=move_11.Geometry, EndPoint=avr)  # disabled
circle_5 = CircleCNR(Center=move_11.Geometry, Normal=Vector(0, 0, 1), Radius=number_slider_22)  # disabled
boundary_10 = BoundarySurfaces(Edges=circle_5)  # disabled
bbx_5 = BrepBrep(BrepA=srf_2, BrepB=boundary_10)  # -> Curves, Points; disabled
end_9 = EndPoints(Curve=bbx_5.Curves)  # -> flatten(Start), End; disabled
number_slider_23 = Slider(0.14, range=0..0.2)  # disabled
panel_19 = Panel("-0.1")  # disabled
pline_6 = PolyLine(Vertices=end_9.Start, Closed=True)  # disabled
offset_5 = OffsetCurve(Curve=pline_6, Distance=panel_19, Corners=1)  # disabled
Y_2 = UnitY(Factor=1)  # disabled
boundary_11 = BoundarySurfaces(Edges=offset_5)  # disabled
X_2 = UnitX(Factor=1)  # disabled
contour_3 = Contour(Shape=boundary_11, Point=Point(0, 0, 0), Direction=Y_2, Distance=number_slider_23)  # disabled
contour_4 = Contour(Shape=boundary_11, Point=Point(0, 0, 0), Direction=X_2, Distance=number_slider_23)  # disabled
number_slider_24 = Slider(0.02, range=0..0.1)  # disabled
Z_16 = UnitZ(Factor=number_slider_24)  # disabled
neg_7 = Negative(Value=Z_16)  # disabled
move_12 = Move(Geometry=contour_3, Motion=neg_7)  # -> Geometry, Transform; disabled
pipe_4 = Pipe(Curve=move_12.Geometry, Radius=number_slider_24, Caps=0)  # disabled
pipe_5 = Pipe(Curve=contour_4, Radius=number_slider_24, Caps=0)  # disabled

avr_6 = Average(Input=flatten(flatten_2))
srf_3 = Surface(flatten(loft_4))
addition = Addition(A=neg, B="1")
Z_17 = UnitZ(Factor=addition)
neg_8 = Negative(Value=Z_17)
amp_5 = Amplitude(Vector=neg_8, Amplitude=Slider(1.3, range=1..1.5))
move_13 = Move(Geometry=avr_6, Motion=amp_5)  # -> Geometry, Transform
number_slider_25 = Slider(3, range=0..10)  # disabled
bbx_6 = BrepBrep(BrepA=cap_2, BrepB=srf_2)  # -> Curves, Points; disabled
mirror_4 = Mirror(Geometry=bbx_6.Curves, Plane=avr_5)  # -> Geometry, Transform; disabled
number_slider_26 = Slider(0.05, range=0..0.1)  # disabled
number_slider_27 = Slider(0.05, range=0..0.1)  # disabled
join_3 = JoinCurves(Curves=flatten([mirror_4.Geometry, bbx_6.Curves]), Preserve=False)  # -> graft(Curves); disabled
number_slider_28 = Slider(2, range=0..10)  # disabled
bang_2 = ExplodeTree(Data=join_3)  # -> Branch0, Branch1; disabled
srf_4 = Surface(loft_3)
number_slider_29 = Slider(0.05, range=0..0.1)
crv = Curve(bang_2.Branch0)  # disabled
divide = DivideCurve(Curve=crv, Count=number_slider_28, Kinks=False)  # -> Points, Tangents, Parameters; disabled
panel_20 = Panel("5")  # disabled
mirror_5 = Mirror(Geometry=loft_3, Plane=avr_3)  # -> Geometry, Transform
item_15 = ListItem(List=divide.Points, Index=0, Wrap=True)  # -> Item, Item1; disabled
Z_18 = UnitZ(Factor=panel_20)  # disabled
pipe_6 = Pipe(Curve=ln_2, Radius=Slider(0.05, range=0..0.1), Caps=0)
move_14 = Move(Geometry=extr_5, Motion=Z_12)  # -> Geometry, Transform
brep = Brep(item_9)  # disabled
ln_9 = Line(StartPoint=item_15.Item, EndPoint=item_15.Item1)  # disabled
# Layers
offsrf = OffsetSurface(Surface=srf_4, Distance=number_slider_29, BothSides=0, CreateSolid=True)
volume_2 = Volume(Geometry=brep)  # -> Volume, Centroid; disabled
offsrf_2 = OffsetSurface(Surface=mirror_5.Geometry, Distance=number_slider_29, BothSides=0, CreateSolid=True)
move_15 = Move(Geometry=ln_9, Motion=Z_18)  # -> Geometry, Transform; disabled

# ---- group: upper floor
brep_2 = Brep(extr_3)

# ---- group: Lower floor
brep_3 = Brep(extr_2)

# ----
number_slider_30 = Slider(3, range=0..10)  # disabled
number_slider_31 = Slider(3, range=0..10)  # disabled
midpt_5 = CurveMiddle(Curve=move_15.Geometry)  # disabled
lnpt = LinePt(Line=ln_9, Point=midpt_5)  # disabled
pln = Plane(lnpt)  # disabled
vec = Vector(pln)  # disabled

# ---- group: ceiling structure
brep_4 = Brep(merge_3)

# ---- group: outer ring
brep_5 = Brep(move_14.Geometry)

# ---- group: Structure lower
brep_6 = Brep(offsrf_2)

# ---- group: structure upper
brep_7 = Brep(offsrf)

# ---- group: outer ring parts
brep_8 = Brep(pipe_6)

# ----
amp_6 = Amplitude(Vector=vec, Amplitude=number_slider_31)  # disabled
mirror_6 = Mirror(Geometry=crv, Plane=pln)  # -> Geometry, Transform; disabled
amp_7 = Amplitude(Vector=vec, Amplitude=number_slider_30)  # disabled
vdis = VectorDisplay(Anchor=pln, Vector=vec)  # disabled
move_16 = Move(Geometry=mirror_6.Geometry, Motion=amp_7)  # -> Geometry, Transform; disabled
merge_6 = Merge(Data1=flatten(brep_5), Data2=flatten(brep_8))

# ---- group: structure
entwine = Entwine(Branch00=flatten(brep_6), Branch01=flatten(brep_7), FlattenInputs=True)  # -> flatten(Result)

# ---- group: Floors
entwine_2 = Entwine(Branch00=flatten(brep_2), Branch01=flatten(brep_3), FlattenInputs=True)  # -> flatten(Result)

# ----
Z_19 = UnitZ(Factor="3.2")
loft_9 = Loft(
    Curves=flatten([move_16.Geometry, crv]),
    Options={Adjust=False, Closed=False, LoftEnds=0, LoftSimp=0, LoftType=0, Rebuild=10, Refit=0.01})  # disabled

# ---- group: ceiling structure
brep_9 = Brep(flatten(brep_4))

# ----
area_5 = Area(Geometry=loft_9)  # -> Area, Centroid; disabled
move_17 = Move(Geometry=entwine, Motion=Z_19)  # -> Geometry, Transform
move_18 = Move(Geometry=brep_9, Motion=Z_19)  # -> Geometry, Transform
move_19 = Move(Geometry=entwine_2, Motion=Z_19)  # -> Geometry, Transform
orient = Orient(Geometry=pln, Source=PlaneXY(0, 0, 0), Target=area_5.Centroid)  # -> Geometry, Transform; disabled
box = CenterBox(Base=orient.Geometry, X=1, Y=1, Z=1)  # disabled

# ---- group: Bake Object to its layers
button = Button()

# ----
# LAYER AND SUBLAYER ACCESS/NAME
panel_21 = Panel("Units_Buffer::")

panel_22 = Panel("https://macad.speckle.xyz/streams/5e4e4e4563/branches/24.02.27-class")  # disabled

number_slider_32 = Slider(148, range=0..400)
layer_name = Panel("CeilingStructure")
material_name = Panel("Steel")
rgb = ColourRGB(Alpha=Slider(0.697, range=0..1), Red=number_slider_32, Green=number_slider_32, Blue=number_slider_32)
concat = Concatenate(FragmentC=panel_21, FragmentA="buffer", FragmentB=layer_name)
lng = ListLength(List=move_18.Geometry)
layer_baking_location = Panel(concat)
dup = DuplicateData(Data=material_name, Number=lng, Order=True)
dup_2 = DuplicateData(Data=concat, Number=lng, Order=True)
dup_3 = DuplicateData(Data=rgb, Number=lng, Order=True)
ef_layer = EleFrontLayer(Layer=dup_2, DisplayColour=dup_3, MaterialName=dup)  # -> Layer, FullPath, Hidden, Locked, DisplayColour, MaterialName, Linetype, PrintColour, PrintWidth
ef_att = EleFrontAttributes(Layer=dup_2, ColourSource=ef_layer.DisplayColour, MaterialName=ef_layer.MaterialName, PrintColour=ef_layer.PrintColour)  # -> Attributes, Keys, Values, Name, Layer, ColourSource, DisplayColour, MaterialSource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
bklay = BakeLayers(Layers=ef_layer.Layer, Bake=button)
bake = BakeObjects(Geometry=move_18.Geometry, Attributes=ef_att.Attributes, Bake=button, createGroups=False)  # -> Message, Ghosts

number_slider_33 = Slider(148, range=0..400)
layer_name_2 = Panel("Floors")
material_name_2 = Panel("Steel")
rgb_2 = ColourRGB(Alpha=Slider(0.697, range=0..1), Red=number_slider_33, Green=number_slider_33, Blue=number_slider_33)
concat_2 = Concatenate(FragmentC=panel_21, FragmentA="buffer", FragmentB=layer_name_2)
lng_2 = ListLength(List=move_19.Geometry)
layer_baking_location_2 = Panel(concat_2)
dup_4 = DuplicateData(Data=material_name_2, Number=lng_2, Order=True)
dup_5 = DuplicateData(Data=concat_2, Number=lng_2, Order=True)
dup_6 = DuplicateData(Data=rgb_2, Number=lng_2, Order=True)
ef_layer_2 = EleFrontLayer(Layer=dup_5, DisplayColour=dup_6, MaterialName=dup_4)  # -> Layer, FullPath, Hidden, Locked, DisplayColour, MaterialName, Linetype, PrintColour, PrintWidth
ef_att_2 = EleFrontAttributes(
    Layer=dup_5,
    ColourSource=ef_layer_2.DisplayColour,
    MaterialName=ef_layer_2.MaterialName,
    PrintColour=ef_layer_2.PrintColour)  # -> Attributes, Keys, Values, Name, Layer, ColourSource, DisplayColour, MaterialSource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
bklay_2 = BakeLayers(Layers=ef_layer_2.Layer, Bake=button)
bake_2 = BakeObjects(Geometry=move_19.Geometry, Attributes=ef_att_2.Attributes, Bake=button, createGroups=False)  # -> Message, Ghosts

number_slider_34 = Slider(148, range=0..400)
layer_name_3 = Panel("PrimaryStructure")
material_name_3 = Panel("Steel")
rgb_3 = ColourRGB(Alpha=Slider(0.697, range=0..1), Red=number_slider_34, Green=number_slider_34, Blue=number_slider_34)
concat_3 = Concatenate(FragmentC=panel_21, FragmentA="buffer", FragmentB=layer_name_3)
lng_3 = ListLength(List=move_17.Geometry)
layer_baking_location_3 = Panel(concat_3)
dup_7 = DuplicateData(Data=material_name_3, Number=lng_3, Order=True)
dup_8 = DuplicateData(Data=concat_3, Number=lng_3, Order=True)
dup_9 = DuplicateData(Data=rgb_3, Number=lng_3, Order=True)
ef_layer_3 = EleFrontLayer(Layer=dup_8, DisplayColour=dup_9, MaterialName=dup_7)  # -> Layer, FullPath, Hidden, Locked, DisplayColour, MaterialName, Linetype, PrintColour, PrintWidth
ef_att_3 = EleFrontAttributes(
    Layer=dup_8,
    ColourSource=ef_layer_3.DisplayColour,
    MaterialName=ef_layer_3.MaterialName,
    PrintColour=ef_layer_3.PrintColour)  # -> Attributes, Keys, Values, Name, Layer, ColourSource, DisplayColour, MaterialSource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
bklay_3 = BakeLayers(Layers=ef_layer_3.Layer, Bake=button)
bake_3 = BakeObjects(Geometry=move_17.Geometry, Attributes=ef_att_3.Attributes, Bake=button, createGroups=False)  # -> Message, Ghosts

pt_3 = ConstructPoint(XCoordinate=0, YCoordinate=0, ZCoordinate=0)
# ASSEMBLY PHASE 5
expblock = ExplodeBlock(recursive=False)  # -> Name, Transform, Geometry; disabled
detatt = DetachAttributes(Geometry=expblock.Geometry)  # -> Geometry, Attributes; disabled
volume_3 = Volume(Geometry=detatt.Geometry)  # -> Volume, Centroid; disabled
cset_3 = CreateSet(List=volume_3.Volume)  # -> Set, Map; disabled
cset_4 = CreateSet(List=cset_3.Map)  # -> Set, Map; disabled
mindex_2 = MemberIndex(Set=cset_3.Map, Member=cset_4.Set)  # -> Index, Count; disabled
item_16 = ListItem(List=detatt.Geometry, Index=mindex_2.Index, Wrap=True)  # -> simplify(Item); disabled
bang_3 = ExplodeTree(Data=item_16)  # -> Branch0, Branch1, Branch2; disabled
panel_23 = Panel("Inflatable")  # disabled
panel_24 = Panel("Glass")  # disabled
panel_25 = Panel("Steel")  # disabled

# ---- group: Units_Support
pln_2 = Plane()  # disabled

# ----
sso = BlockDefinition(
    Name=panel_24,
    Geometry=bang_3.Branch0,
    SelectedConstructorName="Objects.Other.BlockDefinition.ctor(System.String,System.Collections.Generic.List`1[Speckle.Core.Models.Base],Objects.Geometry.Point)",
    SelectedTypeName="Objects.Other.BlockDefinition",
    UseSchemaTag=False,
    UserSetSchemaTag=False,
    seed="c3e00cf1e113ee790956")  # disabled
sso_2 = BlockDefinition(
    Name=panel_23,
    Geometry=bang_3.Branch1,
    SelectedConstructorName="Objects.Other.BlockDefinition.ctor(System.String,System.Collections.Generic.List`1[Speckle.Core.Models.Base],Objects.Geometry.Point)",
    SelectedTypeName="Objects.Other.BlockDefinition",
    UseSchemaTag=False,
    UserSetSchemaTag=False,
    seed="a06898b9aae7d5b59163")  # disabled
sso_3 = BlockDefinition(
    Name=panel_25,
    Geometry=bang_3.Branch2,
    SelectedConstructorName="Objects.Other.BlockDefinition.ctor(System.String,System.Collections.Generic.List`1[Speckle.Core.Models.Base],Objects.Geometry.Point)",
    SelectedTypeName="Objects.Other.BlockDefinition",
    UseSchemaTag=False,
    UserSetSchemaTag=False,
    seed="bf22bfac7f0cb1c82614")  # disabled
pt_4 = Point(pln_2)  # disabled
orient_2 = Orient(Source=PlaneXY(0, 0, 0), Target=pt_4)  # -> Geometry, Transform; disabled
sso_4 = BlockInstance(
    BlockDefinition=sso,
    Transform=orient_2.Transform,
    SelectedConstructorName="Objects.Other.BlockInstance.ctor(Objects.Other.BlockDefinition,Objects.Other.Transform)",
    SelectedTypeName="Objects.Other.BlockInstance",
    UseSchemaTag=False,
    UserSetSchemaTag=False,
    seed="b29bcd91531f56f9eb1f")  # disabled
sso_5 = BlockInstance(
    BlockDefinition=sso_2,
    Transform=orient_2.Transform,
    SelectedConstructorName="Objects.Other.BlockInstance.ctor(Objects.Other.BlockDefinition,Objects.Other.Transform)",
    SelectedTypeName="Objects.Other.BlockInstance",
    UseSchemaTag=False,
    UserSetSchemaTag=False,
    seed="6c22e30deca8216941c1")  # disabled
sso_6 = BlockInstance(
    BlockDefinition=sso_3,
    Transform=orient_2.Transform,
    SelectedConstructorName="Objects.Other.BlockInstance.ctor(Objects.Other.BlockDefinition,Objects.Other.Transform)",
    SelectedTypeName="Objects.Other.BlockInstance",
    UseSchemaTag=False,
    UserSetSchemaTag=False,
    seed="f42b875f65374629faa6")  # disabled
phase = Panel("PODS")  # disabled
panel_26 = Panel("INFLATABLES")  # disabled
panel_27 = Panel("STRUCTURE")  # disabled
panel_28 = Panel("STRUCTURE")  # disabled
name = ExtendSpeckleObject(SpeckleObject=sso_4, BIMSCTYPE=panel_27, BIMSCMATERIAL=panel_24, BIMSCPHASE=phase, selectedKitName="Objects")  # disabled
name_2 = ExtendSpeckleObject(SpeckleObject=sso_5, BIMSCTYPE=panel_26, BIMSCMATERIAL=panel_23, BIMSCPHASE=phase, selectedKitName="Objects")  # disabled
name_3 = ExtendSpeckleObject(SpeckleObject=sso_6, BIMSCTYPE=panel_28, BIMSCMATERIAL=panel_25, BIMSCPHASE=phase, selectedKitName="Objects")  # disabled
in = CreateSpeckleObject(Inflatables=name_2, Structure=name_3, Window=name, selectedKitName="Objects")  # disabled
in_2 = CreateSpeckleObject(Units_Buffer=in, selectedKitName="Objects")  # disabled

number_slider_35 = Slider(0.7, range=0..2.02)  # disabled
# SUPPORT
number_slider_36 = Slider(2, range=1..13)  # disabled
number_slider_37 = Slider(1.5, range=0..6.002)  # disabled
number_slider_38 = Slider(1.5, range=1..2)  # disabled
range_7 = Range(Domain=number_slider_37, Steps=number_slider_38)  # disabled
range_8 = Range(Domain=Domain(0, 1), Steps=number_slider_38)  # disabled
graph_5 = GraphMapper(range_8, x0=0, x1=1, y0=0, y1=1, container_name="Bezier", cpx=[0, 0.5185281634, 1, 1], cpy=[0, 0, 0.1436586976, 1])  # disabled
pt_5 = ConstructPoint(XCoordinate=0, YCoordinate=0, ZCoordinate=range_7)  # disabled
panel_29 = Panel("0.5*pi")  # disabled
dom_5 = ConstructDomain(DomainStart=number_slider_36, DomainEnd=number_slider_35)  # disabled
bnd_6 = Bounds(Numbers=graph_5)  # disabled
prot_3 = RotatePlane(Plane=pt_5, Angle=panel_29)  # disabled
remap_5 = RemapNumbers(Value=graph_5, Source=bnd_6, Target=dom_5)  # -> Mapped, Clipped; disabled
cir_4 = Circle(Plane=pt_5, Radius=remap_5.Mapped)  # disabled
item_17 = ListItem(List=cir_4, Index=0, Wrap=True)  # disabled
number_slider_39 = Slider(4, range=0..50)  # disabled
area_6 = Area(Geometry=item_17)  # -> Area, Centroid; disabled
number_slider_40 = Slider(0.01, range=0..1)  # disabled
range_9 = Range(Domain=Domain(0, 1), Steps=number_slider_39)  # disabled
panel_30 = Panel("1")  # disabled
panel_31 = Panel("0")  # disabled
shatter_3 = Shatter(Curve=reparameterize(graft(cir_4)), Parameters=range_9)  # disabled
subtraction_4 = Subtraction(A=panel_30, B=number_slider_40)  # disabled
merge_7 = Merge(Data1=panel_31, Data2=number_slider_40, Data3=subtraction_4, Data4=panel_30)  # disabled
consec_3 = ConsecutiveDomains(Numbers=merge_7, Additive=invert(True))  # disabled
panel_32 = Panel(merge_7)  # disabled
subcrv_3 = SubCurve(BaseCurve=reparameterize(graft(shatter_3)), Domain=consec_3)  # disabled
panel_33 = Panel("""0
2""")  # disabled
panel_34 = Panel(consec_3)  # disabled
cull_i_3 = CullIndex(List=subcrv_3, Indices=panel_33, Wrap=True)  # -> simplify(List); disabled
item_18 = ListItem(List=subcrv_3, Index=panel_33, Wrap=True)  # disabled
pshift_5 = ShiftPaths(Data=cull_i_3, Offset=-1)  # disabled
flip_5 = FlipMatrix(Data=pshift_5)  # disabled
midpt_6 = CurveMiddle(Curve=flip_5)  # disabled
loft_10 = Loft(Curves=cir_4, Options={Adjust=False, Closed=False, LoftEnds=0, LoftSimp=0, LoftType=0, Rebuild=10, Refit=0.01})  # disabled
number_slider_41 = Slider(0.1, range=0..10)  # disabled
number_slider_42 = Slider(0.11, range=0..1)  # disabled
pshift_6 = ShiftPaths(Data=item_18, Offset=-1)  # disabled
graph_6 = GraphMapper(range_8, x0=0, x1=1, y0=0, y1=1, container_name="Bezier", cpx=[0, 0.25, 0.75, 1], cpy=[0, 0.25, 0.75, 1])  # disabled
join_4 = JoinCurves(Curves=pshift_6, Preserve=False)  # disabled
brep_cp_3 = BrepClosestPoint(Point=midpt_6, Brep=loft_10)  # -> Point, Normal, Distance; disabled
dom_6 = ConstructDomain(DomainStart=number_slider_41, DomainEnd=number_slider_42)  # disabled
flip_6 = FlipMatrix(Data=join_4)  # disabled
bnd_7 = Bounds(Numbers=graph_6)  # disabled
remap_6 = RemapNumbers(Value=graph_6, Source=bnd_7, Target=dom_6)  # -> Mapped, Clipped; disabled
amp_8 = Amplitude(Vector=brep_cp_3.Normal, Amplitude=remap_6.Mapped)  # disabled
rev_3 = Reverse(Vector=amp_8)  # disabled
end_10 = EndPoints(Curve=flip_5)  # -> Start, End; disabled
move_20 = Move(Geometry=midpt_6, Motion=rev_3)  # -> Geometry, Transform; disabled
arc_3 = Arc3Pt(PointA=end_10.Start, PointB=move_20.Geometry, PointC=end_10.End)  # -> Arc, Plane, Radius; disabled
item_19 = ListItem(List=arc_3.Arc, Index=0, Wrap=True)  # disabled
project_4 = Project(Geometry=item_19, Plane=PlaneXY(0, 0, 0))  # -> Geometry, Transform; disabled
panel_35 = Panel("0")  # disabled
panel_36 = Panel("0.01")  # disabled
loft_opt_3 = LoftOptions(Closed=False, Adjust=False, Rebuild=0, Refit=panel_36, Type=0)  # disabled
replace_3 = ReplaceItems(List=arc_3.Arc, Item=project_4.Geometry, Indices=panel_35, Wrap=False)  # disabled
loft_11 = Loft(Curves=flip_6, Options=loft_opt_3)  # disabled
loft_12 = Loft(Curves=replace_3, Options=loft_opt_3)  # disabled
entwine_3 = Entwine(Branch00=loft_12, Branch01=loft_11, FlattenInputs=True)  # disabled
number_slider_43 = Slider(0.01, range=0..1)  # disabled
swatch = ColourSwatch(SwatchColor=RGB(255, 255, 255))  # disabled
swatch_2 = ColourSwatch(SwatchColor=RGBA(107, 107, 107, 206))  # disabled
brep_10 = Brep(item_8)  # disabled
merge_8 = Merge(Data1=swatch_2, Data2=swatch)  # -> simplify(graft(Result)); disabled
python = GhPythonScript(S=entwine_3, D=number_slider_43)  # -> simplify(a); inputs S: Brep; disabled
# ---------- python: Python ----------
import rhinoscriptsyntax as rs

a = rs.OffsetSurface(S, D, None, False, True)
# ---------- end python ----------
item_20 = ListItem(List=brep_10, Index=0, Wrap=True)  # disabled
volume_4 = Volume(Geometry=item_20)  # -> Volume, Centroid; disabled
flatten_3 = FlattenTree(Tree=python, Path="{0}")  # disabled
move2pt = MoveToPoint(Geometry=flatten_3, PointA=area_6.Centroid, PointB=graft(volume_4.Centroid))  # -> simplify(Moved), Vector, Transform; disabled
lng_4 = ListLength(List=move2pt.Moved)  # disabled
graft = GraftTree(Tree=volume_4.Centroid, IncludeEmptyLists=True, IncludeNullItems=True)  # -> simplify(Tree); disabled
group = Group(Objects=move2pt.Moved)  # disabled
split_2 = SplitList(List=move2pt.Moved, Index=expr("x/2", lng_4))  # -> flatten(ListA), flatten(ListB); disabled
mirror_7 = Mirror(Geometry=group, Plane=graft)  # -> Geometry, Transform; disabled
ungroup = Ungroup(Group=mirror_7.Geometry)  # disabled
entwine_4 = Entwine(Branch00=split_2.ListA, Branch01=split_2.ListB, FlattenInputs=True)  # -> simplify(Result); disabled
split_3 = SplitList(List=ungroup, Index=expr("x/2", lng_4))  # -> flatten(ListA), flatten(ListB); disabled
entwine_5 = Entwine(Branch00=split_3.ListA, Branch01=split_3.ListB, FlattenInputs=True)  # -> simplify(Result); disabled
merge_9 = Merge(Data1=entwine_4, Data2=entwine_5)  # disabled
previewmat = CustomPreviewMaterials(Geometry=merge_9, DiffuseColor=RGB(255, 255, 255))  # disabled

number_slider_44 = Slider(0.1, range=0..10)  # disabled
panel_37 = Panel("-1")  # disabled
Z_20 = UnitZ(Factor=expr("-x", number_slider_44))  # disabled
item_21 = ListItem(List=cir_4, Index=panel_37, Wrap=True)  # disabled
extr_6 = Extrude(Base=item_21, Direction=Z_20)  # disabled
cap_3 = CapHoles(Brep=extr_6)  # disabled

move2pt_2 = MoveToPoint(Geometry=cap_3, PointA=area_6.Centroid, PointB=graft(volume_4.Centroid))  # -> Moved, Vector, Transform; disabled
previewmat_2 = CustomPreviewMaterials(Geometry=move2pt_2.Moved, DiffuseColor=RGB(255, 255, 255))  # disabled

merge_10 = Merge(Data5=move2pt_2.Moved, Data6=merge_9)  # disabled
send = Send(
    Stream=panel_22,
    Data=merge_10,
    AutoSend=False,
    BaseId="7005cf4f04ba1d7dde6e5ba4a54a8704",
    CurrentComponentState="expired",
    KitName="Objects",
    OutputWrappers="https://macad.speckle.xyz\t5e4e4e4563\t1905a1a1a6",
    UseDefaultCache=True,
    selectedKitName="Objects")  # disabled
panel_38 = Panel(send)  # disabled

mirror_8 = Mirror(Geometry=loft_4, Plane=avr_6)  # -> Geometry, Transform
debrep_3 = DeconstructBrep(Brep=mirror_8.Geometry)  # -> Faces, Edges, Vertices
midpt_7 = CurveMiddle(Curve=debrep_3.Edges)
pdecon_4 = Deconstruct(Point=midpt_7)  # -> XComponent, YComponent, ZComponent

larger = LargerThan(FirstNumber=pdecon_4.ZComponent, SecondNumber="-0.1")  # -> LargerThan, OrEqualTo

cull_4 = CullPattern(List=midpt_7, CullPattern=larger.LargerThan)
flatten_4 = FlattenTree(Tree=cull_4, Path="{0}")

avr_7 = Average(Input=flatten(flatten_4))
move_21 = Move(Geometry=avr_7, Motion=Z_17)  # -> Geometry, Transform
srf_5 = Surface(flatten(mirror_8.Geometry))

panel_39 = Panel("""1
2""")  # disabled
panel_40 = Panel("0.5")  # disabled
panel_41 = Panel("0")  # disabled
panel_42 = Panel("1")  # disabled
panel_43 = Panel("0")  # disabled
panel_44 = Panel("1")  # disabled

item_22 = ListItem(List=flatten, Index=panel_39, Wrap=True)  # disabled

ln_10 = Line(StartPoint=avr_4, EndPoint=item_22)  # disabled
pframe_2 = PerpFrame(Curve=simplify(ln_10), Parameter=panel_40)  # -> graft(Frame); disabled
ext_2 = ExtendCurve(Curve=ln_10, Type=panel_43, Start=panel_41, End=panel_42)  # disabled
pipe_7 = Pipe(Curve=ext_2, Radius=panel_44, Caps=0)  # disabled
cap_4 = CapHoles(Brep=pipe_7)  # disabled

merge_11 = Merge(Data1=cap_2, Data2=cap_4)  # -> flatten(Result); disabled
splitmul = SplitBrepMultiple(Brep=srf_2, Cutters=merge_11)  # disabled
bbx_7 = BrepBrep(BrepA=cap_4, BrepB=srf_2)  # -> Curves, Points; disabled
area_7 = Area(Geometry=splitmul)  # -> Area, Centroid; disabled
smaller_3 = SmallerThan(FirstNumber=flatten(area_7.Area), SecondNumber=number_slider_25)  # -> SmallerThan, OrEqualTo; disabled

# ----
# Layers
number_slider_45 = Slider(0.05, range=0..0.1)  # disabled
move_22 = Move(Geometry=extr_4, Motion=Z_10)  # -> Geometry, Transform; disabled
pipe_8 = Pipe(Curve=ln, Radius=number_slider_14, Caps=0)  # disabled
number_slider_46 = Slider(0.1, range=0..0.2)  # disabled
number_slider_47 = Slider(0.1, range=0..0.2)  # disabled
extr_7 = Extrude(Base=boundary_9, Direction=Z_14)  # disabled
cull_5 = CullPattern(List=flatten(splitmul), CullPattern=smaller_3.SmallerThan)  # disabled
item_23 = ListItem(List=splitmul, Index=0, Wrap=True)  # disabled
boundary_12 = BoundarySurfaces(Edges=item_11)  # disabled
pipe_9 = Pipe(Curve=bbx_6.Curves, Radius=number_slider_26, Caps=0)  # disabled
pipe_10 = Pipe(Curve=bbx_7.Curves, Radius=number_slider_27, Caps=0)  # disabled
merge_12 = Merge(Data1=pipe_4, Data2=pipe_5)  # disabled
srf_6 = Surface(loft_6)  # disabled
offsrf_3 = OffsetSurface(Surface=srf_6, Distance=number_slider_45, BothSides=0, CreateSolid=True)  # disabled
offset_6 = OffsetSurface(Surface=item_23, Distance=number_slider_47, Retrim=True)  # disabled
offset_7 = OffsetSurface(Surface=offset_6, Distance=number_slider_46, Retrim=True)  # disabled

entwine_6 = Entwine(
    Branch00=extr_7,
    Branch01=merge_12,
    Branch02=cull_5,
    Branch03=pipe_9,
    Branch04=pipe_10,
    Branch05=boundary_12,
    Branch06=move_22.Geometry,
    Branch07=pipe_8,
    Branch08=offsrf_3,
    FlattenInputs=True)  # disabled

# ----
# LOWER HALF
panel_45 = Panel("""1
2""")
item_24 = ListItem(List=flatten_4, Index=panel_45, Wrap=True)

move_23 = Move(Geometry=item_24, Motion=Z_17)  # -> Geometry, Transform

ln_11 = Line(StartPoint=move_21.Geometry, EndPoint=move_23.Geometry)
pframe_3 = PerpFrame(Curve=simplify(ln_11), Parameter="0.5")  # -> graft(Frame)
ext_3 = ExtendCurve(Curve=ln_11, Type="0", Start="0", End="1")
pipe_11 = Pipe(Curve=ext_3, Radius="1", Caps=0)
cap_5 = CapHoles(Brep=pipe_11)

bbx_8 = BrepBrep(BrepA=cap_5, BrepB=srf_5)  # -> Curves, Points
pipe_12 = Pipe(Curve=bbx_8.Curves, Radius=Slider(0.05, range=0..0.1), Caps=0)

# ---- group: w frame
brep_11 = Brep(pipe_12)

# ----
panel_46 = Panel("""0
3""")
item_25 = ListItem(List=flatten_4, Index=panel_46, Wrap=True)

move_24 = Move(Geometry=item_25, Motion=Z_17)  # -> Geometry, Transform

ln_12 = Line(StartPoint=move_24.Geometry, EndPoint=move_21.Geometry)
pframe_4 = PerpFrame(Curve=simplify(ln_12), Parameter="0.5")  # -> graft(Frame)
ext_4 = ExtendCurve(Curve=ln_12, Type="0", Start="1", End="0")
pipe_13 = Pipe(Curve=ext_4, Radius="1", Caps=0)
scale_nu_2 = ScaleNU(Geometry=pipe_13, Plane=pframe_4, ScaleX=Slider(1.1, range=0..1.1), ScaleY=Slider(0.88, range=0..1), ScaleZ=1)  # -> flatten(Geometry), Transform
cap_6 = CapHoles(Brep=scale_nu_2.Geometry)

merge_13 = Merge(Data1=cap_6, Data2=cap_5)  # -> flatten(Result)
bbx_9 = BrepBrep(BrepA=cap_6, BrepB=srf_5)  # -> Curves, Points
splitmul_2 = SplitBrepMultiple(Brep=srf_5, Cutters=merge_13)
area_8 = Area(Geometry=splitmul_2)  # -> Area, Centroid
smaller_4 = SmallerThan(FirstNumber=flatten(area_8.Area), SecondNumber=Slider(6, range=0..10))  # -> SmallerThan, OrEqualTo
cull_6 = CullPattern(List=flatten(splitmul_2), CullPattern=smaller_4.SmallerThan)
item_26 = ListItem(List=splitmul_2, Index=0, Wrap=True)
pipe_14 = Pipe(Curve=bbx_9.Curves, Radius=Slider(0.05, range=0..0.1), Caps=0)
offset_8 = OffsetSurface(Surface=item_26, Distance=Slider(0.1, range=0..0.2), Retrim=True)
# Layers
flip_7 = Flip(Surface=offset_8, Guide=item_26)  # -> Surface, Result
offset_9 = OffsetSurface(Surface=flip_7.Surface, Distance=Slider(0.1, range=0..0.2), Retrim=True)

# ---- group: windows down
brep_12 = Brep(cull_6)

# ---- group: inflatable inner
brep_13 = Brep(offset_9)

# ---- group: inflatable middle
brep_14 = Brep(offset_8)

# ---- group: inflatable outter
brep_15 = Brep(item_26)

# ---- group: w frame circulation
brep_16 = Brep(pipe_14)

# ----
# UPPER HALF
panel_47 = Panel("""1
2""")
item_27 = ListItem(List=flatten_2, Index=panel_47, Wrap=True)

move_25 = Move(Geometry=item_27, Motion=amp_5)  # -> Geometry, Transform

ln_13 = Line(StartPoint=move_25.Geometry, EndPoint=move_13.Geometry)
pframe_5 = PerpFrame(Curve=simplify(ln_13), Parameter="0.5")  # -> graft(Frame)
ext_5 = ExtendCurve(Curve=ln_13, Type="0", Start="1", End="0")
pipe_15 = Pipe(Curve=ext_5, Radius="1", Caps=0)
cap_7 = CapHoles(Brep=pipe_15)

bbx_10 = BrepBrep(BrepA=cap_7, BrepB=srf_3)  # -> Curves, Points
pipe_16 = Pipe(Curve=bbx_10.Curves, Radius=Slider(0.05, range=0..0.1), Caps=0)

# ---- group: w frames inner lower
brep_17 = Brep(pipe_16)

# ----
panel_48 = Panel("""0
3""")
item_28 = ListItem(List=flatten_2, Index=panel_48, Wrap=True)

move_26 = Move(Geometry=item_28, Motion=amp_5)  # -> Geometry, Transform

ln_14 = Line(StartPoint=move_26.Geometry, EndPoint=move_13.Geometry)
pframe_6 = PerpFrame(Curve=simplify(ln_14), Parameter="0.5")  # -> graft(Frame)
ext_6 = ExtendCurve(Curve=ln_14, Type="0", Start="1", End="0")
pipe_17 = Pipe(Curve=ext_6, Radius="1", Caps=0)
scale_nu_3 = ScaleNU(Geometry=pipe_17, Plane=pframe_6, ScaleX=Slider(1.1, range=0..1.1), ScaleY=Slider(0.88, range=0..1), ScaleZ=1)  # -> flatten(Geometry), Transform
cap_8 = CapHoles(Brep=scale_nu_3.Geometry)

merge_14 = Merge(Data1=cap_8, Data2=cap_7)  # -> flatten(Result)
bbx_11 = BrepBrep(BrepA=cap_8, BrepB=srf_3)  # -> Curves, Points
splitmul_3 = SplitBrepMultiple(Brep=srf_3, Cutters=merge_14)
area_9 = Area(Geometry=splitmul_3)  # -> Area, Centroid
smaller_5 = SmallerThan(FirstNumber=flatten(area_9.Area), SecondNumber=Slider(6, range=0..10))  # -> SmallerThan, OrEqualTo
cull_7 = CullPattern(List=flatten(splitmul_3), CullPattern=smaller_5.SmallerThan)
item_29 = ListItem(List=splitmul_3, Index=0, Wrap=True)
pipe_18 = Pipe(Curve=bbx_11.Curves, Radius=Slider(0.05, range=0..0.1), Caps=0)
offset_10 = OffsetSurface(Surface=item_29, Distance=Slider(0.1, range=0..0.2), Retrim=True)
offset_11 = OffsetSurface(Surface=offset_10, Distance=Slider(0.1, range=0..0.2), Retrim=True)

# ---- group: inflatable inner
brep_18 = Brep(offset_11)

# ---- group: w frames outer lower
brep_19 = Brep(pipe_18)

# ---- group: windows upper
brep_20 = Brep(cull_7)

# ---- group: inflatable outter
brep_21 = Brep(item_29)

# ---- group: inflatable middle
brep_22 = Brep(offset_10)

# ---- group: windows
entwine_7 = Entwine(Branch00=flatten(brep_20), Branch01=flatten(brep_12), FlattenInputs=True)  # -> flatten(Result)

# ---- group: inflatable inner
entwine_8 = Entwine(Branch00=flatten(brep_18), Branch01=flatten(brep_13), FlattenInputs=True)  # -> flatten(Result)

# ---- group: inflatable outter
entwine_9 = Entwine(Branch00=flatten(brep_21), Branch01=flatten(brep_15), FlattenInputs=True)  # -> flatten(Result)

# ---- group: inflatable middle
entwine_10 = Entwine(Branch00=flatten(brep_22), Branch01=flatten(brep_14), FlattenInputs=True)  # -> flatten(Result)

# ---- group: Window frames
merge_15 = Merge(Data1=flatten(brep_16), Data2=flatten(brep_11), Data3=flatten(brep_19), Data4=flatten(brep_17), Data5=merge_6)

# ----
move_27 = Move(Geometry=entwine_7, Motion=Z_19)  # -> Geometry, Transform
move_28 = Move(Geometry=entwine_8, Motion=Z_19)  # -> Geometry, Transform
move_29 = Move(Geometry=entwine_9, Motion=Z_19)  # -> Geometry, Transform
move_30 = Move(Geometry=entwine_10, Motion=Z_19)  # -> Geometry, Transform
move_31 = Move(Geometry=merge_15, Motion=Z_19)  # -> Geometry, Transform

entwine_11 = Entwine(
    Branch00=brep_15,
    Branch01=brep_14,
    Branch02=brep_13,
    Branch03=brep_18,
    Branch04=brep_22,
    Branch05=brep_21,
    Branch06=brep_12,
    Branch07=brep_20,
    Branch08=brep_16,
    Branch09=brep_11,
    Branch010=brep_19,
    Branch011=brep_17,
    Branch012=brep_6,
    Branch013=brep_7,
    Branch014=extr_3,
    Branch015=extr_2,
    Branch016=brep_4,
    Branch017=brep_5,
    Branch018=brep_8,
    FlattenInputs=True)  # disabled
swatch_3 = ColourSwatch(SwatchColor=RGB(255, 255, 255))  # disabled
swatch_4 = ColourSwatch(SwatchColor=RGBA(189, 189, 189, 206))  # disabled
brep_23 = Brep(cap)  # disabled
merge_16 = Merge(Data1=swatch_4, Data2=swatch_3)  # -> simplify(graft(Result)); disabled
item_30 = ListItem(List=flatten(brep_23), Index=0, Wrap=True)  # disabled
volume_5 = Volume(Geometry=item_30)  # -> Volume, Centroid; disabled
move2pt_3 = MoveToPoint(Geometry=entwine_11, PointA=area_3.Centroid, PointB=graft(volume_5.Centroid))  # -> simplify(Moved), Vector, Transform; disabled
previewmat_3 = CustomPreviewMaterials(DiffuseColor=RGB(255, 255, 255))  # disabled
previewmat_4 = CustomPreviewMaterials(Geometry=move2pt_3.Moved, DiffuseColor=merge_16)  # disabled

number_slider_48 = Slider(148, range=0..400)
layer_name_4 = Panel("Windows")
material_name_4 = Panel("Pods-Glass")
rgb_4 = ColourRGB(Alpha=Slider(0.697, range=0..1), Red=number_slider_48, Green=number_slider_48, Blue=number_slider_48)
concat_4 = Concatenate(FragmentC=panel_21, FragmentA="buffer", FragmentB=layer_name_4)
lng_5 = ListLength(List=move_27.Geometry)
layer_baking_location_4 = Panel(concat_4)
dup_10 = DuplicateData(Data=material_name_4, Number=lng_5, Order=True)
dup_11 = DuplicateData(Data=concat_4, Number=lng_5, Order=True)
dup_12 = DuplicateData(Data=rgb_4, Number=lng_5, Order=True)
ef_layer_4 = EleFrontLayer(Layer=dup_11, DisplayColour=dup_12, MaterialName=dup_10)  # -> Layer, FullPath, Hidden, Locked, DisplayColour, MaterialName, Linetype, PrintColour, PrintWidth
ef_att_4 = EleFrontAttributes(
    Layer=dup_11,
    ColourSource=ef_layer_4.DisplayColour,
    MaterialName=ef_layer_4.MaterialName,
    PrintColour=ef_layer_4.PrintColour)  # -> Attributes, Keys, Values, Name, Layer, ColourSource, DisplayColour, MaterialSource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
bklay_4 = BakeLayers(Layers=ef_layer_4.Layer, Bake=button)
bake_4 = BakeObjects(Geometry=move_27.Geometry, Attributes=ef_att_4.Attributes, Bake=button, createGroups=False)  # -> Message, Ghosts

number_slider_49 = Slider(148, range=0..400)
layer_name_5 = Panel("FabricInner")
material_name_5 = Panel("inflatable")
rgb_5 = ColourRGB(Alpha=Slider(0.697, range=0..1), Red=number_slider_49, Green=number_slider_49, Blue=number_slider_49)
concat_5 = Concatenate(FragmentC=panel_21, FragmentA="buffer", FragmentB=layer_name_5)
lng_6 = ListLength(List=move_28.Geometry)
layer_baking_location_5 = Panel(concat_5)
dup_13 = DuplicateData(Data=material_name_5, Number=lng_6, Order=True)
dup_14 = DuplicateData(Data=concat_5, Number=lng_6, Order=True)
dup_15 = DuplicateData(Data=rgb_5, Number=lng_6, Order=True)
ef_layer_5 = EleFrontLayer(Layer=dup_14, DisplayColour=dup_15, MaterialName=dup_13)  # -> Layer, FullPath, Hidden, Locked, DisplayColour, MaterialName, Linetype, PrintColour, PrintWidth
ef_att_5 = EleFrontAttributes(
    Layer=dup_14,
    ColourSource=ef_layer_5.DisplayColour,
    MaterialName=ef_layer_5.MaterialName,
    PrintColour=ef_layer_5.PrintColour)  # -> Attributes, Keys, Values, Name, Layer, ColourSource, DisplayColour, MaterialSource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
bklay_5 = BakeLayers(Layers=ef_layer_5.Layer, Bake=button)
bake_5 = BakeObjects(Geometry=move_28.Geometry, Attributes=ef_att_5.Attributes, Bake=button, createGroups=False)  # -> Message, Ghosts

number_slider_50 = Slider(148, range=0..400)
layer_name_6 = Panel("WindowFrames")
material_name_6 = Panel("Steel")
rgb_6 = ColourRGB(Alpha=Slider(0.697, range=0..1), Red=number_slider_50, Green=number_slider_50, Blue=number_slider_50)
concat_6 = Concatenate(FragmentC=panel_21, FragmentA="buffer", FragmentB=layer_name_6)
lng_7 = ListLength(List=move_31.Geometry)
layer_baking_location_6 = Panel(concat_6)
dup_16 = DuplicateData(Data=material_name_6, Number=lng_7, Order=True)
dup_17 = DuplicateData(Data=concat_6, Number=lng_7, Order=True)
dup_18 = DuplicateData(Data=rgb_6, Number=lng_7, Order=True)
ef_layer_6 = EleFrontLayer(Layer=dup_17, DisplayColour=dup_18, MaterialName=dup_16)  # -> Layer, FullPath, Hidden, Locked, DisplayColour, MaterialName, Linetype, PrintColour, PrintWidth
ef_att_6 = EleFrontAttributes(
    Layer=dup_17,
    ColourSource=ef_layer_6.DisplayColour,
    MaterialName=ef_layer_6.MaterialName,
    PrintColour=ef_layer_6.PrintColour)  # -> Attributes, Keys, Values, Name, Layer, ColourSource, DisplayColour, MaterialSource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
bklay_6 = BakeLayers(Layers=ef_layer_6.Layer, Bake=button)
bake_6 = BakeObjects(Geometry=move_31.Geometry, Attributes=ef_att_6.Attributes, Bake=button, createGroups=False)  # -> Message, Ghosts

number_slider_51 = Slider(148, range=0..400)
layer_name_7 = Panel("FabricMiddle")
material_name_7 = Panel("inflatable")
rgb_7 = ColourRGB(Alpha=Slider(0.697, range=0..1), Red=number_slider_51, Green=number_slider_51, Blue=number_slider_51)
concat_7 = Concatenate(FragmentC=panel_21, FragmentA="buffer", FragmentB=layer_name_7)
lng_8 = ListLength(List=move_30.Geometry)
layer_baking_location_7 = Panel(concat_7)
dup_19 = DuplicateData(Data=material_name_7, Number=lng_8, Order=True)
dup_20 = DuplicateData(Data=concat_7, Number=lng_8, Order=True)
dup_21 = DuplicateData(Data=rgb_7, Number=lng_8, Order=True)
ef_layer_7 = EleFrontLayer(Layer=dup_20, DisplayColour=dup_21, MaterialName=dup_19)  # -> Layer, FullPath, Hidden, Locked, DisplayColour, MaterialName, Linetype, PrintColour, PrintWidth
ef_att_7 = EleFrontAttributes(
    Layer=dup_20,
    ColourSource=ef_layer_7.DisplayColour,
    MaterialName=ef_layer_7.MaterialName,
    PrintColour=ef_layer_7.PrintColour)  # -> Attributes, Keys, Values, Name, Layer, ColourSource, DisplayColour, MaterialSource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
bklay_7 = BakeLayers(Layers=ef_layer_7.Layer, Bake=button)
bake_7 = BakeObjects(Geometry=move_30.Geometry, Attributes=ef_att_7.Attributes, Bake=button, createGroups=False)  # -> Message, Ghosts

number_slider_52 = Slider(148, range=0..400)
layer_name_8 = Panel("FabricOuter")
material_name_8 = Panel("inflatable")
rgb_8 = ColourRGB(Alpha=Slider(0.697, range=0..1), Red=number_slider_52, Green=number_slider_52, Blue=number_slider_52)
concat_8 = Concatenate(FragmentC=panel_21, FragmentA="buffer", FragmentB=layer_name_8)
lng_9 = ListLength(List=move_29.Geometry)
layer_baking_location_8 = Panel(concat_8)
dup_22 = DuplicateData(Data=material_name_8, Number=lng_9, Order=True)
dup_23 = DuplicateData(Data=concat_8, Number=lng_9, Order=True)
dup_24 = DuplicateData(Data=rgb_8, Number=lng_9, Order=True)
ef_layer_8 = EleFrontLayer(Layer=dup_23, DisplayColour=dup_24, MaterialName=dup_22)  # -> Layer, FullPath, Hidden, Locked, DisplayColour, MaterialName, Linetype, PrintColour, PrintWidth
ef_att_8 = EleFrontAttributes(
    Layer=dup_23,
    ColourSource=ef_layer_8.DisplayColour,
    MaterialName=ef_layer_8.MaterialName,
    PrintColour=ef_layer_8.PrintColour)  # -> Attributes, Keys, Values, Name, Layer, ColourSource, DisplayColour, MaterialSource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
bklay_8 = BakeLayers(Layers=ef_layer_8.Layer, Bake=button)
bake_8 = BakeObjects(Geometry=move_29.Geometry, Attributes=ef_att_8.Attributes, Bake=button, createGroups=False)  # -> Message, Ghosts

entwine_12 = Entwine(Branch00=item_23, Branch01=offsrf_3, Branch02=offset_6, Branch03=offset_7, FlattenInputs=True)  # disabled
number_slider_53 = Slider(0.01, range=0..1)  # disabled
swatch_5 = ColourSwatch(SwatchColor=RGB(255, 255, 255))  # disabled
swatch_6 = ColourSwatch(SwatchColor=RGBA(189, 189, 189, 206))  # disabled
merge_17 = Merge(Data1=swatch_6, Data2=swatch_5)  # -> simplify(graft(Result)); disabled
python_2 = GhPythonScript(S=entwine_12, D=number_slider_53)  # -> simplify(a); inputs S: Brep; disabled; same code as python
brep_24 = Brep(item_9)  # disabled
volume_6 = Volume(Geometry=brep_24)  # -> Volume, Centroid; disabled
flatten_5 = FlattenTree(Tree=python_2, Path="{0}")  # disabled
graft_2 = GraftTree(Tree=volume_6.Centroid, IncludeEmptyLists=True, IncludeNullItems=True)  # -> simplify(Tree); disabled

entwine_13 = Entwine(Branch00=flatten_5, Branch01=entwine_6, FlattenInputs=True)  # disabled
move2pt_4 = MoveToPoint(Geometry=entwine_13, PointA=area.Centroid, PointB=graft(volume_2.Centroid))  # -> simplify(Moved), Vector, Transform; disabled

move2pt_5 = MoveToPoint(Geometry=entwine_13, PointA=area.Centroid, PointB=graft(volume_6.Centroid))  # -> simplify(Moved), Vector, Transform; disabled
lng_10 = ListLength(List=move2pt_5.Moved)  # disabled
group_2 = Group(Objects=move2pt_5.Moved)  # disabled
split_4 = SplitList(List=move2pt_5.Moved, Index=expr("x/2", lng_10))  # -> flatten(ListA), flatten(ListB); disabled
mirror_9 = Mirror(Geometry=group_2, Plane=graft_2)  # -> Geometry, Transform; disabled
ungroup_2 = Ungroup(Group=mirror_9.Geometry)  # disabled
entwine_14 = Entwine(Branch00=split_4.ListA, Branch01=split_4.ListB, FlattenInputs=True)  # -> simplify(Result); disabled
split_5 = SplitList(List=ungroup_2, Index=expr("x/2", lng_10))  # -> flatten(ListA), flatten(ListB); disabled
entwine_15 = Entwine(Branch00=split_5.ListA, Branch01=split_5.ListB, FlattenInputs=True)  # -> simplify(Result); disabled
merge_18 = Merge(Data1=entwine_14, Data2=entwine_15)  # disabled
previewmat_5 = CustomPreviewMaterials(Geometry=merge_18, DiffuseColor=merge_17)  # disabled
