# Grasshopper definition Unit_gh.gh (Grasshopper 1.0.7)
# plug-ins: Kangaroo2 Components, Human, Weaverbird, Rhino.Inside for Autodesk Revit, Bifocals, ShapeDiverForGrasshopper, MeshEdit Components, Pufferfish

sddp = ShapeDiverDocumentPayload({AbsoluteTolerance=0, AngleTolerance=0, DistanceDisplayPrecision=0, GltfVersion="Gltf2", GrasshopperVersion="1.0.0007", InputGroups="{}", OutputGroups="{}", RelativeTolerance=0, RhinoVersion="7.36.23346.16351", UnitSystem=0, VersionCreated="1.16.0.0", VersionSaved="1.14.0.0"})

# ----
# input side length!
# exterior face
# OCTOGON
number_slider = Slider(8, range=0..10)
pi = Pi(Factor=1)
number_slider_2 = Slider(3, range=0..10)
division = Division(A=pi, B=number_slider)
tan = Tangent(Value=division)
multiplication = Multiplication(A="2", B=tan)
division_2 = Division(A=number_slider_2, B=multiplication)
polygon = Polygon(Plane=PlaneXY(0, 0, 0), Radius=division_2, Segments=number_slider, FilletRadius=0)  # -> Polygon, Length
pt = Point(Point(4185.194014, 9214.115731, 0))
area = Area(Geometry=polygon.Polygon)  # -> Area, Centroid
orient = Orient(Geometry=polygon.Polygon, Source=area.Centroid, Target=pt)  # -> Geometry, Transform
Z = UnitZ(Factor=number_slider_2)
extr = Extrude(Base=polygon.Polygon, Direction=Z)

mesh = Mesh(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)
srf = Surface(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)
number_slider_3 = Slider(21602, range=10000..30000)  # disabled
pt_2 = Point(Point(-10541.30868, 12500.40471, -12653.74845))  # disabled

# ----
# input side length!
number_slider_4 = Slider(2.5, range=0..10)

xy = XYPlane(Origin=Point(0, 0, 0))  # disabled
faceb = FaceBoundaries(Mesh=mesh)
explode = Explode(Curve=faceb, Recursive=True)  # -> Segments, Vertices
sph = Sphere(Base=pt_2, Radius=number_slider_3)  # disabled
demesh = DeconstructMesh(Mesh=mesh)  # -> Vertices, Faces, Colours, Normals; disabled
avr = Average(Input=explode.Vertices)
lng = ListLength(List=explode.Vertices)
number = Number(expr("x-1", lng))
sec = BrepPlane(Brep=sph, Plane=xy)  # -> Curves, Points; disabled
srf_cp = SurfaceClosestPoint(Point=avr, Surface=reparameterize(srf))  # -> Point, UVPoint, Distance
project = Project(Geometry=demesh.Vertices, Plane=xy)  # -> Geometry, Transform; disabled
cull_i = CullIndex(List=explode.Vertices, Indices=number, Wrap=True)
incurve = PointInCurve(Point=project.Geometry, Curve=sec.Curves)  # -> Relationship, Point; disabled
pdecon = Deconstruct(Point=srf_cp.UVPoint)  # -> XComponent, YComponent, ZComponent
component_families = ComponentFamiliesPicker(<component families picker referenced from the Revit model>, SearchPattern="adaptive")  # disabled
panel = Panel("1")  # disabled
multiplication_2 = Multiplication(A=pdecon.XComponent, B=pdecon.YComponent)
bnd = Bounds(Numbers=flatten(multiplication_2))
dedomain = DeconstructDomain(Domain=bnd)  # -> Start, End
smaller = SmallerThan(FirstNumber=incurve.Relationship, SecondNumber=panel)  # -> SmallerThan, OrEqualTo; disabled

# ----
# interior face
division_3 = Division(A=number_slider_4, B=multiplication)
polygon_2 = Polygon(Plane=PlaneXY(0, 0, 0), Radius=division_3, Segments=number_slider, FilletRadius=0)  # -> Polygon, Length
area_2 = Area(Geometry=polygon_2.Polygon)  # -> Area, Centroid
Z_2 = UnitZ(Factor=number_slider_4)
extr_2 = Extrude(Base=polygon_2.Polygon, Direction=Z_2)

dispatch = Dispatch(List=demesh.Vertices, DispatchPattern=smaller.SmallerThan)  # -> ListA, ListB; disabled
dispatch_2 = Dispatch(List=project.Geometry, DispatchPattern=smaller.SmallerThan)  # -> ListA, ListB; disabled
gradient = Gradient(
    LowerLimit=dedomain.Start,
    UpperLimit=dedomain.End,
    Parameter=multiplication_2,
    stops=[0: RGB(0, 128, 0), 0.5: RGB(255, 255, 0), 1: RGB(255, 0, 0)])
element_type_picker = ElementTypePicker(component_families)  # disabled
crv_cp = CurveClosestPoint(Point=dispatch_2.ListB, Curve=sec.Curves)  # -> Point, Parameter, Distance; disabled
vec2pt = Vector2Pt(PointA=dispatch_2.ListB, PointB=crv_cp.Point, Unitize=False)  # -> Vector, Length; disabled
vec2pt_2 = Vector2Pt(PointA=dispatch_2.ListB, PointB=dispatch.ListB, Unitize=False)  # -> Vector, Length; disabled
ln = Line(StartPoint=dispatch.ListA, EndPoint=dispatch_2.ListA)  # disabled
trigger = Trigger(Interval=-1000, TimerInterval=1000, Target=a_component)  # disabled
ln_2 = Line(StartPoint=dispatch.ListB, EndPoint=crv_cp.Point)  # -> flatten(Line); disabled
concat = Concatenate(FragmentA="Color ", FragmentB=gradient)
pl = ConstructPlane(Origin=dispatch_2.ListB, XAxis=vec2pt.Vector, YAxis=vec2pt_2.Vector)  # disabled
a_component = AddComponentAdaptive(Points=cull_i, Type=element_type_picker, TrackingMode=2)  # disabled
external_vertical = Curve(ln)  # disabled
bcx = BrepCurve(Brep=sph, Curve=ln_2)  # -> Curves, Points; disabled
preview = CustomPreview(Geometry=avr, Material=gradient)
panel_2 = Panel(concat)
material = AddMaterial(Name=concat, TrackingMode=2)  # disabled
crv_cp_2 = CurveClosestPoint(Point=bcx.Points, Curve=reparameterize(graft(ln_2)))  # -> Point, Parameter, Distance; disabled
graphics = MaterialGraphics(Material=material)  # -> Material, UseRenderAppearance, Color, Transparency, SurfacePatternsForegroundPattern, SurfacePatternsForegroundColor, SurfacePatternsBackgroundPattern, SurfacePatternsBackgroundColor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; disabled
item = ListItem(List=crv_cp_2.Parameter, Index=0, Wrap=True)  # disabled
panel_3 = Panel("1")  # disabled
panel_4 = Panel("20000")  # disabled
panel_5 = Panel("Material")  # disabled
similar = Similarity(FirstNumber=item, SecondNumber=panel_3, Threshold=0.1)  # -> Similarity, AbsoluteDifference; disabled
dispatch_3 = Dispatch(List=pl, DispatchPattern=flatten(similar.Similarity))  # -> ListA, ListB; disabled
dispatch_4 = Dispatch(List=dispatch.ListB, DispatchPattern=flatten(similar.Similarity))  # -> ListA, ListB; disabled
dispatch_5 = Dispatch(List=ln_2, DispatchPattern=flatten(similar.Similarity))  # -> ListA, ListB; disabled
rectangle = Rectangle(Plane=dispatch_3.ListB, XSize=panel_4, YSize=panel_4, Radius=0)  # -> Rectangle, Length; disabled
param = ElementParameter(Element=simplify(a_component), Parameter=panel_5, Value=material)  # -> Element, Value; disabled

cap = CapHoles(Brep=extr_2)
debrep = DeconstructBrep(Brep=cap)  # -> Faces, Edges, Vertices
debrep_2 = DeconstructBrep(Brep=debrep.Faces)  # -> Faces, Edges, Vertices
join = JoinCurves(Curves=debrep_2.Edges, Preserve=False)  # -> flatten(Curves)

boundary = BoundarySurfaces(Edges=rectangle.Rectangle)  # disabled
external_inclined = Curve(dispatch_5.ListA)  # disabled
bbx = BrepBrep(BrepA=boundary, BrepB=sph)  # -> Curves, Points; disabled
tan_2 = TangentLines(Point=graft(dispatch_4.ListB), Circle=bbx.Curves)  # -> Tangent1, Tangent2; disabled
end = EndPoints(Curve=tan_2.Tangent1)  # -> Start, End; disabled
crv_cp_3 = CurveClosestPoint(Point=end.End, Curve=bbx.Curves)  # -> Point, Parameter, Distance; disabled

# ----
# horizontal faces
# vertical faces
pcen = PolygonCenter(Polyline=join)  # -> CenterV, CenterE, CenterA
pdecon_2 = Deconstruct(Point=pcen.CenterV)  # -> XComponent, YComponent, ZComponent
ma = MassAddition(Input=pdecon_2.ZComponent)  # -> Result, PartialResults
lng_2 = ListLength(List=pdecon_2.ZComponent)
division_4 = Division(A=ma.Result, B=lng_2)
similar_2 = Similarity(FirstNumber=pdecon_2.ZComponent, SecondNumber=division_4, Threshold="0.1")  # -> Similarity, AbsoluteDifference
dispatch_6 = Dispatch(List=join, DispatchPattern=similar_2.Similarity)  # -> ListA, ListB
crv = Curve(dispatch_6.ListA)

shatter = Shatter(Curve=bbx.Curves, Parameters=crv_cp_3.Parameter)  # disabled
panel_6 = Panel("0")  # disabled
cull_i_2 = CullIndex(List=shatter, Indices=panel_6, Wrap=True)  # disabled
merge = Merge(Data1=simplify(tan_2.Tangent1), Data2=simplify(cull_i_2))  # disabled
join_2 = JoinCurves(Curves=merge, Preserve=False)  # disabled
component_families_2 = ComponentFamiliesPicker(SearchPattern="class")  # disabled
external_vertical_2 = Curve(external_vertical)  # disabled
external_curved = Curve(flatten(join_2))  # disabled
external_inclined_2 = Curve(external_inclined)  # disabled
panel_7 = Panel("3")  # disabled
panel_8 = Panel("6")  # disabled
reb = RebuildCurve(Curve=external_curved, Degree=panel_7, Count=panel_8, Tangents=False)  # disabled
element_type_picker_2 = ElementTypePicker(component_families_2)  # disabled
element_type_picker_3 = ElementTypePicker(component_families_2)  # disabled
levels = LevelsPicker(<levels picker referenced from the Revit model>)  # disabled
entwine = Entwine(Branch00=external_vertical_2, Branch01=external_inclined_2, Branch02=reb, FlattenInputs=True)  # -> simplify(Result); disabled
element_type_picker_4 = ElementTypePicker(component_families_2)  # disabled
flip = FlipCurve(Curve=entwine)  # -> Curve, Flag; disabled
merge_2 = Merge(Data1=element_type_picker_4, Data2=element_type_picker_2, Data3=element_type_picker_3)  # disabled
tstat = TreeStatistics(Tree=graft(flip.Curve))  # -> Paths, Length, Count; disabled
tstat_2 = TreeStatistics(Tree=flip.Curve)  # -> Paths, Length, Count; disabled
dpath = DeconstructPath(Branch=tstat.Paths)  # disabled
dup = DuplicateData(Data=graft(tstat_2.Paths), Number=graft(tstat_2.Length), Order=True)  # disabled
item_2 = ListItem(List=dpath, Index=0, Wrap=True)  # disabled
item_3 = ListItem(List=merge_2, Index=item_2, Wrap=True)  # -> simplify(Item); disabled
trigger_2 = Trigger(Interval=-1000, TimerInterval=1000, Target=s_beam)  # disabled
len = Length(Curve=flip.Curve)  # -> flatten(Length); disabled

# ---- group: Upgraded : Add Beam
L = Level(levels)  # disabled

# ---- group: Upgraded : Add Beam / Add Beam
s_beam = AddStructuralBeam(Curve=flatten(flip.Curve), Type=flatten(item_3), TrackingMode=2)  # disabled

# ----
panel_9 = Panel("0.2 to 1")  # disabled
bnd_2 = Bounds(Numbers=len)  # disabled
remap = RemapNumbers(Value=len, Source=bnd_2, Target=panel_9)  # -> Mapped, Clipped; disabled
panel_10 = Panel("150")  # disabled
panel_11 = Panel("350")  # disabled
multiplication_3 = Multiplication(A=panel_11, B=remap.Mapped)  # disabled
multiplication_4 = Multiplication(A=panel_10, B=remap.Mapped)  # disabled
panel_12 = Panel("R")  # disabled
panel_13 = Panel("r")  # disabled
param_2 = ElementParameter(Element=s_beam, Parameter=panel_13, Value=multiplication_4)  # -> Element, Value; disabled
param_3 = ElementParameter(Element=s_beam, Parameter=panel_12, Value=multiplication_3)  # -> Element, Value; disabled
item_4 = ListItem(List=crv, Index=0, Wrap=True)  # -> Item, Item1, Item2, Item3, Item4, Item5, Item6, Item7
merge_3 = Merge(Data1=item_4.Item4, Data2=item_4.Item5, Data3=item_4.Item6, Data4=item_4.Item7)
merge_4 = Merge(Data1=item_4.Item, Data2=item_4.Item1, Data3=item_4.Item2, Data4=item_4.Item3)
crv_2 = Curve(dispatch_6.ListB)
item_5 = ListItem(List=merge_4, Index=0, Wrap=True)  # -> Item, Item1, Item2, Item3
length = Slider(0.43, range=0..1)
# limits!
offset = Slider(0.37, range=0..1)
crv_3 = Curve([item_5.Item, item_5.Item3])
crv_4 = Curve([item_5.Item1, item_5.Item2])
# INSIDE
boundary_2 = BoundarySurfaces(Edges=crv_3)

# ----
# points dont match,
# looks cool tho
# type 3 upper and lower
cluster = Cluster(F=length, A=offset, relay=crv_2)
crv_5 = Curve(graft(crv_2))
crv_6 = Curve(graft(cluster))
loft = Loft(Curves=[crv_5, crv_6], Options={Adjust=False, Closed=False, LoftEnds=0, LoftSimp=0, LoftType=0, Rebuild=10, Refit=0.01})  # -> flatten(Loft)
boundary_3 = BoundarySurfaces(Edges=crv_6)  # disabled

# ----
# limits!
offset_2 = Slider(0, range=0..0.55)
length_2 = Slider(0.84, range=0..1)

# ----
# limits!
length_3 = Slider(0.47, range=0..1)
offset_3 = Slider(0.31, range=0..1)

# ----
# circulation
offset_4 = Slider(0.55, range=0..0.55)
length_4 = Slider(0.9, range=0..1)
debrep_3 = DeconstructBrep(Brep=boundary_2)  # -> Faces, Edges, Vertices
join_3 = JoinCurves(Curves=debrep_3.Edges, Preserve=False)
disc = Discontinuity(Curve=join_3, Level=1)  # -> Points, Parameters
area_3 = Area(Geometry=boundary_2)  # -> Area, Centroid
shift = ShiftList(List=disc.Points, Shift=Slider(5, range=0..10), Wrap=True)
pline = PolyLine(Vertices=shift, Closed=True)
evalsrf = EvaluateSurface(Surface=reparameterize(boundary_2), Point=area_3.Centroid)  # -> Point, Normal, UDirection, VDirection, Frame
scale = Scale(Geometry=flatten(pline), Center=area_3.Centroid, Factor=length_4)  # -> Geometry, Transform
amp = Amplitude(Vector=evalsrf.Normal, Amplitude=offset_4)
move = Move(Geometry=scale.Geometry, Motion=amp)  # -> Geometry, Transform
debrep_4 = DeconstructBrep(Brep=move.Geometry)  # -> Faces, Edges, Vertices
divide = DivideDomain²(Domain=debrep_4.Faces, UCount="1", VCount="2")
subsrf = Isotrim(Surface=debrep_4.Faces, Domain=divide)
item_6 = ListItem(List=subsrf, Index=0, Wrap=True)  # -> Item, Item1
debrep_5 = DeconstructBrep(Brep=item_6.Item1)  # -> Faces, Edges, Vertices
join_4 = JoinCurves(Curves=debrep_5.Edges, Preserve=False)
disc_2 = Discontinuity(Curve=join_4, Level=1)  # -> Points, Parameters
disc_3 = Discontinuity(Curve=pline, Level=1)  # -> Points, Parameters
shift_2 = ShiftList(List=disc_2.Points, Shift=1, Wrap=True)
pline_2 = PolyLine(Vertices=shift_2, Closed=True)  # -> simplify(Polyline)
pline_3 = PolyLine(Vertices=disc_3.Points, Closed=True)  # -> simplify(Polyline)
loft_2 = Loft(
    Curves=[pline_2, pline_3],
    Options={Adjust=False, Closed=False, LoftEnds=0, LoftSimp=0, LoftType=0, Rebuild=10, Refit=0.01})  # -> flatten(Loft)

boundary_4 = BoundarySurfaces(Edges=crv_4)
area_4 = Area(Geometry=boundary_4)  # -> Area, Centroid
evalsrf_2 = EvaluateSurface(Surface=reparameterize(boundary_4), Point=area_4.Centroid)  # -> Point, Normal, UDirection, VDirection, Frame
scale_2 = Scale(Geometry=crv_4, Center=area_4.Centroid, Factor=length_2)  # -> Geometry, Transform
amp_2 = Amplitude(Vector=evalsrf_2.Normal, Amplitude=offset_2)
move_2 = Move(Geometry=scale_2.Geometry, Motion=amp_2)  # -> Geometry, Transform
crv_7 = Curve(graft(crv_4))
crv_8 = Curve(graft(move_2.Geometry))
loft_3 = Loft(Curves=[crv_8, crv_7], Options={Adjust=False, Closed=False, LoftEnds=0, LoftSimp=0, LoftType=0, Rebuild=10, Refit=0.01})  # -> flatten(Loft)

# ----
# OUTSIDE
cluster_2 = Cluster_2(G=merge_3, F=length_3, A_2=Slider(0, range=0..100), A=offset_3, E=merge_3)
crv_9 = Curve(graft(cluster_2))
crv_10 = Curve(graft(merge_3))
loft_4 = Loft(Curves=[crv_10, crv_9], Options={Adjust=False, Closed=False, LoftEnds=0, LoftSimp=0, LoftType=0, Rebuild=10, Refit=0.01})  # -> flatten(Loft)
boundary_5 = BoundarySurfaces(Edges=crv_9)  # -> flatten(Surfaces)

# ----
# op B no divisions
number_slider_5 = Slider(0.66, range=0..1)  # disabled
cluster_3 = Cluster_3(F=number_slider_5, L=crv_4)  # -> crv_3, crv_4; disabled
loft_5 = Loft(
    Curves=[cluster_3.crv_3, cluster_3.crv_4],
    Options={Adjust=False, Closed=False, LoftEnds=0, LoftSimp=0, LoftType=0, Rebuild=10, Refit=0.01})  # -> flatten(Loft); disabled

# ----
# Type 2
mesh_2 = Mesh(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)
# Type 1
mesh_3 = Mesh(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)
merge_5 = Merge(Data1=loft_2, Data2=loft_3, Data3=loft_4, Data4=boundary_5, Data5=loft)
join_5 = BrepJoin(Breps=merge_5)  # -> Breps, Closed
lng_3 = ListLength()
debrep_6 = DeconstructBrep(Brep=join_5.Breps)  # -> Faces, Edges, Vertices
cset = CreateSet(List=flatten(lng_3))  # -> Set, Map
avr_2 = Average(Input=debrep_6.Vertices)
debrep_7 = DeconstructBrep(Brep=debrep_6.Faces)  # -> Faces, Edges, Vertices
panel_14 = Panel(cset.Set)
panel_15 = Panel(debrep_7.Edges)
panel_16 = Panel(debrep_6.Faces)
component_families_3 = ComponentFamiliesPicker(<component families picker referenced from the Revit model>, SearchPattern="structural")
scale_3 = Scale(Geometry=debrep_6.Edges, Center=avr_2, Factor=Slider(1, range=0.75..1.5))  # -> Geometry, Transform
triremesh = TriRemesh(Geometry=join_5.Breps, Iterations=25)  # -> Triangulation, Dual, Creases
mp = MultiPipe(
    Curves=scale_3.Geometry,
    NodeSize=Slider(0.07, range=0..0.3),
    EndOffset=1,
    StrutSize=Slider(0.36, range=0..1),
    Segment=0,
    KinkAngle=0.6,
    CubeFit=0,
    Caps=0)
element_type_picker_5 = ElementTypePicker(
    component_families_3,
    {"G06 structure frames 2 : G06 structure frames 2": "259cede1-da21-465f-9b38-6fb7cec222e9:663c11c7-d6fa-4a35-bc7d-2b96c24eb3a3-0005817e"}, selected="G06 structure frames 2 : G06 structure frames 2")
wbcatmullclark = WeaverbirdsCatmullClarkSubdivision(MeshCurves=triremesh.Triangulation, Level=Slider(2, range=0..10), SmoothNakedEdges=1)

boundary_6 = BoundarySurfaces(Edges=crv_2)
item_7 = ListItem(List=boundary_6, Index=0, Wrap=True)
cap_2 = CapHoles(Brep=join_5.Breps)

offsrf = OffsetSurface(Surface=loft_4, Distance="0.200", BothSides=0, CreateSolid=True)
offsrf_2 = OffsetSurface(Surface=[loft_2, loft_3], Distance="-0.200", BothSides=0, CreateSolid=True)
number_slider_6 = Slider(8, range=0..10)
phase = Phase(<phase referenced from the Revit model>)

# ---- group: Side Panels
merge_6 = Merge(Data1=offsrf_2, Data2=offsrf)

# ---- group: Windows
boundary_7 = BoundarySurfaces(Edges=crv_8)
boundary_8 = BoundarySurfaces(Edges=crv_6)
srf_2 = Surface(boundary_5)

# ---- group: Upper and Lower Panels
brep = Brep(loft)

# ----
previewmat = CustomPreviewMaterials(Geometry=mp, DiffuseColor=RGB(255, 255, 255))
previewmat_2 = CustomPreviewMaterials(Geometry=wbcatmullclark, DiffuseColor=RGB(255, 255, 255))

# ---- group: Doors
srf_3 = Surface(pline_2)

# ----
crv_11 = Curve(scale_3.Geometry)
merge_7 = Merge(Data1=srf_2, Data2=flatten(boundary_7), Data3=flatten(boundary_8), Data4=flatten(srf_3))
offsrf_3 = OffsetSurface(Surface=brep, Distance="0.200", BothSides=0, CreateSolid=True)

subd = SubD(<subd referenced from the Rhino model>)
mesh_4 = Mesh(subd)
wbcatmullclark_2 = WeaverbirdsCatmullClarkSubdivision(MeshCurves=mesh_4, Level=Slider(3, range=1..3), SmoothNakedEdges=1)
topography = AddTopographyMesh(Mesh=wbcatmullclark_2, TrackingMode=2)

list = ElementTypePicker()
trigger_3 = Trigger(Interval=-1000, TimerInterval=1000, Target=[g_shape_3, g_shape_2, g_shape, topography])

mesh_5 = Mesh(<mesh referenced from the Rhino model>)
srf_4 = Surface(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)
explode_2 = MeshExplode(Mesh=mesh_5, Interpolate=False)
demesh_2 = DeconstructMesh(Mesh=explode_2)  # -> Vertices, Faces, Colours, Normals
area_5 = Area(Geometry=explode_2)  # -> Area, Centroid
sort = SortList(Keys=demesh_2.Vertices, ValuesA=demesh_2.Vertices)  # -> Keys, ValuesA
srf_cp_2 = SurfaceClosestPoint(Point=area_5.Centroid, Surface=reparameterize(mesh_5))  # -> Point, UVPoint, Distance
component_families_4 = ComponentFamiliesPicker(<component families picker referenced from the Revit model>, SearchPattern="generic")
element_type_picker_6 = ElementTypePicker(
    component_families_4,
    {"quadMeshPanel : quadMeshPanel": "259cede1-da21-465f-9b38-6fb7cec222e9:767992d0-5ce3-406e-9628-705649cfe053-00058682"}, selected="quadMeshPanel : quadMeshPanel")
active = ActiveDocument()
trigger_4 = Trigger(Interval=1000, TimerInterval=1000, Target=[a_component_2, s_beam_2])  # disabled
a_component_2 = AddComponentAdaptive(Document=active, Points=demesh_2.Vertices, Type=element_type_picker_6, TrackingMode=2)  # -> simplify(Component)
inspect = InspectElement(Element=a_component_2)  # -> simplify(MaterialsAndFinishesPanelMaterial)
param_4 = ElementParameter(Element=a_component_2, Parameter=inspect)  # -> Element, Value
phasing = ElementPhasing(Element=param_4.Element, Created=phase)  # -> Element, Created, Demolished

meshcp = MeshClosestPoint(Point=area_5.Centroid, Mesh=mesh_5)  # -> Point, Index, Parameter

pdecon_3 = Deconstruct(Point=meshcp.Point)  # -> XComponent, YComponent, ZComponent
multiplication_5 = Multiplication(A=pdecon_3.XComponent, B=pdecon_3.YComponent)  # -> simplify(Result)
bnd_3 = Bounds(Numbers=flatten(multiplication_5))
dedomain_2 = DeconstructDomain(Domain=bnd_3)  # -> Start, End
gradient_2 = Gradient(
    LowerLimit=dedomain_2.Start,
    UpperLimit=dedomain_2.End,
    Parameter=multiplication_5,
    stops=[0: RGB(0, 128, 0), 0.5: RGB(255, 255, 0), 1: RGB(255, 0, 0)])
cset_2 = CreateSet(List=flatten(gradient_2))  # -> Set, Map
concat_2 = Concatenate(FragmentA="color ", FragmentB=cset_2.Set)
material_2 = AddMaterial(Name=concat_2, TrackingMode=2)
item_8 = ListItem(List=flatten(material_2), Index=cset_2.Map, Wrap=True)  # -> simplify(graft(Item))
graphics_2 = MaterialGraphics(Material=item_8, Color=gradient_2)  # -> simplify(Material), UseRenderAppearance, Color, Transparency, SurfacePatternsForegroundPattern, SurfacePatternsForegroundColor, CutPatternsForegroundPattern, CutPatternsForegroundColor

area_6 = Area(Geometry=mesh_5)  # -> Area, Centroid
panel_17 = Panel(a_component_2)
arrpolar = PolarArray(Geometry=scale_3.Geometry, Plane=area_6.Centroid, Count=number_slider_6, Angle=6.283185307)  # -> Geometry, Transform
arrpolar_2 = PolarArray(Geometry=join_5.Breps, Plane=area_6.Centroid, Count=number_slider_6, Angle=6.283185307)  # -> Geometry, Transform; disabled
cull_i_3 = CullIndex(List=arrpolar.Geometry, Indices="0", Wrap=True)
cull_i_4 = CullIndex(List=arrpolar_2.Geometry, Indices="0", Wrap=True)  # disabled
s_beam_2 = AddStructuralBeam(Curve=flatten([crv_11, cull_i_3]), Type=element_type_picker_5, TrackingMode=2)
b_shape = AddDirectShapeBrep(Brep=cull_i_4, TrackingMode=2)  # disabled

arrpolar_3 = PolarArray(Geometry=merge_6, Plane=area_6.Centroid, Count=number_slider_6, Angle=6.283185307)  # -> Geometry, Transform
cull_i_5 = CullIndex(List=arrpolar_3.Geometry, Indices="0", Wrap=True)  # -> flatten(List)
g_shape = AddDirectShapeGeometry(Category=<geometry referenced from the Revit model>, Geometry=cull_i_5, TrackingMode=2)

arrpolar_4 = PolarArray(Geometry=offsrf_3, Plane=area_6.Centroid, Count=number_slider_6, Angle=6.283185307)  # -> Geometry, Transform
cull_i_6 = CullIndex(List=arrpolar_4.Geometry, Indices="0", Wrap=True)
g_shape_2 = AddDirectShapeGeometry(Category=<geometry referenced from the Revit model>, Geometry=cull_i_6, TrackingMode=2)

arrpolar_5 = PolarArray(Geometry=merge_7, Plane=area_6.Centroid, Count=number_slider_6, Angle=6.283185307)  # -> Geometry, Transform
cull_i_7 = CullIndex(List=arrpolar_5.Geometry, Indices="0", Wrap=True)
g_shape_3 = AddDirectShapeGeometry(Category=<geometry referenced from the Revit model>, Geometry=cull_i_7, TrackingMode=2)

# ---- group: Floors
arrpolar_6 = PolarArray(Geometry=item_7, Plane=area_6.Centroid, Count=number_slider_6, Angle=6.283185307)  # -> Geometry, Transform
cull_i_8 = CullIndex(List=arrpolar_6.Geometry, Indices="0", Wrap=True)
floor = AddFloor(
    Boundary=cull_i_8,
    Type=<hostobjecttype referenced from the Revit model>,
    Level=<geometry referenced from the Revit model>,
    Structural=True,
    TrackingMode=2)

# ----
phasing_2 = ElementPhasing(Element=s_beam_2, Created=phase)  # -> Element, Created, Demolished

# ==== cluster Cluster
relay = ClusterInput()
boundary = BoundarySurfaces(Edges=relay)
area = Area(Geometry=boundary)  # -> Area, Centroid
F = ClusterInput()
evalsrf = EvaluateSurface(Surface=reparameterize(boundary), Point=area.Centroid)  # -> Point, Normal, UDirection, VDirection, Frame
scale = Scale(Geometry=relay, Center=area.Centroid, Factor=F)  # -> Geometry, Transform
A = ClusterInput()
amp = Amplitude(Vector=evalsrf.Normal, Amplitude=A)
move = Move(Geometry=scale.Geometry, Motion=amp)  # -> Geometry, Transform
G = ClusterOutput(move.Geometry)

# ==== cluster Cluster_2
E = ClusterInput()
boundary = BoundarySurfaces(Edges=E)
area = Area(Geometry=boundary)  # -> Area, Centroid
G = ClusterInput()
F = ClusterInput()
evalsrf = EvaluateSurface(Surface=reparameterize(boundary), Point=area.Centroid)  # -> Point, Normal, UDirection, VDirection, Frame
scale = Scale(Geometry=G, Center=area.Centroid, Factor=F)  # -> Geometry, Transform
A = ClusterInput()
amp = Amplitude(Vector=evalsrf.Normal, Amplitude=A)
pln = Plane(evalsrf.Normal)
move = Move(Geometry=scale.Geometry, Motion=amp)  # -> Geometry, Transform
debrep = DeconstructBrep(Brep=move.Geometry)  # -> Faces, Edges, Vertices
avr = Average(Input=debrep.Vertices)  # -> flatten(ArithmeticMean)
ln = Line(StartPoint=area.Centroid, EndPoint=avr)
A_2 = ClusterInput()
rotax = RotateAxis(Geometry=move.Geometry, Angle=degrees(A_2), Axis=ln)  # -> Geometry, Transform
relay = ClusterOutput(rotax.Geometry)

# ==== cluster Cluster_3
L = ClusterInput()
item = ListItem(List=L, Index=0, Wrap=True)  # -> Item, Item1
disc = Discontinuity(Curve=item.Item, Level=1)  # -> Points, Parameters
disc_2 = Discontinuity(Curve=item.Item1, Level=1)  # -> Points, Parameters
item_2 = ListItem(List=disc.Points, Index=0, Wrap=True)  # -> Item, Item1, Item2, Item3
item_3 = ListItem(List=disc_2.Points, Index=0, Wrap=True)  # -> Item, Item1, Item2, Item3
ln = Line(StartPoint=item_2.Item, EndPoint=item_2.Item1)
midpt = CurveMiddle(Curve=ln)
merge = Merge(
    Data1=item_2.Item1,
    Data2=item_2.Item2,
    Data3=item_2.Item3,
    Data4=item_2.Item,
    Data5=item_3.Item,
    Data6=item_3.Item1,
    Data7=item_3.Item2)
pline = PolyLine(Vertices=merge, Closed=True)
F = ClusterInput()
scale = Scale(Geometry=pline, Center=midpt, Factor=F)  # -> Geometry, Transform
crv = Curve(scale.Geometry)
crv_2 = Curve(pline)
crv_3 = ClusterOutput(crv)
crv_4 = ClusterOutput(crv_2)
