# Grasshopper definition Meditation_interior_design_v1.gh (Grasshopper 1.0.7)
# plug-ins: Kangaroo2 Components, MetaHopper, Heteroptera, MeshEdit Components, ClipperComponents, Bifocals

# AIR CYARD
# units contour
geo = Geometry([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])
# units contour
# WATER CYARD
geo_2 = Geometry([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])

# ----
# units contour
# EARTH CYARD
geo_3 = Geometry([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])

debrep = DeconstructBrep(Brep=geo_2)  # -> Faces, Edges, Vertices
debrep_2 = DeconstructBrep(Brep=geo)  # -> Faces, Edges, Vertices
debrep_3 = DeconstructBrep(Brep=geo_3)  # -> Faces, Edges, Vertices
area = Area(Geometry=debrep.Faces)  # -> Area, Centroid
area_2 = Area(Geometry=debrep_2.Faces)  # -> Area, Centroid
area_3 = Area(Geometry=debrep_3.Faces)  # -> Area, Centroid
pdecon = Deconstruct(Point=area.Centroid)  # -> XComponent, YComponent, ZComponent
pdecon_2 = Deconstruct(Point=area_2.Centroid)  # -> XComponent, YComponent, ZComponent
pdecon_3 = Deconstruct(Point=area_3.Centroid)  # -> XComponent, YComponent, ZComponent
panel = Panel(pdecon.ZComponent)
panel_2 = Panel(pdecon.ZComponent)
panel_3 = Panel(pdecon_2.ZComponent)
panel_4 = Panel(pdecon_2.ZComponent)
panel_5 = Panel(pdecon_3.ZComponent)
panel_6 = Panel(pdecon_3.ZComponent)
ma = MassAddition(Input=panel)  # -> Result, PartialResults
lng = ListLength(List=panel)
ma_2 = MassAddition(Input=panel_3)  # -> Result, PartialResults
lng_2 = ListLength(List=panel_3)
ma_3 = MassAddition(Input=panel_5)  # -> Result, PartialResults
lng_3 = ListLength(List=panel_5)
division = Division(A=ma.Result, B=lng)
division_2 = Division(A=ma_2.Result, B=lng_2)
division_3 = Division(A=ma_3.Result, B=lng_3)

# ----
# always sleect the top f
# aces and make sno sense
smaller = SmallerThan(FirstNumber=pdecon.ZComponent, SecondNumber=division)  # -> SmallerThan, OrEqualTo
larger = LargerThan(FirstNumber=pdecon.ZComponent, SecondNumber=division)  # -> LargerThan, OrEqualTo
dispatch = Dispatch(List=debrep.Faces, DispatchPattern=larger.OrEqualTo)  # -> ListA, ListB
srf = Surface(dispatch.ListB)

# ----
# remove this when solved
bnd = Bounds(Numbers=flatten(pdecon.ZComponent))
dedomain = DeconstructDomain(Domain=bnd)  # -> Start, End
subtraction = Subtraction(A=dedomain.End, B=dedomain.Start)
Z = UnitZ(Factor=subtraction)
srf_2 = Surface(dispatch.ListA)
neg = Negative(Value=Z)
move = Move(Geometry=srf_2, Motion=neg)  # -> Geometry, Transform

# ----
# always sleect the top f
# aces and make sno sense
smaller_2 = SmallerThan(FirstNumber=pdecon_2.ZComponent, SecondNumber=division_2)  # -> SmallerThan, OrEqualTo
larger_2 = LargerThan(FirstNumber=pdecon_2.ZComponent, SecondNumber=division_2)  # -> LargerThan, OrEqualTo
dispatch_2 = Dispatch(List=debrep_2.Faces, DispatchPattern=larger_2.OrEqualTo)  # -> ListA, ListB
srf_3 = Surface(dispatch_2.ListB)

# ----
# remove this when solved
bnd_2 = Bounds(Numbers=flatten(pdecon_2.ZComponent))
dedomain_2 = DeconstructDomain(Domain=bnd_2)  # -> Start, End
subtraction_2 = Subtraction(A=dedomain_2.End, B=dedomain_2.Start)
Z_2 = UnitZ(Factor=subtraction_2)
srf_4 = Surface(dispatch_2.ListA)
neg_2 = Negative(Value=Z_2)
move_2 = Move(Geometry=srf_4, Motion=neg_2)  # -> Geometry, Transform

# ----
# always sleect the top f
# aces and make sno sense
smaller_3 = SmallerThan(FirstNumber=pdecon_3.ZComponent, SecondNumber=division_3)  # -> SmallerThan, OrEqualTo
larger_3 = LargerThan(FirstNumber=pdecon_3.ZComponent, SecondNumber=division_3)  # -> LargerThan, OrEqualTo
dispatch_3 = Dispatch(List=debrep_3.Faces, DispatchPattern=larger_3.OrEqualTo)  # -> ListA, ListB
srf_5 = Surface(dispatch_3.ListB)

# ----
# remove this when solved
bnd_3 = Bounds(Numbers=flatten(pdecon_3.ZComponent))
dedomain_3 = DeconstructDomain(Domain=bnd_3)  # -> Start, End
subtraction_3 = Subtraction(A=dedomain_3.End, B=dedomain_3.Start)
Z_3 = UnitZ(Factor=subtraction_3)
srf_6 = Surface(dispatch_3.ListA)
neg_3 = Negative(Value=Z_3)
move_3 = Move(Geometry=srf_6, Motion=neg_3)  # -> Geometry, Transform

debrep_4 = DeconstructBrep(Brep=move.Geometry)  # -> Faces, Edges, Vertices
debrep_5 = DeconstructBrep(Brep=move_2.Geometry)  # -> Faces, Edges, Vertices
debrep_6 = DeconstructBrep(Brep=move_3.Geometry)  # -> Faces, Edges, Vertices
area_4 = Area(Geometry=debrep_4.Faces)  # -> Area, flatten(Centroid)
midpt = CurveMiddle(Curve=debrep_4.Edges)
area_5 = Area(Geometry=debrep_5.Faces)  # -> Area, flatten(Centroid)
midpt_2 = CurveMiddle(Curve=debrep_5.Edges)
area_6 = Area(Geometry=debrep_6.Faces)  # -> Area, flatten(Centroid)
midpt_3 = CurveMiddle(Curve=debrep_6.Edges)
avr = Average(Input=area_4.Centroid)
avr_2 = Average(Input=area_5.Centroid)
avr_3 = Average(Input=area_6.Centroid)
ln = Line(StartPoint=avr, EndPoint=midpt)
ln_2 = Line(StartPoint=avr_2, EndPoint=midpt_2)
ln_3 = Line(StartPoint=avr_3, EndPoint=midpt_3)
len = Length(Curve=ln)
len_2 = Length(Curve=ln_2)
len_3 = Length(Curve=ln_3)
smaller_4 = SmallerThan(FirstNumber=len, SecondNumber=Slider(12.13, range=10..16))  # -> SmallerThan, OrEqualTo
smaller_5 = SmallerThan(FirstNumber=len_2, SecondNumber=Slider(12.13, range=10..16))  # -> SmallerThan, OrEqualTo
smaller_6 = SmallerThan(FirstNumber=len_3, SecondNumber=Slider(12.13, range=10..16))  # -> SmallerThan, OrEqualTo
dispatch_4 = Dispatch(List=debrep_4.Edges, DispatchPattern=smaller_4.SmallerThan)  # -> ListA, ListB
dispatch_5 = Dispatch(List=debrep_5.Edges, DispatchPattern=smaller_5.SmallerThan)  # -> ListA, ListB
dispatch_6 = Dispatch(List=debrep_6.Edges, DispatchPattern=smaller_6.SmallerThan)  # -> ListA, ListB
crv = Curve(dispatch_4.ListB)

# ----
# curve
crv_2 = Curve(dispatch_4.ListA)
join = JoinCurves(Curves=flatten(crv_2), Preserve=False)

crv_3 = Curve(dispatch_5.ListB)

# ----
# curve
crv_4 = Curve(dispatch_5.ListA)

# ----
# curve
crv_5 = Curve(dispatch_6.ListA)
join_2 = JoinCurves(Curves=flatten(crv_5), Preserve=False)

crv_6 = Curve(dispatch_6.ListB)
number_slider = Slider(15, range=0..100)  # disabled
number_slider_2 = Slider(1.7, range=0..10)  # disabled
number_slider_3 = Slider(15, range=0..100)  # disabled
number_slider_4 = Slider(3.4, range=0..10)  # disabled
join_3 = JoinCurves(Curves=flatten(crv_4), Preserve=False)
number_slider_5 = Slider(15, range=0..100)  # disabled
number_slider_6 = Slider(15, range=0..100)  # disabled
number_slider_7 = Slider(300, range=0..1000)  # disabled
number_slider_8 = Slider(10, range=0..10)  # disabled
number_slider_9 = Slider(2.3, range=0..10)  # disabled

# ----
# MANUAL INPUT (FOR NOW)
number_slider_10 = Slider(21, range=0..24)

number_slider_11 = Slider(200, range=0..1000)  # disabled

# ----
# MANUAL INPUT (FOR NOW)
number_slider_12 = Slider(15, range=0..24)

# ----
# MANUAL INPUT (FOR NOW)
number_slider_13 = Slider(3, range=0..24)

# ----
# MANUAL INPUT (FOR NOW)
number_slider_14 = Slider(21, range=0..24)

debrep_7 = DeconstructBrep(Brep=join)  # -> Faces, Edges, Vertices
xy = XYPlane(Origin=Point(0, 0, 0))  # disabled

# ----
# center point
pcen = PolygonCenter(Polyline=join)  # -> CenterV, CenterE, CenterA

debrep_8 = DeconstructBrep(Brep=join_3)  # -> Faces, Edges, Vertices

# ----
# center point
pcen_2 = PolygonCenter(Polyline=join_3)  # -> CenterV, CenterE, CenterA

# ----
# center point
pcen_3 = PolygonCenter(Polyline=join_2)  # -> CenterV, CenterE, CenterA

xy_2 = XYPlane(Origin=Point(0, 0, 0))  # disabled

# ----
# FLOOR extrusion
number_slider_15 = Slider(3, range=1..3)

division_4 = Division(A=number_slider_3, B=number_slider_2)  # disabled
division_5 = Division(A=number_slider_3, B=number_slider_4)  # disabled
division_6 = Division(A=number_slider_11, B=number_slider_8)  # disabled
division_7 = Division(A=number_slider_11, B=number_slider_9)  # disabled
dom = ConstructDomain(DomainStart=division_4, DomainEnd=division_5)  # disabled
planesrf = PlaneSurface(Plane=xy, XSize=number_slider, YSize=number_slider_3)  # disabled
debrep_9 = DeconstructBrep(Brep=join_2)  # -> Faces, Edges, Vertices
number_slider_16 = Slider(4, range=0..10)  # disabled
dom_2 = ConstructDomain(DomainStart=division_6, DomainEnd=division_7)  # disabled
planesrf_2 = PlaneSurface(Plane=xy_2, XSize=number_slider_7, YSize=number_slider_11)  # disabled
shift = ShiftList(List=debrep_7.Edges, Shift=number_slider_12, Wrap=True)
shift_2 = ShiftList(List=debrep_8.Edges, Shift=number_slider_13, Wrap=True)
number_slider_17 = Slider(5, range=0..10)  # disabled
srf_7 = Surface(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)  # disabled

# ----
# CENTER RADIUS
number_slider_18 = Slider(4, range=0..10)
pt = Point(pcen.CenterV)
circle = CircleCNR(Center=pt, Normal=Vector(0, 0, 1), Radius=number_slider_18)

# ----
# CENTER RADIUS
number_slider_19 = Slider(4, range=0..10)
pt_2 = Point(pcen_2.CenterV)
circle_2 = CircleCNR(Center=pt_2, Normal=Vector(0, 0, 1), Radius=number_slider_19)

# ----
# FLOOR
Z_4 = UnitZ(Factor=number_slider_15)
boundary = BoundarySurfaces(Edges=join_3)
neg_4 = Negative(Value=Z_4)
extr = Extrude(Base=boundary, Direction=neg_4)

# ----
# sorted points
midpt_4 = CurveMiddle(Curve=shift)

# ----
# sorted points
midpt_5 = CurveMiddle(Curve=shift_2)

bnd_4 = Bounds(Numbers=midpt_5)

# ----
# FLOOR
Z_5 = UnitZ(Factor=number_slider_15)
boundary_2 = BoundarySurfaces(Edges=join)
neg_5 = Negative(Value=Z_5)
extr_2 = Extrude(Base=boundary_2, Direction=neg_5)

shift_3 = ShiftList(List=debrep_9.Edges, Shift=number_slider_14, Wrap=True)
range = Range(Domain=dom, Steps=number_slider_16)  # disabled
pcen_4 = PolygonCenter(Polyline=srf_7)  # -> CenterV, CenterE, CenterA; disabled

# ----
# CENTER RADIUS
number_slider_20 = Slider(4, range=0..10)
pt_3 = Point(pcen_3.CenterV)
circle_3 = CircleCNR(Center=pt_3, Normal=Vector(0, 0, 1), Radius=number_slider_20)

range_2 = Range(Domain=dom_2, Steps=number_slider_17)  # disabled
pcen_5 = PolygonCenter(Polyline=planesrf_2)  # -> CenterV, CenterE, CenterA; disabled
random = Random(Range=bnd_4, Number=Slider(3, range=0..10), Seed=Slider(6, range=0..10))
bnd_5 = Bounds(Numbers=midpt_4)

# ----
# sorted points
midpt_6 = CurveMiddle(Curve=shift_3)

cir = Circle(Plane=pcen_4.CenterV, Radius=range)  # disabled

# ----
# FLOOR
Z_6 = UnitZ(Factor=number_slider_15)
boundary_3 = BoundarySurfaces(Edges=join_2)
# PATH
neg_6 = Negative(Value=Z_6)
extr_3 = Extrude(Base=boundary_3, Direction=neg_6)

item = ListItem(List=midpt_5, Index=random, Wrap=True)
cir_2 = Circle(Plane=pcen_5.CenterV, Radius=range_2)  # disabled
number_slider_21 = Slider(0.4, range=0..10)  # disabled
bnd_6 = Bounds(Numbers=midpt_6)
points = PointList(Points=midpt_4, Size=Slider(1, range=0..1))
len_4 = Length(Curve=cir)  # disabled
points_2 = PointList(Points=midpt_5, Size=Slider(1, range=0..1))
number_slider_22 = Slider(2, range=0..10)  # disabled
random_2 = Random(Range=bnd_5, Number=Slider(3, range=0..10), Seed=Slider(9, range=0..10))
len_5 = Length(Curve=cir_2)  # disabled
points_3 = PointList(Points=midpt_6, Size=Slider(1, range=0..1))
merge = Merge(Data1=pt_2, Data2=item)  # -> flatten(Result)
random_3 = Random(Range=bnd_6, Number=Slider(3, range=0..10), Seed=Slider(2, range=0..10))
item_2 = ListItem(List=midpt_4, Index=random_2, Wrap=True)
division_8 = Division(A=len_4, B=number_slider_21)  # disabled
division_9 = Division(A=len_5, B=number_slider_22)  # disabled
divide = DivideCurve(Curve=cir, Count=division_8, Kinks=False)  # -> simplify(Points), Tangents, Parameters; disabled
item_3 = ListItem(List=midpt_6, Index=random_3, Wrap=True)
divide_2 = DivideCurve(Curve=cir_2, Count=division_9, Kinks=False)  # -> simplify(Points), Tangents, Parameters; disabled

mst = MST(BasePoints=merge)  # -> PointPointTopology, ConnectionPointTopology, Lines
polyoffset = PolylineOffset(
    Polylines=mst.Lines,
    Distance=Slider(1.59, range=1..3),
    Plane=pt_2,
    Tolerance=0.01,
    ClosedFillet=Slider(0, range=0..2),
    OpenFillet=Slider(0, range=0..2),
    Miter=2)  # -> Contour, Holes
project = Project(Geometry=[polyoffset.Contour, circle_2], Plane=pt_2)  # -> flatten(Geometry), Transform
runion = RegionUnion(Curves=project.Geometry, Plane=pt_2)
reb = RebuildCurve(Curve=runion, Degree=Slider(3, range=0..10), Count=10, Tangents=False)

pline = PolyLine(Vertices=divide.Points, Closed=invert(False))  # disabled
merge_2 = Merge(Data1=pt, Data2=item_2)  # -> flatten(Result)
pline_2 = PolyLine(Vertices=divide_2.Points, Closed=invert(False))  # disabled
merge_3 = Merge(Data1=pt_3, Data2=item_3)  # -> flatten(Result)
lng_4 = ListLength(List=divide.Points)  # -> flatten(Length); disabled

mst_2 = MST(BasePoints=merge_3)  # -> PointPointTopology, ConnectionPointTopology, Lines
polyoffset_2 = PolylineOffset(
    Polylines=mst_2.Lines,
    Distance=Slider(1.59, range=1..3),
    Plane=pt_3,
    Tolerance=0.01,
    ClosedFillet=Slider(0, range=0..2),
    OpenFillet=Slider(0, range=0..2),
    Miter=2)  # -> Contour, Holes
project_2 = Project(Geometry=[polyoffset_2.Contour, circle_3], Plane=pt_3)  # -> flatten(Geometry), Transform
runion_2 = RegionUnion(Curves=project_2.Geometry, Plane=pt_3)

mst_3 = MST(BasePoints=merge_2)  # -> PointPointTopology, ConnectionPointTopology, Lines
polyoffset_3 = PolylineOffset(
    Polylines=mst_3.Lines,
    Distance=Slider(1.59, range=1..3),
    Plane=pt,
    Tolerance=0.01,
    ClosedFillet=Slider(0, range=0..2),
    OpenFillet=Slider(0, range=0..2),
    Miter=2)  # -> Contour, Holes
project_3 = Project(Geometry=[polyoffset_3.Contour, circle], Plane=pt)  # -> flatten(Geometry), Transform
runion_3 = RegionUnion(Curves=project_3.Geometry, Plane=pt)

lng_5 = ListLength(List=divide_2.Points)  # -> flatten(Length); disabled
explode = Explode(Curve=pline, Recursive=True)  # -> Segments, Vertices; disabled
series = Series(Start=0, Step=1, Count=lng_4)  # disabled
explode_2 = Explode(Curve=pline_2, Recursive=True)  # -> Segments, Vertices; disabled
number_slider_23 = Slider(310, range=0..1000)  # disabled
series_2 = Series(Start=0, Step=1, Count=lng_5)  # disabled
pt_4 = Point(flatten(divide.Points))  # disabled
line = Line(flatten(explode.Segments))  # disabled

number_slider_24 = Slider(2, range=0..10)  # disabled
number_slider_25 = Slider(3.474, range=0..10)  # disabled

shift_4 = ShiftList(List=series, Shift=1, Wrap=True)  # disabled
number_slider_26 = Slider(0.18, range=0..5)  # disabled
number_slider_27 = Slider(1000, range=0..1000)  # disabled
number_slider_28 = Slider(1000, range=0..1000)  # disabled
pt_5 = Point(flatten(divide_2.Points))  # disabled
number_slider_29 = Slider(1000, range=0..1000)  # disabled
line_2 = Line(flatten(explode_2.Segments))  # disabled
number_slider_30 = Slider(10, range=0..10)  # disabled
shift_5 = ShiftList(List=explode.Segments, Shift=1, Wrap=True)  # disabled
panel_7 = Panel("0")  # disabled
number_slider_31 = Slider(1000, range=0..1000)  # disabled
shift_6 = ShiftList(List=series_2, Shift=1, Wrap=True)  # disabled
number_slider_32 = Slider(1.59, range=0..5)  # disabled
number_slider_33 = Slider(5.641, range=0..10)  # disabled
number_slider_34 = Slider(1000, range=0..1000)  # disabled
entwine = Entwine(Branch00=line, Branch01=pt_4, FlattenInputs=True)  # disabled
int = Integer(flatten(series))  # disabled
int_2 = Integer(flatten(shift_4))  # disabled
shift_7 = ShiftList(List=explode_2.Segments, Shift=1, Wrap=True)  # disabled
panel_8 = Panel("0")  # disabled
entwine_2 = Entwine(Branch00=line_2, Branch01=pt_5, FlattenInputs=True)  # disabled
int_3 = Integer(flatten(series_2))  # disabled
int_4 = Integer(flatten(shift_6))  # disabled
length_line = LengthLine(Line=flatten(explode.Segments), Length=number_slider_25, Strength=number_slider_24)  # disabled
onmesh = OnMesh(Points=divide.Points, Mesh=srf_7, Strength=number_slider_23)  # disabled
angle = Angle(LineA=explode.Segments, LineB=shift_5, RestAngle=panel_7, Strength=number_slider_29)  # disabled
collider = Collider(Objects=entwine, Radii=number_slider_26, IgnoreA=int, IgnoreB=int_2, Strength=number_slider_28)  # disabled
show = Show(G=pline)  # disabled
length_line_2 = LengthLine(Line=flatten(explode_2.Segments), Length=number_slider_33, Strength=number_slider_30)  # disabled
onmesh_2 = OnMesh(Points=divide_2.Points, Mesh=planesrf_2, Strength=number_slider_27)  # disabled
angle_2 = Angle(LineA=explode_2.Segments, LineB=shift_7, RestAngle=panel_8, Strength=number_slider_34)  # disabled
collider_2 = Collider(Objects=entwine_2, Radii=number_slider_32, IgnoreA=int_3, IgnoreB=int_4, Strength=number_slider_31)  # disabled
show_2 = Show(G=pline_2)  # disabled
reb_2 = RebuildCurve(Curve=runion_3, Degree=Slider(3, range=0..10), Count=10, Tangents=False)
reb_3 = RebuildCurve(Curve=runion_2, Degree=Slider(10, range=0..10), Count=10, Tangents=False)
toggle = BooleanToggle(False)  # disabled
button = Button()  # disabled
entwine_3 = Entwine(Branch00=show, Branch01=[onmesh, length_line, angle, collider], FlattenInputs=True)  # disabled
toggle_2 = BooleanToggle(False)  # disabled
button_2 = Button()  # disabled
entwine_4 = Entwine(Branch00=show_2, Branch01=[onmesh_2, length_line_2, angle_2, collider_2], FlattenInputs=True)  # disabled
solver = Solver(GoalObjects=entwine_3, Reset=button, Threshold=1e-15, Tolerance=0.0001, On=toggle)  # -> I, V, O; disabled
solver_2 = Solver(GoalObjects=entwine_4, Reset=button_2, Threshold=1e-15, Tolerance=0.0001, On=toggle_2)  # -> I, V, O; disabled

# ----
# LOCATION OF BUFFER UNITS
panel_9 = Panel("""5
20
14""")

# ----
# LOCATION OF BUFFER UNITS
panel_10 = Panel("""5
11
14""")

# ----
# LOCATION OF BUFFER UNITS
panel_11 = Panel("""5
14
20""")

# ----
# LOCATION OF BUFFER UNITS
panel_12 = Panel("""5
14
20""")

item_4 = ListItem(List=midpt_4, Index=0, Wrap=True)
item_5 = ListItem(List=midpt_6, Index=0, Wrap=True)
dom_3 = ConstructDomain(DomainStart=Slider(1, range=1..5), DomainEnd=Slider(3.28, range=1..5))
number_slider_35 = Slider(0.2, range=0..1)

# ----
# walkway width
number_slider_36 = Slider(1.07, range=0..10)

radius_openings = Number()
crv_7 = Curve([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])
brep = Brep(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)
join_4 = JoinCurves(Curves=crv_7, Preserve=False)

# ----
# METHOD01-Project Curves - Offset - Ruled
panel_13 = Panel("METHOD02-Meshing - Project")
brep_2 = Brep(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)
crv_8 = Curve([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])
brep_3 = Brep(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)
crv_9 = Curve([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])
project_4 = Project(Geometry=crv_8, Plane=PlaneXY(0, 0, 0))  # -> Geometry, Transform
join_5 = JoinCurves(Curves=crv_9, Preserve=False)
mp = MultiPipe(
    Curves=project_4.Geometry,
    NodeSize=Slider(20, range=0..100),
    EndOffset=1,
    StrutSize=Slider(1, range=0..100),
    Segment=0,
    KinkAngle=0.6,
    CubeFit=0,
    Caps=0)
project_5 = Project(Curve=join_5, Brep=brep_3, Direction=Vector(0, 0, 1), UseTasks=False)  # -> flatten(Curve)
curvepoint = PointOnCurve(project_4.Geometry, parameter=0.5)
subdpoly = SubDControlPolygon(SubD=mp)
xy_3 = XYPlane(Origin=Point(0, 0, 0))
faceb = FaceBoundaries(Mesh=subdpoly)
number_slider_37 = Slider(20, range=0..100)
avr_4 = Average(Input=curvepoint)
pcen_6 = PolygonCenter(Polyline=faceb)  # -> CenterV, CenterE, CenterA
offset_l = OffsetCurveLoose(Curve=project_5, Distance=expr("-x", number_slider_37), Plane=xy_3)
offset_l_2 = OffsetCurveLoose(Curve=project_5, Distance=number_slider_37, Plane=xy_3)
pdecon_4 = Deconstruct(Point=pcen_6.CenterV)  # -> XComponent, YComponent, ZComponent
pdecon_5 = Deconstruct(Point=avr_4)  # -> XComponent, YComponent, ZComponent
rulesrf = RuledSurface(CurveA=offset_l_2, CurveB=offset_l)
larger_4 = LargerThan(FirstNumber=pdecon_4.ZComponent, SecondNumber=pdecon_5.ZComponent)  # -> LargerThan, OrEqualTo
cullf = CullFaces(Mesh=subdpoly, Pattern=larger_4.LargerThan)
Z_7 = UnitZ(Factor=1)
demesh = DeconstructMesh(Mesh=cullf)  # -> Vertices, Faces, Colours, Normals
project_6 = ProjectPoint(Point=demesh.Vertices, Direction=Z_7, Geometry=brep_2)  # -> Point, Index
conmesh = ConstructMesh(Vertices=project_6.Point, Faces=demesh.Faces)

number_slider_38 = Slider(2, range=0..100)
xy_4 = XYPlane(Origin=Point(0, 0, 0))

# ----
# units contour
# FIRE CYARD
geo_4 = Geometry([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])
debrep_10 = DeconstructBrep(Brep=geo_4)  # -> Faces, Edges, Vertices
area_7 = Area(Geometry=debrep_10.Faces)  # -> Area, Centroid
pdecon_6 = Deconstruct(Point=area_7.Centroid)  # -> XComponent, YComponent, ZComponent
panel_14 = Panel(pdecon_6.ZComponent)
panel_15 = Panel(pdecon_6.ZComponent)
ma_4 = MassAddition(Input=panel_14)  # -> Result, PartialResults
lng_6 = ListLength(List=panel_14)
division_10 = Division(A=ma_4.Result, B=lng_6)

# ----
# always sleect the top f
# aces and make sno sense
smaller_7 = SmallerThan(FirstNumber=pdecon_6.ZComponent, SecondNumber=division_10)  # -> SmallerThan, OrEqualTo
larger_5 = LargerThan(FirstNumber=pdecon_6.ZComponent, SecondNumber=division_10)  # -> LargerThan, OrEqualTo
dispatch_7 = Dispatch(List=debrep_10.Faces, DispatchPattern=larger_5.OrEqualTo)  # -> ListA, ListB
srf_8 = Surface(dispatch_7.ListB)

# ----
# remove this when solved
bnd_7 = Bounds(Numbers=flatten(pdecon_6.ZComponent))
dedomain_4 = DeconstructDomain(Domain=bnd_7)  # -> Start, End
subtraction_4 = Subtraction(A=dedomain_4.End, B=dedomain_4.Start)
Z_8 = UnitZ(Factor=subtraction_4)
srf_9 = Surface(dispatch_7.ListA)
neg_7 = Negative(Value=Z_8)
move_4 = Move(Geometry=srf_9, Motion=neg_7)  # -> Geometry, Transform

debrep_11 = DeconstructBrep(Brep=move_4.Geometry)  # -> Faces, Edges, Vertices
area_8 = Area(Geometry=debrep_11.Faces)  # -> Area, flatten(Centroid)
midpt_7 = CurveMiddle(Curve=debrep_11.Edges)
avr_5 = Average(Input=area_8.Centroid)
ln_4 = Line(StartPoint=avr_5, EndPoint=midpt_7)
len_6 = Length(Curve=ln_4)
smaller_8 = SmallerThan(FirstNumber=len_6, SecondNumber=Slider(12.13, range=10..16))  # -> SmallerThan, OrEqualTo
dispatch_8 = Dispatch(List=debrep_11.Edges, DispatchPattern=smaller_8.SmallerThan)  # -> ListA, ListB
crv_10 = Curve(dispatch_8.ListB)

# ----
# curve
crv_11 = Curve(dispatch_8.ListA)

join_6 = JoinCurves(Curves=flatten(crv_11), Preserve=False)
debrep_12 = DeconstructBrep(Brep=join_6)  # -> Faces, Edges, Vertices
shift_8 = ShiftList(List=debrep_12.Edges, Shift=number_slider_10, Wrap=True)

# ----
# center point
pcen_7 = PolygonCenter(Polyline=join_6)  # -> CenterV, CenterE, CenterA

# ----
# CENTER RADIUS
number_slider_39 = Slider(4, range=0..10)
pt_6 = Point(pcen_7.CenterV)
circle_4 = CircleCNR(Center=pt_6, Normal=Vector(0, 0, 1), Radius=number_slider_39)

# ----
# sorted points
midpt_8 = CurveMiddle(Curve=shift_8)

# ----
# FLOOR
Z_9 = UnitZ(Factor=number_slider_15)
boundary_4 = BoundarySurfaces(Edges=join_6)
neg_8 = Negative(Value=Z_9)
extr_4 = Extrude(Base=boundary_4, Direction=neg_8)

bnd_8 = Bounds(Numbers=midpt_8)

points_4 = PointList(Points=midpt_8, Size=Slider(1, range=0..1))

random_4 = Random(Range=bnd_8, Number=Slider(2, range=0..10), Seed=Slider(6, range=0..10))
item_6 = ListItem(List=midpt_8, Index=random_4, Wrap=True)
merge_4 = Merge(Data1=boundary_3, Data2=boundary_2, Data3=boundary_4, Data4=boundary)
debrep_13 = DeconstructBrep(Brep=merge_4)  # -> flatten(Faces), Edges, Vertices

merge_5 = Merge(Data1=pt_6, Data2=item_6)  # -> flatten(Result)
mst_4 = MST(BasePoints=merge_5)  # -> PointPointTopology, ConnectionPointTopology, Lines
polyoffset_4 = PolylineOffset(
    Polylines=mst_4.Lines,
    Distance=Slider(1.59, range=1..3),
    Plane=pt_6,
    Tolerance=0.01,
    ClosedFillet=Slider(0, range=0..2),
    OpenFillet=Slider(0, range=0..2),
    Miter=2)  # -> Contour, Holes
project_7 = Project(Geometry=[polyoffset_4.Contour, circle_4], Plane=pt_6)  # -> flatten(Geometry), Transform
runion_4 = RegionUnion(Curves=project_7.Geometry, Plane=pt_6)
reb_4 = RebuildCurve(Curve=runion_4, Degree=Slider(3, range=0..10), Count=10, Tangents=False)

item_7 = ListItem(List=debrep_13.Faces, Index=0, Wrap=True)  # -> Item, Item1, Item2, Item3
item_8 = ListItem(List=debrep_13.Faces, Index=0, Wrap=True)  # -> Item, Item1, Item2, Item3

area_9 = Area(Geometry=item_7.Item3)  # -> Area, Centroid
cir_3 = Circle(Plane=area_9.Centroid, Radius=Slider(3, range=0..10))
divide_3 = DivideCurve(Curve=cir_3, Count=Slider(4, range=0..10), Kinks=False)  # -> Points, Tangents, Parameters
points_5 = PointList(Points=divide_3.Points, Size=Slider(1.36, range=0..2))

debrep_14 = DeconstructBrep(Brep=item_8.Item3)  # -> Faces, Edges, Vertices
shift_9 = ShiftList(List=debrep_14.Vertices, Shift=Slider(15, range=0..24), Wrap=True)
pline_3 = PolyLine(Vertices=shift_9, Closed=True)
points_6 = PointList(Points=shift_9, Size=Slider(1.39, range=0..10))
debrep_15 = DeconstructBrep(Brep=pline_3)  # -> Faces, Edges, Vertices
midpt_9 = CurveMiddle(Curve=debrep_15.Edges)
item_9 = ListItem(List=midpt_9, Index=0, Wrap=True)
ln_5 = Line(StartPoint=area_9.Centroid, EndPoint=item_9)
ccx = CurveCurve(CurveA=ln_5, CurveB=cir_3)  # -> Points, ParamsA, ParamsB

area_10 = Area(Geometry=item_7.Item)  # -> Area, Centroid
cir_4 = Circle(Plane=area_10.Centroid, Radius=Slider(4, range=0..10))
divide_4 = DivideCurve(Curve=cir_4, Count=Slider(4, range=0..10), Kinks=False)  # -> Points, Tangents, Parameters
points_7 = PointList(Points=divide_4.Points, Size=Slider(1.36, range=0..2))

area_11 = Area(Geometry=item_7.Item2)  # -> Area, Centroid
cir_5 = Circle(Plane=area_11.Centroid, Radius=Slider(3, range=0..10))
divide_5 = DivideCurve(Curve=cir_5, Count=Slider(4, range=0..10), Kinks=False)  # -> Points, Tangents, Parameters
points_8 = PointList(Points=divide_5.Points, Size=Slider(1.36, range=0..2))

area_12 = Area(Geometry=item_7.Item1)  # -> Area, Centroid
cir_6 = Circle(Plane=area_12.Centroid, Radius=Slider(4, range=0..10))
divide_6 = DivideCurve(Curve=cir_6, Count=Slider(4, range=0..10), Kinks=False)  # -> Points, Tangents, Parameters
points_9 = PointList(Points=divide_6.Points, Size=Slider(1.36, range=0..2))

debrep_16 = DeconstructBrep(Brep=item_8.Item2)  # -> Faces, Edges, Vertices
shift_10 = ShiftList(List=debrep_16.Vertices, Shift=Slider(21, range=0..24), Wrap=True)
pline_4 = PolyLine(Vertices=shift_10, Closed=True)
points_10 = PointList(Points=shift_10, Size=Slider(1.39, range=0..10))
debrep_17 = DeconstructBrep(Brep=pline_4)  # -> Faces, Edges, Vertices
midpt_10 = CurveMiddle(Curve=debrep_17.Edges)
item_10 = ListItem(List=midpt_10, Index=[Slider(0, range=0..23), Slider(6, range=0..23)], Wrap=True)
ln_6 = Line(StartPoint=area_11.Centroid, EndPoint=item_10)
ccx_2 = CurveCurve(CurveA=ln_6, CurveB=cir_5)  # -> Points, ParamsA, ParamsB

debrep_18 = DeconstructBrep(Brep=item_8.Item1)  # -> Faces, Edges, Vertices
shift_11 = ShiftList(List=debrep_18.Vertices, Shift=Slider(15, range=0..24), Wrap=True)
pline_5 = PolyLine(Vertices=shift_11, Closed=True)
points_11 = PointList(Points=shift_11, Size=Slider(1.39, range=0..10))
debrep_19 = DeconstructBrep(Brep=pline_5)  # -> Faces, Edges, Vertices
midpt_11 = CurveMiddle(Curve=debrep_19.Edges)
item_11 = ListItem(List=midpt_11, Index=[Slider(0, range=0..23), Slider(18, range=0..23)], Wrap=True)
ln_7 = Line(StartPoint=area_12.Centroid, EndPoint=item_11)
ccx_3 = CurveCurve(CurveA=ln_7, CurveB=cir_6)  # -> Points, ParamsA, ParamsB

debrep_20 = DeconstructBrep(Brep=item_8.Item)  # -> Faces, Edges, Vertices
shift_12 = ShiftList(List=debrep_20.Vertices, Shift=Slider(21, range=0..24), Wrap=True)
pline_6 = PolyLine(Vertices=shift_12, Closed=True)
points_12 = PointList(Points=shift_12, Size=Slider(1.39, range=0..10))
debrep_21 = DeconstructBrep(Brep=pline_6)  # -> Faces, Edges, Vertices
midpt_12 = CurveMiddle(Curve=debrep_21.Edges)
item_12 = ListItem(List=midpt_12, Index=Slider(0, range=0..23), Wrap=True)
ln_8 = Line(StartPoint=area_10.Centroid, EndPoint=item_12)
ccx_4 = CurveCurve(CurveA=ln_8, CurveB=cir_4)  # -> Points, ParamsA, ParamsB

merge_6 = Merge(Data1=pt_3, Data2=pt, Data3=pt_6, Data4=pt_2)  # -> flatten(Result)

number_slider_40 = Slider(113, range=0..1000)
pl_3pt = Plane3Pt(PointA=pt_3, PointB=pt, PointC=pt_6)
planesrf_3 = PlaneSurface(Plane=pl_3pt, XSize=number_slider_40, YSize=number_slider_40)
item_13 = ListItem(List=merge_6, Index=0, Wrap=True)  # -> Item, Item1, Item2
area_13 = Area(Geometry=planesrf_3)  # -> Area, Centroid
pt_7 = Point(item_13.Item2)
orient = Orient(Geometry=planesrf_3, Source=area_13.Centroid, Target=pt_7)  # -> Geometry, Transform
Z_10 = UnitZ(Factor=1)
extr_5 = Extrude(Base=orient.Geometry, Direction=Z_10)

cluster = Cluster(
    pt=ccx_4.Points,
    pt_7=item_12,
    pt_2=ccx_3.Points,
    pt_6=item_11,
    d8=area_10.Centroid,
    d9=area_12.Centroid,
    d10=area_11.Centroid,
    d11=area_9.Centroid,
    pt_3=ccx_2.Points,
    pt_5=item_10,
    pt_4=ccx.Points)

# ----
# CIRCULATION EP
item_14 = ListItem(List=shift_12, Index=panel_9, Wrap=True)
item_15 = ListItem(List=midpt_11, Index=0, Wrap=True)
crv_12 = Curve(cir_4)
area_14 = Area(Geometry=crv_12)  # -> Area, Centroid
crv_cp = CurveClosestPoint(Point=item_14, Curve=crv_12)  # -> Point, Parameter, Distance
merge_7 = Merge(Data1=crv_cp.Point, Data2=item_14, Data3=area_14.Centroid)  # -> flatten(Result)
mst_5 = MST(BasePoints=merge_7)  # -> PointPointTopology, ConnectionPointTopology, Lines
ln_9 = Line(StartPoint=crv_cp.Point, EndPoint=item_14)

# ----
# CIRCULATION WP
item_16 = ListItem(List=shift_11, Index=panel_10, Wrap=True)
item_17 = ListItem(List=midpt_10, Index=0, Wrap=True)
crv_13 = Curve(cir_6)
area_15 = Area(Geometry=crv_13)  # -> Area, Centroid
crv_cp_2 = CurveClosestPoint(Point=item_16, Curve=crv_13)  # -> Point, Parameter, Distance
merge_8 = Merge(Data1=crv_cp_2.Point, Data2=item_16, Data3=area_15.Centroid)  # -> flatten(Result)
mst_6 = MST(BasePoints=merge_8)  # -> PointPointTopology, ConnectionPointTopology, Lines
ln_10 = Line(StartPoint=crv_cp_2.Point, EndPoint=item_16)

# ----
# CIRCULATION WP
item_18 = ListItem(List=shift_10, Index=panel_11, Wrap=True)
item_19 = ListItem(List=midpt_10, Index=0, Wrap=True)
crv_14 = Curve(cir_5)
area_16 = Area(Geometry=crv_14)  # -> Area, Centroid
crv_cp_3 = CurveClosestPoint(Point=item_18, Curve=crv_14)  # -> Point, Parameter, Distance
merge_9 = Merge(Data1=crv_cp_3.Point, Data2=item_18, Data3=area_16.Centroid)  # -> flatten(Result)
mst_7 = MST(BasePoints=merge_9)  # -> PointPointTopology, ConnectionPointTopology, Lines
ln_11 = Line(StartPoint=crv_cp_3.Point, EndPoint=item_18)

# ----
# CIRCULATION WP
item_20 = ListItem(List=shift_9, Index=panel_12, Wrap=True)
item_21 = ListItem(List=midpt_9, Index=0, Wrap=True)
crv_15 = Curve(cir_3)
area_17 = Area(Geometry=crv_15)  # -> Area, Centroid
crv_cp_4 = CurveClosestPoint(Point=item_20, Curve=crv_15)  # -> Point, Parameter, Distance
merge_10 = Merge(Data1=crv_cp_4.Point, Data2=item_20, Data3=area_17.Centroid)  # -> flatten(Result)
mst_8 = MST(BasePoints=merge_10)  # -> PointPointTopology, ConnectionPointTopology, Lines
ln_12 = Line(StartPoint=crv_cp_4.Point, EndPoint=item_20)

# ----
# CENTER PATH
mst_9 = MST(BasePoints=cluster)  # -> PointPointTopology, ConnectionPointTopology, Lines

# ----
# INCLUDE RAMPS HERE!
polyoffset_5 = PolylineOffset(
    Polylines=mst_8.Lines,
    Distance=Slider(0.82, range=0..10),
    Plane=area_17.Centroid,
    Tolerance=0.01,
    ClosedFillet=1,
    OpenFillet=1,
    Miter=2)  # -> Contour, Holes
crv_16 = Curve(pline_3)
crv_17 = Curve(crv_15)
crv_18 = Curve(polyoffset_5.Contour)
runion_5 = RegionUnion(Curves=flatten([crv_18, crv_17]), Plane=area_17.Centroid)
reb_5 = RebuildCurve(Curve=runion_5, Degree=Slider(4, range=0..10), Count=Slider(7, range=0..100), Tangents=False)
rdiff = RegionDifference(CurvesA=crv_16, CurvesB=reb_5, Plane=area_17.Centroid)
crv_19 = Curve(rdiff)

item_22 = ListItem(List=midpt_8, Index=0, Wrap=True)
# RAMP POINTS
merge_11 = Merge(Data1=pt_3, Data2=item_5, Data3=pt, Data4=item_4, Data5=pt_6, Data6=item_22, Data7=pt_2)  # -> flatten(Result)
merge_12 = Merge(Data1=merge_11, Data2=merge_3, Data3=item_2, Data4=item_6, Data5=item)  # -> flatten(Result)
duppt = RemoveDuplicatePts(Points=merge_12, Tolerance=0.01)
mst_10 = MST(BasePoints=merge_11)  # -> PointPointTopology, ConnectionPointTopology, Lines
lng_7 = ListLength(List=duppt)
range_3 = Range(Domain=dom_3, Steps=lng_7)
mst_11 = MST(BasePoints=flatten(duppt))  # -> PointPointTopology, ConnectionPointTopology, Lines
clean = CleanTree(RemoveNulls=True, RemoveInvalid=True, RemoveEmpty=False, Tree=mst_10.Lines)
cir_7 = Circle(Plane=merge_12, Radius=range_3)
polyoffset_6 = PolylineOffset(
    Polylines=mst_11.Lines,
    Distance=Slider(1.59, range=1..3),
    Plane=pl_3pt,
    Tolerance=0.01,
    ClosedFillet=Slider(0, range=0..2),
    OpenFillet=Slider(0, range=0..2),
    Miter=2)  # -> Contour, Holes
boundary_5 = BoundarySurfaces(Edges=polyoffset_6.Contour)
crv_20 = Curve(clean)
runion_6 = RegionUnion(Curves=[cir_7, polyoffset_6.Contour], Plane=pl_3pt)

join_7 = JoinCurves(Curves=crv_20, Preserve=False)
number_slider_41 = Slider(1.5, range=0..10)
pframe = PerpFrame(Curve=reparameterize(join_7), Parameter=Slider(0, range=0..1))
end = EndPoints(Curve=join_7)  # -> Start, End
rectangle = Rectangle(Plane=pframe, XSize=Domain(-1, 1), YSize=Slider(10, range=0..10), Radius=0)  # -> Rectangle, Length
area_18 = Area(Geometry=rectangle.Rectangle)  # -> Area, Centroid
orient_2 = Orient(Geometry=rectangle.Rectangle, Source=area_18.Centroid, Target=end.Start)  # -> Geometry, Transform

number_slider_42 = Slider(1, range=0..10)
join_8 = JoinCurves(Curves=crv_20, Preserve=False)
number_slider_43 = Slider(1.5, range=0..10)
pframe_2 = PerpFrame(Curve=reparameterize(join_8), Parameter=Slider(0, range=0..1))
end_2 = EndPoints(Curve=join_8)  # -> Start, End
rectangle_2 = Rectangle(Plane=pframe_2, XSize=Domain(-1, 1), YSize=Slider(0.2, range=0..1), Radius=0)  # -> Rectangle, Length
area_19 = Area(Geometry=rectangle_2.Rectangle)  # -> Area, Centroid
orient_3 = Orient(Geometry=rectangle_2.Rectangle, Source=area_19.Centroid, Target=end_2.Start)  # -> Geometry, Transform

join_9 = JoinCurves(Curves=crv_20, Preserve=False)
pframe_3 = PerpFrame(Curve=reparameterize(join_9), Parameter=Slider(0, range=0..1))
end_3 = EndPoints(Curve=join_9)  # -> Start, End
rectangle_3 = Rectangle(Plane=pframe_3, XSize=Slider(22, range=0..100), YSize=Slider(0.2, range=0..1), Radius=0)  # -> Rectangle, Length
area_20 = Area(Geometry=rectangle_3.Rectangle)  # -> Area, Centroid
orient_4 = Orient(Geometry=rectangle_3.Rectangle, Source=area_20.Centroid, Target=end_3.Start)  # -> Geometry, Transform

# ----
# fix perpendicularity
swp1 = Sweep1(Rail=join_7, Sections=orient_2.Geometry, Miter=1)
swp1_2 = Sweep1(Rail=join_8, Sections=orient_3.Geometry, Miter=1)

merge_13 = Merge(Data1=extr_3, Data2=extr_2, Data3=extr_4, Data4=extr)
merge_14 = Merge(Data1=boundary_3, Data2=boundary_2, Data3=boundary_4, Data4=boundary)
cap = CapHoles(Brep=merge_13)
cap_2 = CapHoles(Brep=swp1)

# ----
# option 2 MILTIPIPE
# MULTIPIPE FOR OPENINGS
end_4 = EndPoints(Curve=crv_20)  # -> Start, End
merge_15 = Merge(Data1=end_4.Start, Data2=end_4.End)
pdecon_7 = Deconstruct(Point=merge_15)  # -> XComponent, YComponent, ZComponent
dom_4 = ConstructDomain(DomainStart=Slider(1, range=0..25), DomainEnd=Slider(1.5, range=0..25))
bnd_9 = Bounds(Numbers=pdecon_7.XComponent)
remap = RemapNumbers(Value=pdecon_7.XComponent, Source=bnd_9, Target=Domain(0, 1))  # -> Mapped, Clipped
graph = GraphMapper(
    remap.Mapped,
    x0=0,
    x1=1,
    y0=0,
    y1=1,
    container_name="Bezier",
    cpx=[0, 0.9037944674, 0.2178725153, 1],
    cpy=[0, 0.2222495079, 0.938179791, 1])
remap_2 = RemapNumbers(Value=graph, Source=Domain(0, 1), Target=dom_4)  # -> Mapped, Clipped
randomize = RandomizeNumbers(Number=remap_2.Mapped, Ratio=Slider(0.55, range=0..1))
mp_2 = MultiPipe(
    Curves=crv_20,
    NodeSize=Slider(4, range=0..10),
    SizePoints=merge_15,
    EndOffset=1,
    StrutSize=1,
    Segment=0,
    KinkAngle=0.6,
    CubeFit=0)
mp_3 = MultiPipe(
    Curves=crv_20,
    NodeSize=number_slider_36,
    SizePoints=merge_15,
    EndOffset=Slider(0.28, range=0..10),
    StrutSize=1,
    Segment=0,
    KinkAngle=0.6,
    CubeFit=0)
toggle_3 = GroupToggle(ToggleActive=True, ToggleVisible=False)  # disabled

sdiff = SolidDifference(BrepsA=cap, BrepsB=cap_2)
swp1_3 = Sweep1(Rail=join_9, Sections=orient_4.Geometry, Miter=1)
brep_4 = Brep(sdiff)
debrep_22 = DeconstructBrep(Brep=swp1_3)  # -> Faces, Edges, Vertices
area_21 = Area(Geometry=debrep_22.Faces)  # -> Area, Centroid
larger_6 = LargerThan(FirstNumber=area_21.Area, SecondNumber=Slider(153, range=0..1000))  # -> LargerThan, OrEqualTo
dispatch_9 = Dispatch(List=debrep_22.Faces, DispatchPattern=larger_6.OrEqualTo)  # -> ListA, ListB
item_23 = ListItem(List=dispatch_9.ListA, Index=0, Wrap=True)  # -> Item, Item1, Item2, Item3, Item4, Item5, Item6, Item7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
srf_10 = Surface([item_23.Item1, item_23.Item3, item_23.Item5, item_23.Item7, item_23.Item9, item_23.Item11])
join_10 = BrepJoin(Breps=srf_10)  # -> Breps, Closed; disabled
crv_21 = Curve(runion_6)  # disabled
project_8 = Project(Curve=crv_21, Brep=join_10.Breps, Direction=Vector(0, 0, 1), UseTasks=False)  # -> flatten(Curve)

# ----
# MESHING
subd_control_polygon = SubDControlPolygon(SubD=mp_3)
mesh_explode = MeshExplode(Mesh=subd_control_polygon, Interpolate=False)
mesh_area = MeshArea(Mesh=mesh_explode)  # -> Area, Centroid
deconstruct = Deconstruct(Point=mesh_area.Centroid)  # -> XComponent, YComponent, ZComponent
larger_than = LargerThan(FirstNumber=deconstruct.ZComponent, SecondNumber=Slider(20, range=0..100))  # -> LargerThan, OrEqualTo
cull_pattern = CullPattern(List=mesh_explode, CullPattern=larger_than.LargerThan)
pln = Plane(pl_3pt)
project_9 = Project(Geometry=cull_pattern, Plane=pln)  # -> Geometry, Transform
mesh_join = MeshJoin(Meshes=project_9.Geometry)

offset_l_3 = OffsetCurveLoose(Curve=project_8, Distance=expr("-x", number_slider_38), Plane=xy_4)
offset_l_4 = OffsetCurveLoose(Curve=project_8, Distance=number_slider_38, Plane=xy_4)
rulesrf_2 = RuledSurface(CurveA=project_8, CurveB=offset_l_3)
rulesrf_3 = RuledSurface(CurveA=offset_l_4, CurveB=offset_l_3)
weld = WeldMesh(Mesh=mesh_join, Angle=3.141592654)
face_boundaries = FaceBoundaries(Mesh=weld)
runion_7 = RegionUnion(Curves=face_boundaries)
extr_6 = Extrude(Base=runion_7)
project_10 = Project(Curve=runion_7, Brep=merge_14, Direction=Vector(0, 0, 1))

# ==== cluster Cluster
pt = ClusterInput()
pt_2 = ClusterInput()
pt_3 = ClusterInput()
pt_4 = ClusterInput()
pt_5 = ClusterInput()
pt_6 = ClusterInput()
pt_7 = ClusterInput()
d8 = ClusterInput()
d9 = ClusterInput()
d10 = ClusterInput()
d11 = ClusterInput()
pt_8 = Point(pt_5)
pt_9 = Point(pt_6)
pt_10 = Point(pt)
pt_11 = Point(pt_2)
item = ListItem(List=pt_8, Index=0, Wrap=True)
pt_12 = Point(pt_7)
pt_13 = Point(pt_4)
pt_14 = Point(pt_3)
item_2 = ListItem(List=pt_9, Index=0, Wrap=True)
merge = Merge(
    Data1=pt_10,
    Data2=pt_12,
    Data3=pt_11,
    Data4=item_2,
    Data5=pt_14,
    Data6=item,
    Data7=pt_13,
    Data8=d8,
    Data9=d9,
    Data10=d10,
    Data11=d11)  # -> flatten(Result)
R = ClusterOutput(merge)
