# Grasshopper definition units.gh (Grasshopper 1.0.7)
# plug-ins: Speckle 2, Kangaroo2 Components

panel = Panel("https://macad.speckle.xyz/streams/0f1c84ad9c/commits/c4616ae012")
receive = Receive(
    Stream=panel,
    AutoReceive=False,
    CurrentComponentState="expired",
    ExpandOutput=True,
    ReceiveOnOpen=False,
    ReceivedCommitId="c4616ae012",
    StreamWrapper="https://macad.speckle.xyz/streams/0f1c84ad9c/commits/c4616ae012",
    selectedKitName="Objects")  # -> Info, CollectionType, Elements, Name
dso = DeconstructSpeckleObject(SpeckleObject=receive.Elements, selectedKitName="Objects")  # -> CollectionType, DisplayStyle, Elements, Name, Visible
dso_2 = DeconstructSpeckleObject(SpeckleObject=dso.Elements, selectedKitName="Objects")  # -> CollectionType, DisplayStyle, Elements, Name, Visible
dso_3 = DeconstructSpeckleObject(SpeckleObject=dso.DisplayStyle, selectedKitName="Objects")  # -> Color, Linetype, Lineweight, Name, Units
brep = Brep(dso_2.Elements)
debrep = DeconstructBrep()  # -> Faces, Edges, Vertices
scale = Scale(Geometry=debrep.Edges, Center=Point(0, 0, 0), Factor=0.5)  # -> Geometry, Transform
mp = MultiPipe(
    Curves=scale.Geometry,
    NodeSize=Slider(0.07, range=0..0.3),
    EndOffset=1,
    StrutSize=Slider(0.36, range=0..1),
    Segment=0,
    KinkAngle=0.6,
    CubeFit=0,
    Caps=0)
